# Grasshopper definition CEM_1.75_GHPluginExample.gh (Grasshopper 1.0.7)
# plug-ins: CEM_Extract_Structure, CEM_Extract_Topology, CEM_Load, CEM_Optimization_Setup, CEM_Origin_Node, CEM_Bound_Origin_Node, CEM_Constraint_Plane, CEM_Support, CEM_Calculate_Structure, CEM_Deviation, CEM_Target, CEM_Trail, CEM_Bound_Deviation, CEM_Material_Properties, CEM_Build_Topology, CEM_Bound_Trail

# ---- group: CEM_Build_Topology
pointload = Point(flatten([<point referenced from the Rhino model> x4]))
# CEM - Release 1.75
# If you use the library of CEM in a project, please refer to the CEM GitHub repository:
# 
# @Misc{cem2019,
# author = {Ohlbrock, Patrick Ole and D'Acunto, Pierluigi},
# title = {{CEM: Combinatorial Equilibrium Modeling}},
# year = {2019},
# note = {Release 1.75},
# url = { http://github.com/OleOhlbrock/CEM },
# }
trailedge = Curve(flatten([<curve referenced from the Rhino model> x12]))
deviationedge = Curve(flatten([<curve referenced from the Rhino model> x16]))
support = Point(flatten([<point referenced from the Rhino model> x4]))
cem_deviation = CEM_Deviation(DeviationEdge=deviationedge, DeviationMagn=Slider(-2, range=-20..10))
cem_load = CEM_Load(
    PointLoad=pointload,
    LoadMagnX=Slider(0, range=-10..10),
    LoadMagnY=Slider(0, range=-10..10),
    LoadMagnZ=Slider(-3, range=-10..10))
cem_trail = CEM_Trail(TrailEdge=trailedge, TrailLen=Slider(-3, range=-10..10))
cem_support = CEM_Support(Support=support)
cem_build_topology = CEM_Build_Topology(T=cem_trail, L=cem_load, D=cem_deviation, S=cem_support)

# ----
panel = Panel(cem_build_topology)
cem_extract_topology = CEM_Extract_Topology(TP=cem_build_topology)  # -> Nodes, NodesID, Edges, EdgesID, ConstraintPlane, ConstraintPlaneID, OriginNode, OriginNodeID
tag = TextTag3D(Location=cem_extract_topology.Nodes, Text=cem_extract_topology.NodesID, Size=0.25, Colour=RGB(0, 0, 0), Justification=7)
tag_2 = TextTag3D(Location=cem_extract_topology.Edges, Text=cem_extract_topology.EdgesID, Size=0.15, Colour=RGB(0, 0, 0), Justification=7)
targetnode = Panel("""15
13
12
14""")
boundoriginnodeid = Panel("""1
3
6
9""")
series = Series(Start=0, Step=1, Count=11)
series_2 = Series(Start=12, Step=1, Count=16)

# ---- group: CEM_Calculate_Structure
specific_weight_kn_m3 = Slider(73.5, range=5..500)
self_weight = BooleanToggle(True)
yieldstress_kn_m2 = Slider(500000, range=50..1000000)
targetnodes = Point([<point referenced from the Rhino model> x4])
targetnodeid = Integer(targetnode)
targetvector = Vector()
targetvectorid = Integer()
targetvectorcoeffdir = Slider(0, range=0..10000)
boundscoefficientoriginnodex = Slider(0.2, range=0..1000)
bounddevid = Integer(series_2)
list = ValueList({"LD_AUGLAG", "LD_LBFGS", "LD_SLSQP", "LD_TNEWTON", "LN_BOBYQA", "LN_COBYLA", "LN_SBPLX", "GD_MLSL", "GN_MLSL", "GN_ISRES"}, selected="LD_SLSQP")
targetvectorcoeffmag = Slider(0, range=0..10000)
boundoriginnodeid_2 = Integer(boundoriginnodeid)
boundtrailid = Integer(series)
originnodes = Point([<point referenced from the Rhino model> x4])
cem_bound_origin_node = CEM_Bound_Origin_Node(
    BoundOriginNodeID=boundoriginnodeid_2,
    BoundUpOriginNodeX=boundscoefficientoriginnodex,
    BoundLowOriginNodeX=boundscoefficientoriginnodex,
    BoundUpOriginNodeY=boundscoefficientoriginnodex,
    BoundLowOriginNodeY=boundscoefficientoriginnodex)
cem_target = CEM_Target(
    TargetNode=targetnodes,
    TargetNodeID=targetnodeid,
    TargetNodeCoeff=Slider(1, range=0..10000),
    TargetVector=targetvector,
    TargetVectorID=targetvectorid,
    TargetVectorCoeffMag=targetvectorcoeffmag,
    MarshallingSignalParameter=targetvectorcoeffdir)
cem_constraint_plane = CEM_Constraint_Plane(ConstraintPlane=cem_extract_topology.ConstraintPlane, ConstraintPlaneID=cem_extract_topology.ConstraintPlaneID)
cem_bound_trail = CEM_Bound_Trail(BoundTrailID=boundtrailid, BoundUpTrail=Slider(10, range=0..5000), BoundLowTrail=Slider(10, range=0..5000))
cem_bound_deviation = CEM_Bound_Deviation(BoundDevID=bounddevid, BoundUpDev=Slider(20, range=0..5000), BoundLowDev=Slider(20, range=0..5000))
cem_origin_node = CEM_Origin_Node(OriginNode=originnodes, OriginNodeID=cem_extract_topology.OriginNode)
cem_material_properties = CEM_Material_Properties(SelfWeight=self_weight, YieldStress=yieldstress_kn_m2, SpecWeight=specific_weight_kn_m3)
cem_optimization_setup = CEM_Optimization_Setup(
    TO=cem_target,
    BO=cem_bound_origin_node,
    BT=cem_bound_trail,
    BD=cem_bound_deviation,
    GradientDelta=Slider(0.0001, range=0.0001..1),
    RelativeTolerance=Slider(1e-06, range=1e-06..1),
    MaxIterations=Slider(20, range=1..1000),
    OptimAlgorithm=list)
cem_calculate_structure = CEM_Calculate_Structure(
    MarshallingSignalParameter=cem_build_topology,
    CPL=cem_constraint_plane,
    N=cem_origin_node,
    SW=cem_material_properties,
    O=cem_optimization_setup)

# ----
panel_2 = Panel(cem_calculate_structure)
cem_extract_structure = CEM_Extract_Structure(M=cem_calculate_structure)  # -> Nodes, NodesID, Trails, TrailsID, TrailsCol, TrailsMag, Deviations, DeviationsID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
preview = CustomPreview(
    Geometry=[cem_extract_structure.Trails, cem_extract_structure.ExternalForces, cem_extract_structure.Deviations],
    Material=[cem_extract_structure.TrailsCol, cem_extract_structure.ExternalForcesCol, cem_extract_structure.DeviationsCol])
tag_3 = TextTag3D(
    Location=cem_extract_structure.Nodes,
    Text=cem_extract_structure.NodesID,
    Size=0.25,
    Colour=RGB(0, 0, 0),
    Justification=7)
