# Grasshopper definition CEM_2.00_R7.ghx (Grasshopper 1.0.7)

# ---- group: CEM_Build_Topology
support = Point(flatten([<point referenced from the Rhino model> x4]))
# CEM - Release 2.00
# If you use the library of CEM in a project, please refer to the CEM GitHub repository:
# 
# @Misc{cem2021,
# author = {Ohlbrock, Patrick Ole and D'Acunto, Pierluigi},
# title = {{CEM: Combinatorial Equilibrium Modeling}},
# year = {2021},
# note = {Release 2.00},
# url = { http://github.com/OleOhlbrock/CEM },
# }
trailedge = Curve(flatten([<curve referenced from the Rhino model> x12]))
pointload = Point(flatten([<point referenced from the Rhino model> x4]))
deviationedge = Curve(flatten([<curve referenced from the Rhino model> x16]))
cem_deviation_2_0 = GhPythonScript(deviationEdge=flatten(deviationedge), deviationMagn=flatten(Slider(-2, range=-20..10)))  # -> D; inputs deviationEdge: list of Curve, deviationMagn: list
# ---------- cem_deviation_2_0: Python ----------
"""
Defines a new deviation object from inputs
    Inputs:
        deviationEdge: (curves) The curves that define the deviation members in the topological diagram
        deviationMagn: (float) The force magnitudes of the deviation members [kN] (tension-positive, compression-negative) 
    Outputs:
        D: (deviationObject) The constructed deviation object
    Remarks:
        This generates a new instance of the deviation object
"""


__author__    = ['Patrick Ole Ohlbrock','Pierluigi D''Acunto' ]
__copyright__ = 'Copyright 2021 - ETH Zurich and Technical University of Munich'
__license__   = 'MIT License'
__email__     = ['ohlbrock@arch.ethz.ch','pierluigi.dacunto@tum.de']
__version__   = "2.00"

"""
If you use the CEM library in a project, please refer to the GitHub repository: 

@Misc{cem2021,
author = {Ohlbrock, Patrick Ole and D'Acunto, Pierluigi},
title = {{CEM: Combinatorial Equilibrium Modeling}},
year = {2021},
note = {Release 2.00},
url = { http://github.com/OleOhlbrock/CEM },
}

"""


class Deviation(object):
    def __repr__(self):
        return self.ToString()
        
    def __str__(self):
        return self.ToString()
        
    def ToString(self):
        if deviationEdge:
            return "Deviation Member"

if deviationEdge:
    D = Deviation()
    D.geom = []
    D.magn = []
    
    if deviationMagn and None not in deviationMagn:
        if len(deviationEdge) == len(deviationMagn):
            deviationMagnC = []
            for i in range(len(deviationEdge)):
                deviationMagnC.append( deviationMagn[i] )
            D.geom = deviationEdge
            D.magn = deviationMagnC
        elif len(deviationMagn) == 1:
            deviationMagnC = []
            for i in range(len(deviationEdge)):
                deviationMagnC.append( deviationMagn[0] )
            D.geom = deviationEdge
            D.magn = deviationMagnC
        else:
            deviationMagnC = []
            for i in range(len(deviationEdge)):
                deviationMagnC.append( 1 )
            D.geom = deviationEdge
            D.magn = deviationMagnC
    else:
        deviationMagnC = []
        for i in range(len(deviationEdge)):
            deviationMagnC.append( 1 )
        D.geom = deviationEdge
        D.magn = deviationMagnC
# ---------- end cem_deviation_2_0 ----------
cem_load_2_0 = GhPythonScript(
    pointLoad=flatten(pointload),
    loadMagnX=flatten(Slider(0, range=-10..10)),
    loadMagnY=flatten(Slider(0, range=-10..10)),
    loadMagnZ=flatten(Slider(-3, range=-10..10)))  # -> L; inputs pointLoad: list of Point3d, loadMagnX: list, loadMagnY: list, loadMagnZ: list
# ---------- cem_load_2_0: Python ----------
"""
Defines a new point load object from inputs
    Inputs:
        pointLoad: (point) The vertices that define the point loads in the topological diagram
        loadMagnX: (float) The magnitude of the point load in x-direction [kN]
        loadMagnY: (float) The magnitude of the point load in y-direction [kN]
        loadMagnZ: (float) The magnitude of the point load in z-direction [kN]
    Outputs:
        L: (pointLoadObject) The constructed point load object
    Remarks:
        This generates a new instance of the constructed point load object 
"""

__author__    = ['Patrick Ole Ohlbrock','Pierluigi D''Acunto' ]
__copyright__ = 'Copyright 2021 - ETH Zurich and Technical University of Munich'
__license__   = 'MIT License'
__email__     = ['ohlbrock@arch.ethz.ch','pierluigi.dacunto@tum.de']
__version__   = "2.00"

"""
If you use the CEM library in a project, please refer to the GitHub repository: 

@Misc{cem2021,
author = {Ohlbrock, Patrick Ole and D'Acunto, Pierluigi},
title = {{CEM: Combinatorial Equilibrium Modeling}},
year = {2021},
note = {Release 2.00},
url = { http://github.com/OleOhlbrock/CEM },
}

"""


import Rhino


class Load(object):
    def __repr__(self):
        return self.ToString()
        
    def __str__(self):
        return self.ToString()
        
    def ToString(self):
        if pointLoad:
            return "Point Load"
        else:
            return "No external Load"



if pointLoad:
    L = Load()
    L.geom = []
    L.magn = []
    
    if not loadMagnX: loadMagnX.append(0.0)
    if not loadMagnY: loadMagnY.append(0.0)
    if not loadMagnZ: loadMagnZ.append(0.0)
    
    loadMagn = []
    if len(loadMagnX) == len(loadMagnY) == len(loadMagnZ) and None not in loadMagnX and None not in loadMagnY and None not in loadMagnZ:
        if len(pointLoad) == len(loadMagnX):
            for i in range(len(pointLoad)):
                loadMagn.append( (loadMagnX[i],loadMagnY[i],loadMagnZ[i]) )
            L.geom = pointLoad
            L.magn = loadMagn
        elif len(loadMagnX) == 1:
            for i in range(len(pointLoad)):
                loadMagn.append( (loadMagnX[0],loadMagnY[0],loadMagnZ[0]) )
            L.geom = pointLoad
            L.magn = loadMagn
        else:
            for i in range(len(pointLoad)):
                loadMagn.append( (0,0,0) )
            L.geom = pointLoad
            L.magn = loadMagn
    else:
        for i in range(len(pointLoad)):
            loadMagn.append( (0,0,0) )
        L.geom = pointLoad
        L.magn = loadMagn
# ---------- end cem_load_2_0 ----------
cem_trail_2_0 = GhPythonScript(trailEdge=flatten(trailedge), trailLen=flatten(Slider(-3, range=-10..10)))  # -> T; inputs trailEdge: list of Curve, trailLen: list
# ---------- cem_trail_2_0: Python ----------
"""
Defines new trail edges from inputs
    Inputs:
        trailEdge: (curves) The curves (segments) that define the trail members in the topological diagram
        trailLen: (float) The lenghts of the trail members [m] (tension-positive, compression-negative)
    Outputs:
        T: (trailObject) The constructed trail object
    Remarks:
        This generates a new instance of a trail object
"""

__author__    = ['Patrick Ole Ohlbrock','Pierluigi D''Acunto' ]
__copyright__ = 'Copyright 2021 - ETH Zurich and Technical University of Munich'
__license__   = 'MIT License'
__email__     = ['ohlbrock@arch.ethz.ch','pierluigi.dacunto@tum.de']
__version__   = "2.00"

"""
If you use the CEM library in a project, please refer to the GitHub repository: 

@Misc{cem2021,
author = {Ohlbrock, Patrick Ole and D'Acunto, Pierluigi},
title = {{CEM: Combinatorial Equilibrium Modeling}},
year = {2021},
note = {Release 2.00},
url = { http://github.com/OleOhlbrock/CEM },
}

"""

import Rhino


class Trail(object):
    def __repr__(self):
        return self.ToString()
        
    def __str__(self):
        return self.ToString()
        
    def ToString(self):
        if trailEdge:
            return "Trail Member"



if trailEdge:
    T = Trail()
    T.geom = []
    T.len = []
    
    if trailLen and None not in trailLen:
        if len(trailEdge) == len(trailLen):
            trailLenC = []
            for i in range(len(trailEdge)):
                trailLenC.append( trailLen[i] )
            T.geom = trailEdge
            T.len = trailLenC
        elif len(trailLen) == 1:
            trailLenC = []
            for i in range(len(trailEdge)):
                trailLenC.append( trailLen[0] )
            T.geom = trailEdge
            T.len = trailLenC
        else:
            trailLenC = []
            for i in range(len(trailEdge)):
                trailLenC.append( 1 )
            T.geom = trailEdge
            T.len = trailLenC
    else:
        trailLenC = []
        for i in range(len(trailEdge)):
            trailLenC.append( 1 )
        T.geom = trailEdge
        T.len = trailLenC
# ---------- end cem_trail_2_0 ----------
cem_support_2_0 = GhPythonScript(support=flatten(support))  # -> S; inputs support: list of Point3d
# ---------- cem_support_2_0: Python ----------
"""
Defines a new support object from inputs
    Inputs:
        support: (points) The support points in the topological diagram
    Outputs:
        S: (supportObject) The constructed support object 
    Remarks:
        This generates a new instance of the support object
"""


__author__    = ['Patrick Ole Ohlbrock','Pierluigi D''Acunto' ]
__copyright__ = 'Copyright 2021 - ETH Zurich and Technical University of Munich'
__license__   = 'MIT License'
__email__     = ['ohlbrock@arch.ethz.ch','pierluigi.dacunto@tum.de']
__version__   = "2.00"

"""
If you use the CEM library in a project, please refer to the GitHub repository: 

@Misc{cem2021,
author = {Ohlbrock, Patrick Ole and D'Acunto, Pierluigi},
title = {{CEM: Combinatorial Equilibrium Modeling}},
year = {2021},
note = {Release 2.00},
url = { http://github.com/OleOhlbrock/CEM },
}

"""

class Support(object):
    def __repr__(self):
        return self.ToString()
        
    def __str__(self):
        return self.ToString()
        
    def ToString(self):
        if support:
            return "Support"


if support:
    S = Support()
    S.geom = support
# ---------- end cem_support_2_0 ----------
cem_build_topology_2_0 = PythonScript(T=cem_trail_2_0, L=cem_load_2_0, D=cem_deviation_2_0, S=cem_support_2_0)  # -> out, TP; inputs T: list, L: list, D: list, S: list
# ---------- cem_build_topology_2_0: Python ----------
"""
Defines a new topological diagram from inputs
    Inputs:
        T: (trailObjects) Trail members in the topological diagram 
        L: (pointLoadObjects) Point Loads in the topological diagram 
        D: (deviationObjects) Deviation members in the topological diagram 
        S: (supportObjects) Supports in the topological diagram
    Outputs:
        TP: (topological diagram) The constructed topological diagram (empty topology on error)
    Remarks:
        This generates a new instance of the topological diagram
"""

__author__    = ['Patrick Ole Ohlbrock','Pierluigi D''Acunto' ]
__copyright__ = 'Copyright 2021 - ETH Zurich and Technical University of Munich'
__license__   = 'MIT License'
__email__     = ['ohlbrock@arch.ethz.ch','pierluigi.dacunto@tum.de']
__version__   = "2.00"

"""
If you use the CEM library in a project, please refer to the GitHub repository: 

@Misc{cem2021,
author = {Ohlbrock, Patrick Ole and D'Acunto, Pierluigi},
title = {{CEM: Combinatorial Equilibrium Modeling}},
year = {2021},
note = {Release 2.00},
url = { http://github.com/OleOhlbrock/CEM },
}

"""



import System.Drawing.Color
import System.Guid
import Rhino
import rhinoscriptsyntax as rs
db0_T = 0.000001

class topology(object):
    def __repr__(self):
        return self.ToString()
        
    def __str__(self):
        return self.ToString()
        
    def ToString(self):
        if trailMembers and trailMembersID:
            if len(trailMembers) == len(trailMembersID):
                str0_Description = ""
                if hasattr(self, "db1_StructuralBehaviourOut"):
                    str0_Description += "Topological Diagram"
                    return str0_Description
                else:
                    return "Empty topology"
            else:
                return "Empty topology"
        else:
            return "Empty topology"


def ListListToList(xx2_Data):
    xx1_DataOut = []
    for xx1_Data in xx2_Data:
        xx1_DataOut.extend(xx1_Data)
    return xx1_DataOut


TP = topology()


externalForces = []
externalForcesID = []
if L:
    for l in L:
        if l:
            externalForces.extend(l.geom)
            externalForcesID.extend(l.magn)

trailMembers = []
trailMembersID = []
if T:
    for t in T:
        if t:
            trailMembers.extend(t.geom)
            trailMembersID.extend(t.len)


deviationMembers = []
deviationMembersID = []
if D:
    for d in D:
        if d:
            deviationMembers.extend(d.geom)
            deviationMembersID.extend(d.magn)

supports = []
if S:
    for s in S:
        if s:
            supports.extend(s.geom)



if trailMembers and trailMembersID or deviationMembers and deviationMembersID:
    if len(trailMembers) == len(trailMembersID) and len(deviationMembers) == len(deviationMembersID) and len(externalForces) == len(externalForcesID):

        # Create List of Nodes and trailMembers' Connectivity
        pt1_Node = []
        pt1_NodeRes = []
        int2_Trail = []
        int2_Deviation = []
        int2_ExtForce = []
        
        if trailMembers and trailMembersID:
            pt1_Node.append(trailMembers[0].PointAtStart)


        # Create support trails if support is detached from any trail
        int1_numoftrails = (len(trailMembers))
        for i in range(len(supports)):
            if int1_numoftrails >= 1:
                for j in range(len(trailMembers)):
                    bl0_Check = False
                    pt0_Start = trailMembers[j].PointAtStart
                    pt0_End = trailMembers[j].PointAtEnd
                    if (abs(pt0_Start.X - supports[i].X) < db0_T and abs(pt0_Start.Y - supports[i].Y) < db0_T and abs(pt0_Start.Z - supports[i].Z) < db0_T) or (abs(pt0_End.X - supports[i].X) < db0_T and abs(pt0_End.Y - supports[i].Y) < db0_T and abs(pt0_End.Z - supports[i].Z) < db0_T):
                        bl0_Check = True
                        break
                if bl0_Check == False:
                    ln0_TrailAux = Rhino.Geometry.Line(supports[i],Rhino.Geometry.Vector3d(0,0,10*db0_T))
                    crv0_TrailAux = Rhino.Geometry.LineCurve(ln0_TrailAux)
                    trailMembers.append(crv0_TrailAux)
                    trailMembersID.append(1.0)
            else:
                ln0_TrailAux = Rhino.Geometry.Line(supports[i],Rhino.Geometry.Vector3d(0,0,10*db0_T))
                crv0_TrailAux = Rhino.Geometry.LineCurve(ln0_TrailAux)
                trailMembers.append(crv0_TrailAux)
                trailMembersID.append(1.0)


        
        # Nodes and Egdes from trailMembers
        for crv0_Trail in trailMembers:
            int1_Trail = []
            pt0_Start = crv0_Trail.PointAtStart
            bl0_Check = False
            for i in range(len(pt1_Node)):
                if abs(pt0_Start.X - pt1_Node[i].X) < db0_T and abs(pt0_Start.Y - pt1_Node[i].Y) < db0_T and abs(pt0_Start.Z - pt1_Node[i].Z) < db0_T:
                    int1_Trail.append(i)
                    bl0_Check = True
                    break
            if bl0_Check == False:
                pt1_Node.append(pt0_Start)
                int1_Trail.append(len(pt1_Node)-1)
            pt0_End = crv0_Trail.PointAtEnd
            bl0_Check = False
            for i in range(len(pt1_Node)):
                if abs(pt0_End.X - pt1_Node[i].X) < db0_T and abs(pt0_End.Y - pt1_Node[i].Y) < db0_T and abs(pt0_End.Z - pt1_Node[i].Z) < db0_T:
                    int1_Trail.append(i)
                    bl0_Check = True
                    break
            if bl0_Check == False:
                pt1_Node.append(pt0_End)
                int1_Trail.append(len(pt1_Node)-1)
            int2_Trail.append(int1_Trail)
        
        # Nodes and Egdes from deviatioMembers
        for crv0_Deviation in deviationMembers:
            int1_Deviation = []
            
            pt0_Start = crv0_Deviation.PointAtStart
            bl0_Check = False
            bl0_CheckRes = False
            for i in range(len(pt1_Node)):
                if abs(pt0_Start.X - pt1_Node[i].X) < db0_T and abs(pt0_Start.Y - pt1_Node[i].Y) < db0_T and abs(pt0_Start.Z - pt1_Node[i].Z) < db0_T:
                    int1_Deviation.append(i)
                    bl0_Check = True
                    break
            for i in range(len(pt1_NodeRes)):
                if abs(pt0_Start.X - pt1_NodeRes[i].X) < db0_T and abs(pt0_Start.Y - pt1_NodeRes[i].Y) < db0_T and abs(pt0_Start.Z - pt1_NodeRes[i].Z) < db0_T:
                    int1_Deviation.append(i+len(pt1_Node))
                    bl0_CheckRes = True
                    break
            if bl0_Check == False and bl0_CheckRes == False:
                pt1_NodeRes.append(pt0_Start)
                int1_Deviation.append(len(pt1_Node) + len(pt1_NodeRes)-1)
            points_a = pt1_NodeRes
            pt0_End = crv0_Deviation.PointAtEnd
            bl0_Check = False
            bl0_CheckRes = False
            for i in range(len(pt1_Node)):
                if abs(pt0_End.X - pt1_Node[i].X) < db0_T and abs(pt0_End.Y - pt1_Node[i].Y) < db0_T and abs(pt0_End.Z - pt1_Node[i].Z) < db0_T:
                    int1_Deviation.append(i)
                    bl0_Check = True
                    break
            for i in range(len(pt1_NodeRes)):
                if abs(pt0_End.X - pt1_NodeRes[i].X) < db0_T and abs(pt0_End.Y - pt1_NodeRes[i].Y) < db0_T and abs(pt0_End.Z - pt1_NodeRes[i].Z) < db0_T:
                    int1_Deviation.append(i+len(pt1_Node))
                    bl0_CheckRes = True
                    break
            if bl0_Check == False and bl0_CheckRes == False:
                pt1_NodeRes.append(pt0_End)
                int1_Deviation.append(len(pt1_Node)+len(pt1_NodeRes)-1)
            int2_Deviation.append(int1_Deviation)

        # Add Residual Forces from Auxiliary Trails
        crv1_TrailAux = []
        for i in range(len(pt1_NodeRes)):
            ln0_TrailAux = Rhino.Geometry.Line(pt1_NodeRes[i],Rhino.Geometry.Vector3d(0,0,1))
            crv0_TrailAux = Rhino.Geometry.LineCurve(ln0_TrailAux)
            crv1_TrailAux.append(crv0_TrailAux)
            trailMembers.append(crv0_TrailAux)
            trailMembersID.append(0.0)
            

        # Extend  list of nodes
        pt1_Node.extend(pt1_NodeRes)
        
        # Nodes and Egdes from trailMembers
        pt1_NodeResEnd = []
        for crv0_Trail in crv1_TrailAux:
            int1_Trail = []
            pt0_Start = crv0_Trail.PointAtStart
            pt0_End = crv0_Trail.PointAtEnd
            bl0_Check = False
            for i in range(len(pt1_Node)):
                if abs(pt0_Start.X - pt1_Node[i].X) < db0_T and abs(pt0_Start.Y - pt1_Node[i].Y) < db0_T and abs(pt0_Start.Z - pt1_Node[i].Z) < db0_T:
                    int1_Trail.append(i)
                    int1_Trail.append(i+len(pt1_NodeRes))
                    pt1_NodeResEnd.append(pt0_End)
                    bl0_Check = True
                    break
            int2_Trail.append(int1_Trail)
        pt1_Node.extend(pt1_NodeResEnd)
        
        # Deviation
        crv1_DeviationClean = []
        id1_DeviationClean = []
        for k in range(len(deviationMembers)):
            pt0_StartDeviation = deviationMembers[k].PointAtStart
            pt0_EndDeviation = deviationMembers[k].PointAtEnd
            for i in range(len(pt1_Node)):
                if abs(pt0_StartDeviation.X - pt1_Node[i].X) < db0_T and abs(pt0_StartDeviation.Y - pt1_Node[i].Y) < db0_T and abs(pt0_StartDeviation.Z - pt1_Node[i].Z) < db0_T:
                    for j in range(len(pt1_Node)):
                        if abs(pt0_EndDeviation.X - pt1_Node[j].X) < db0_T and abs(pt0_EndDeviation.Y - pt1_Node[j].Y) < db0_T and abs(pt0_EndDeviation.Z - pt1_Node[j].Z) < db0_T:
                            crv1_DeviationClean.append(deviationMembers[k])
                            id1_DeviationClean.append(deviationMembersID[k])
                            int1_Deviation = []
                            int1_Deviation.append(i)
                            int1_Deviation.append(j)
                            int2_Deviation.append(int1_Deviation)
                            break
                    break
        deviationMembers = crv1_DeviationClean
        deviationMembersID = id1_DeviationClean
        
        # External Force
        pt1_ExtForceClean = []
        External_Forces_IDClean = []
        for k in range(len(externalForces)):
            for i in range(len(pt1_Node)):
                if abs(externalForces[k].X - pt1_Node[i].X) < db0_T and abs(externalForces[k].Y - pt1_Node[i].Y) < db0_T and abs(externalForces[k].Z - pt1_Node[i].Z) < db0_T:
                    pt1_ExtForceClean.append(externalForces[k])
                    External_Forces_IDClean.append(externalForcesID[k])
                    int2_ExtForce.append(i)
                    break
        
        externalForces = pt1_ExtForceClean
        externalForcesID = External_Forces_IDClean

        
        # Extract Attributes External Forces
        st2_externalForcesID = []
        for i in range(len(externalForcesID)):
            st1_externalForcesID = []
            for j in range(len(externalForcesID[i])):
                st1_externalForcesID.append(str(externalForcesID[i][j]))
            st2_externalForcesID.append(st1_externalForcesID)
        str2_ExtForceAtt = st2_externalForcesID

        # Extract Attributes trailMembers
        str1_TrailAtt = [str(x) for x in trailMembersID]

        # Extract Attributes Deviation
        str1_DeviationAtt = [str(x) for x in deviationMembersID]
        
        
        # Create Dictionary of trailMembers' Ends
        dc2_TrailEnds = {}
        for i in range(len(int2_Trail)):
            dc2_TrailEnds[str(i)] = [str(x) for x in int2_Trail[i]]
        
        # Create Dictionary of trailMembers' Attributes
        dc1_TrailAtt = {}
        for i in range(len(str1_TrailAtt)):
            dc1_TrailAtt[str(i)] = str1_TrailAtt[i]
                
        # Create Dictionary of External Forces' End
        dc1_ExtForceEnds = {}
        for i in range(len(int2_ExtForce)):
            dc1_ExtForceEnds[str(i)] = str(int2_ExtForce[i])
        
        # Create Dictionary of External Forces' Attributes
        dc2_ExtForceAtt = {}
        for i in range(len(str2_ExtForceAtt)):
            dc2_ExtForceAtt[str(i)] = [float(x) for x in str2_ExtForceAtt[i]]

        # Create Dictionary of External Forces' Attributes and Labels
        dc2_ExtForce = dc2_ExtForceAtt.copy()
        for key in dc2_ExtForce:
            dc2_ExtForce[key].append(dc1_ExtForceEnds[key])

        
        # Create Lists of Node-Node Connectivity from trailMembers
        int2_Node = []
        for pt0_Node in pt1_Node:
            int1_Node = []
            int2_Node.append(int1_Node)
        for int1_Trail in int2_Trail:
            int2_Node[int1_Trail[0]].append(int1_Trail[1])
            int2_Node[int1_Trail[1]].append(int1_Trail[0])
        
        
        # Create Lists of Deviations' Ends and Attributes
        str2_Deviation = []
        for i in range(len(str1_DeviationAtt)):
            str2_Deviation.append( [str(item) for item in int2_Deviation[i] ] )
            str2_Deviation[i].extend([str1_DeviationAtt[i]])
        
        # Convert Trail Input into Polylines
        ln1_Trail = []
        for crv0_Trail in trailMembers:
            if crv0_Trail is Rhino.Geometry.Line:
                ln1_Trail.append(crv0_Trail)
            else:
                ln1_Trail.append(Rhino.Geometry.Line(crv0_Trail.PointAtStart, crv0_Trail.PointAtEnd))
        
        trailMembers = []
        for ln0_Trail in ln1_Trail:
            trailMembers.append(ln0_Trail.ToNurbsCurve())
        
        plc1_Trail = Rhino.Geometry.Curve.JoinCurves(trailMembers)
        
        pln1_Trail = []
        for plc0_Trail in plc1_Trail:
            pln1_Trail.append(plc0_Trail.TryGetPolyline()[1])
        
        
        # Check supports
        pt1_SupportClean = []
        for j in range(len(pln1_Trail)):
            if supports:
                pt1_SupportClean.append(pln1_Trail[j][len(pln1_Trail[j])-1])
                for i in range(len(supports)):
                    if abs(pln1_Trail[j][0].X - supports[i].X) < db0_T and abs(pln1_Trail[j][0].Y - supports[i].Y) < db0_T and abs(pln1_Trail[j][0].Z - supports[i].Z) < db0_T:
                        pt1_SupportClean[j] = pln1_Trail[j][0]
                        pln1_Trail[j].Reverse()
            else:
                pt1_SupportClean.append(pln1_Trail[j][len(pln1_Trail[j])-1])
        supports = pt1_SupportClean
        
        
        # Find Node Indexes of supports
        int1_Support = []
        for pt0_Support in supports:
            for i in range(len(pt1_Node)):
                if abs(pt0_Support.X - pt1_Node[i].X) < db0_T and abs(pt0_Support.Y - pt1_Node[i].Y) < db0_T and abs(pt0_Support.Z - pt1_Node[i].Z) < db0_T:
                    int1_Support.append(i)
                    break
        
        # Create Graph (Dictionary of Node-Node Connectivity from trailMembers)
        dc2_Node = {}
        for i in range(len(int2_Node)):
            dc2_Node[str(i)] = [str(x) for x in int2_Node[i]]
        
        int2_TrailPoly = []
        for pln0_Trail in pln1_Trail:
            int1_TrailPoly = []
            for i in range(len(pln0_Trail)):
                for k in range(len(pt1_Node)):
                    if abs(pln0_Trail[i].X - pt1_Node[k].X) < db0_T and abs(pln0_Trail[i].Y - pt1_Node[k].Y) < db0_T and abs(pln0_Trail[i].Z - pt1_Node[k].Z) < db0_T:
                        int1_TrailPoly.append(k)
                        break
            int2_TrailPoly.append(list(reversed(int1_TrailPoly)))
        
        dc2_ShortPath = {}

        for i in range(len(pt1_Node)):
            for int1_TrailPoly in int2_TrailPoly:
                if i in int1_TrailPoly:
                    str1_ShortPath = ["S"]
                    str1_ShortPath.extend(map(str, int1_TrailPoly[:int1_TrailPoly.index(i)+1]))
                    dc2_ShortPath[str(i)] = str1_ShortPath
                    break
        
        dc1_ShortPathDist = {}
        dc2_ShortPathDistGrade = {}
        
        for i in range(len(pt1_Node)):
            for pln0_Trail in pln1_Trail:
                for j in range(len(pln0_Trail)):
                    if abs(pln0_Trail[j].X - pt1_Node[i].X) < db0_T and abs(pln0_Trail[j].Y - pt1_Node[i].Y) < db0_T and abs(pln0_Trail[j].Z - pt1_Node[i].Z) < db0_T:
                        dc1_ShortPathDist[str(i)] = len(pln0_Trail) - j
                        break
        

        # Define Sequences
        for key in dc1_ShortPathDist:
            if dc1_ShortPathDist[key] not in dc2_ShortPathDistGrade:
                dc2_ShortPathDistGrade[dc1_ShortPathDist[key]] = [key]
            else:
                dc2_ShortPathDistGrade[dc1_ShortPathDist[key]].extend([key])
        
        
        # Separate Deviation1 (direct) and Deviation2 (indirect-bracing)
        
        dc2_Deviation1Ends = {}
        dc2_Deviation2Ends = {}
        
        dc1_Deviation1Att = {}
        dc1_Deviation2Att = {}
        
        int2_Deviation1 = []
        str2_Deviation2 = []
        
        crv1_Deviation1 = []
        crv1_Deviation2 = []
        
        int1_Deviation1ID = []
        int1_Deviation2ID = []
        
        j = 0
        k = 0
        
        
        for i in range(len(str2_Deviation)):
            if dc1_ShortPathDist[ str(str2_Deviation[i][0]) ] == dc1_ShortPathDist[ str(str2_Deviation[i][1]) ]:
                dc2_Deviation1Ends[str(j)] = [str(str2_Deviation[i][0]),str(str2_Deviation[i][1])]
                dc1_Deviation1Att[str(j)] = str(str2_Deviation[i][2])
                int2_Deviation1.append([int(str2_Deviation[i][0]),int(str2_Deviation[i][1])])
                crv1_Deviation1.append(deviationMembers[i])
                int1_Deviation1ID.append(i)
                j += 1
            else:
                dc2_Deviation2Ends[str(k)] = [str(str2_Deviation[i][0]),str(str2_Deviation[i][1])]
                dc1_Deviation2Att[str(k)] = str(str2_Deviation[i][2])
                str2_Deviation2.append(str2_Deviation[i])
                crv1_Deviation2.append(deviationMembers[i])
                int1_Deviation2ID.append(i)
                k += 1

        
        # Create Dictionary of Trail and Deviation 1 for Structural Matrix
        dc2_EdgeEnds = {}
        dc2_TrailEndsOut = dc2_TrailEnds.copy()
        dc2_Deviation1EndsOut = {}
        
        for key in dc2_TrailEnds:
            dc2_EdgeEnds[str(int(key))] = dc2_TrailEnds[key]
        for key in dc2_Deviation1Ends:
            dc2_EdgeEnds[str(int(key)+len(dc2_TrailEnds))] = dc2_Deviation1Ends[key]
            dc2_Deviation1EndsOut[str(int(key)+len(dc2_TrailEnds))] = dc2_Deviation1Ends[key]
            
        dc1_EdgeAtt = {}
        for key in dc1_TrailAtt:
            dc1_EdgeAtt[str(int(key))] = dc1_TrailAtt[key]
        for key in dc1_Deviation1Att:
            dc1_EdgeAtt[str(int(key)+len(dc1_TrailAtt))] = dc1_Deviation1Att[key]
        
        # Create Dictionary of Trail and Deviation 1 and 2 for Visualization
        dc1_Edge = {}
        for key in dc1_TrailAtt:
            dc1_Edge[str(int(key))] = dc1_TrailAtt[key]
        for key in dc1_Deviation1Att:
            dc1_Edge[str(int(key)+len(dc1_TrailAtt))] = dc1_Deviation1Att[key]
        for key in dc1_Deviation2Att:
            dc1_Edge[str(int(key)+len(dc1_TrailAtt)+len(dc1_Deviation1Att))] = dc1_Deviation2Att[key]
        

        # Update Lists of Node-Node Connectivity from Deviation 1
        for int1_DevTemp in int2_Deviation1:
            int2_Node[int1_DevTemp[0]].append(int1_DevTemp[1])
            int2_Node[int1_DevTemp[1]].append(int1_DevTemp[0])
        
        
        # Create Graph (Dictionary of Node-Node Connectivity from trailMembers)
        for i in range(len(int2_Node)):
            dc2_Node[str(i)] = [str(x) for x in int2_Node[i]]
        
        
        ## Create Dictionaries for Structural Matrix
        dc1_NodeTrailOut = {}
        dc1_NodeTrailIn = {}
        dc2_NodeDeviation = {}
        dc1_NodeExtForce = {}
        dc1_NodeExtForceAtt = {}
        int0_NodeTrailIn = {}

        
        # Trail In and Out
        for key in dc2_ShortPath:
            dc1_NodeTrailOut[key] = dc2_ShortPath[key][len(dc2_ShortPath[key])-2]
        
        int0_ShortPathDistGradeMax = max(dc2_ShortPathDistGrade)
        
        for key in dc1_NodeTrailOut:
            if dc1_NodeTrailOut[key] == "S": dc1_NodeTrailOut[key] = dc1_NodeTrailOut[key] + key
            dc1_NodeTrailIn[dc1_NodeTrailOut[key]] = key

        for key in dc1_NodeTrailOut:
            if key not in dc1_NodeTrailIn:
                str0_Key = "W" + key
                for i in range(int0_ShortPathDistGradeMax - dc1_ShortPathDist[key] + 1):
                    dc1_NodeTrailIn[str0_Key[1:]] = str0_Key
                    str0_Key = "L" + str0_Key

        
        for key in dc1_NodeTrailIn:
            if "L" + key not in dc1_NodeTrailOut:
                dc1_NodeTrailOut[dc1_NodeTrailIn[key]] = key
        
        # Deviation
        for key in dc2_Node:
            str1_v = []
            for v in dc2_Node[key]:
                if v != dc1_NodeTrailOut[key] and v != dc1_NodeTrailIn[key]:
                    str1_v.append(v)
            dc2_NodeDeviation[key] = str1_v
        
        # External Forces
        for key in dc1_ExtForceEnds:
            if dc1_ExtForceEnds[key] not in dc1_NodeExtForce:
                dc1_NodeExtForce[dc1_ExtForceEnds[key]] = [key]
            else:
                dc1_NodeExtForce[dc1_ExtForceEnds[key]].append(key)

        for key in dc1_NodeExtForce:
            for v in dc1_NodeExtForce[key]:
                if dc1_ExtForceEnds[v] not in dc1_NodeExtForceAtt:
                    dc1_NodeExtForceAtt[key] = [dc2_ExtForceAtt[v]]
                else:
                    dc1_NodeExtForceAtt[key].append(dc2_ExtForceAtt[v])

        
        ## Create Structural Matrix According to Weight
        
        # Initialize Matrix with Indices
        str2_StructuralMatrix = []
        str1_NodeOrderMatrix = []
        str2_NodeOrderMatrix = []
        
        str1_NodeOrder = dc2_ShortPathDistGrade[1]

        for i in sorted(range(1,len(dc2_ShortPathDistGrade)+1)):
            str1_NodeOrderUp = []
            str2_NodeOrderMatrix.append(str1_NodeOrder)
            for str0_NodeOrder in str1_NodeOrder:
                str1_NodeOrderMatrix.append(str0_NodeOrder)
                if str0_NodeOrder[0] != "W":
                    str2_StructuralMatrix.append(["0"]*(3+len(str1_NodeOrder)+1))
                    str1_NodeOrderUp.append(dc1_NodeTrailIn[str0_NodeOrder])
                    
                else:
                    str2_StructuralMatrix.append(["0"]*(3+len(str1_NodeOrder)+1))
                    str1_NodeOrderUp.append("W" + str0_NodeOrder)
                    dc1_NodeTrailIn[str0_NodeOrder] = str0_NodeOrder[1:]
                    dc2_EdgeEnds[str0_NodeOrder.replace("W","E")] = [str0_NodeOrder[1:], str0_NodeOrder]
                    dc2_TrailEndsOut[str0_NodeOrder.replace("W","E")] = [str0_NodeOrder[1:], str0_NodeOrder]
            str1_NodeOrder = str1_NodeOrderUp
            
        int0_NodeOrderMatrix = len(str2_NodeOrderMatrix[0])
        
        # Add Attributes Auxiliary Trails
        for key in dc2_EdgeEnds: 
            if key[0] == "E": dc1_EdgeAtt[key] = "0.0"
        
        # Add Attribute Trail Out
        for key in dc2_EdgeEnds:
            if dc2_EdgeEnds[key][0] in dc1_NodeTrailOut and dc2_EdgeEnds[key][1] == dc1_NodeTrailOut[dc2_EdgeEnds[key][0]]:
                int0_NodeIndex = str1_NodeOrderMatrix.index(dc2_EdgeEnds[key][0])
                str2_StructuralMatrix[int0_NodeIndex][len(str2_StructuralMatrix[int0_NodeIndex])-1] = dc1_EdgeAtt[key]
            elif dc2_EdgeEnds[key][1] in dc1_NodeTrailOut and dc2_EdgeEnds[key][0] == dc1_NodeTrailOut[dc2_EdgeEnds[key][1]]:
                int0_NodeIndex = str1_NodeOrderMatrix.index(dc2_EdgeEnds[key][1])
                str2_StructuralMatrix[int0_NodeIndex][len(str2_StructuralMatrix[int0_NodeIndex])-1] = dc1_EdgeAtt[key]
        
        # Add Attribute Deviation
        for key in dc2_EdgeEnds:
            if dc2_EdgeEnds[key][0] in dc2_NodeDeviation and dc2_EdgeEnds[key][1] in dc2_NodeDeviation[dc2_EdgeEnds[key][0]]:
                int0_NodeIndex = str1_NodeOrderMatrix.index(dc2_EdgeEnds[key][0])
                int0_NodeIndexTo = str1_NodeOrderMatrix.index(dc2_EdgeEnds[key][1])
                int0_NodeIndexRaw = (int0_NodeIndexTo) % int0_NodeOrderMatrix
                str2_StructuralMatrix[int0_NodeIndex][3 + int0_NodeIndexRaw] = dc1_EdgeAtt[key]
            if dc2_EdgeEnds[key][1] in dc2_NodeDeviation and dc2_EdgeEnds[key][0] in dc2_NodeDeviation[dc2_EdgeEnds[key][1]]:
                int0_NodeIndex = str1_NodeOrderMatrix.index(dc2_EdgeEnds[key][1])
                int0_NodeIndexTo = str1_NodeOrderMatrix.index(dc2_EdgeEnds[key][0])
                int0_NodeIndexRaw = (int0_NodeIndexTo) % int0_NodeOrderMatrix
                str2_StructuralMatrix[int0_NodeIndex][3 + int0_NodeIndexRaw] = dc1_EdgeAtt[key]
        
        # Order Matrix
        str2_StructuralMatrixOrder = []
        int1_StructuralMatrixOrder = []
        str2_NodeOrderMatrixReversed = []
        
        for i in reversed(range(1,len(str2_NodeOrderMatrix)+1)):
            for j in range(int0_NodeOrderMatrix):
                int0_Index = int0_NodeOrderMatrix*(i-1)+j
                if i != len(str2_NodeOrderMatrix):
                    int1_StructuralMatrixOrder.append(str2_NodeOrderMatrix[i-1][j])
                str2_StructuralMatrixOrder.append(str2_StructuralMatrix[int0_NodeOrderMatrix*(i-1)+j])
        
        for i in reversed(range(1,len(str2_NodeOrderMatrix)+1)):
            str1_NodeOrderMatrixReversed = []
            for j in range(int0_NodeOrderMatrix):
                str1_NodeOrderMatrixReversed.append(str2_NodeOrderMatrix[i-1][j])
            str2_NodeOrderMatrixReversed.append(str1_NodeOrderMatrixReversed)

        
        # Substitute Node Index with Matrix Index in Deviation2
        str1_Deviation2 = ListListToList(str2_Deviation2)
        str1_NodeOrder = ListListToList(str2_NodeOrderMatrixReversed)
        
        str1_NodeOrderOut = str1_NodeOrder[:]
        
        # Edge-Node List
        dc2_EdgeEndsComplete = {}
        dc2_EdgeEndsComplete = dict(dc2_EdgeEnds)
        dc2_Deviation2EndsOut = {}
        
        
        int0_EdgeEndsLen = len([k for k in dc2_EdgeEndsComplete if not k.startswith('E')])
        
        for i in range(0,len(str1_Deviation2),3):
            dc2_EdgeEndsComplete[str( int(int0_EdgeEndsLen+i/3) )] = [str1_Deviation2[i],str1_Deviation2[i+1]]
            dc2_Deviation2EndsOut[str( int(int0_EdgeEndsLen+i/3) )] = [str1_Deviation2[i],str1_Deviation2[i+1]]
                
        for i in range(len(str1_Deviation2)):
            if (i+1) % 3 != 0:
                str1_Deviation2[i] = str1_NodeOrder.index(str(str1_Deviation2[i]))

        
        ## Output
        str1_DeviationIndirectOut = str1_Deviation2
        str1_StructuralBehaviourOut = ListListToList(str2_StructuralMatrixOrder)


        ## Visualization
        
        # Nodes
        pt1_NodeOut = pt1_Node
        pt1_TargetOut = pt1_NodeOut
        str1_NodeOut = ["V" + str(i) + " (" + str(dc1_ShortPathDist[str(i)]) + ")" for i in range(len(pt1_Node))]
        str1_TargetOut = [str(i) for i in range(len(pt1_Node))]
        
        # Edges
        crv1_Edge = []
        crv1_Trail = []
        crv1_Deviation = []
        for crv0_Trail in trailMembers:
            crv1_Edge.append(crv0_Trail)
            crv1_Trail.append(crv0_Trail)
        for crv0_Deviation1 in crv1_Deviation1: 
            crv1_Edge.append(crv0_Deviation1)
            crv1_Deviation.append(crv0_Deviation1)
        for crv0_Deviation2 in crv1_Deviation2: 
            crv1_Edge.append(crv0_Deviation2)
            crv1_Deviation.append(crv0_Deviation2)
        
        crv1_EdgeOut = crv1_Edge
        crv1_TrailOut = crv1_Trail
        crv1_DeviationOut = crv1_Deviation
        
        pt1_EdgeOut = [crv0_Edge.PointAtNormalizedLength(0.6) for crv0_Edge in crv1_EdgeOut]
        pt1_TrailOut = [crv0_Trail.PointAtNormalizedLength(0.6) for crv0_Trail in crv1_TrailOut]
        pt1_DeviationOut = [crv0_Deviation.PointAtNormalizedLength(0.6) for crv0_Deviation in crv1_DeviationOut]
        
        str1_EdgeOut = [str(i) + " (" + dc1_Edge[str(i)] + ")" for i in range(len(crv1_EdgeOut))]
        str1_TrailOut = ["T" + str(i) for i in range(len(crv1_TrailOut))]
        str1_DeviationOut = ["D" + str(i) for i in range(len(str1_TrailOut), len(str1_TrailOut) + len(crv1_DeviationOut))]

        # External Forces
        pt1_ForceOut = []
        str1_ForceOut = []
        
        for key in dc1_NodeExtForce:
            pt0_ForceOut = pt1_Node[int(key)]
            str0_ForceOut = "L" + dc1_NodeExtForce[key][0]
            for j in range(1,len(dc1_NodeExtForce[key])):
                str0_ForceOut += "-" + "L" + dc1_NodeExtForce[key][j]
            pt1_ForceOut.append(pt0_ForceOut)
            str1_ForceOut.append(str0_ForceOut)

        
        
        #### AUTOMATIC GEOMETRIC INPUT FOR FORM DIAGRAM
        
        
        # Amount of layers
        N_layers = len(str1_NodeOrder)/len(supports)
        
        # Create List of Origin Nodes with Indexes
        str1_OriginNodeOut = ["V" + str0_OriginNodeOut.replace("W","") for str0_OriginNodeOut in str1_NodeOrder[:len(supports)]]
        pt1_OriginNodeOut = []
        for str0_OriginNodeOut in str1_OriginNodeOut:
            pt1_OriginNodeOut.append(pt1_Node[int(str0_OriginNodeOut[1:])])

        str1_ConstraintPlane = []
        pl1_ConstraintPlane = []

        for key in dc2_TrailEnds:
            
            str0_0 = dc2_TrailEnds[key][0]
            str0_1 = dc2_TrailEnds[key][1]
            int0_0 = dc1_ShortPathDist[str0_0]
            int0_1 = dc1_ShortPathDist[str0_1]
            
            str1_ConstraintPlane.append(str0_0)
            pt0_Start = pt1_NodeOut[int(str0_0)]
            pt0_End = pt1_NodeOut[int(str0_1)]
            
            if int0_0 > int0_1:
                str1_ConstraintPlane[len(str1_ConstraintPlane)-1] = str0_1
                pt0_Start = pt1_NodeOut[int(str0_1)]
                pt0_End = pt1_NodeOut[int(str0_0)]
                
            vc0_Normal = Rhino.Geometry.Vector3d(pt0_End-pt0_Start)
            pl0_Plane = Rhino.Geometry.Plane(pt0_Start,vc0_Normal)
            pl1_ConstraintPlane.append(pl0_Plane)
            

        str1_ConstraintPlaneOut = str1_ConstraintPlane
        pl1_ConstraintPlaneOut = pl1_ConstraintPlane

        TP.str1_StructuralBehaviourOut = str1_StructuralBehaviourOut
        TP.str1_DeviationIndirectOut = str1_DeviationIndirectOut
        TP.pt1_NodeOut = pt1_NodeOut
        TP.str1_NodeOut = str1_NodeOut
        TP.crv1_EdgeOut = crv1_EdgeOut
        TP.pt1_EdgeOut = pt1_EdgeOut
        TP.str1_EdgeOut = str1_EdgeOut
        TP.pt1_TrailOut = pt1_TrailOut
        TP.str1_TrailOut = str1_TrailOut
        TP.pt1_DeviationOut = pt1_DeviationOut
        TP.str1_DeviationOut = str1_DeviationOut
        TP.dc2_EdgeEndsCompleteOut = dc2_EdgeEndsComplete
        TP.dc2_TrailEndsOut = dc2_TrailEndsOut
        TP.dc2_Deviation1EndsOut = dc2_Deviation1EndsOut
        TP.dc2_Deviation2EndsOut = dc2_Deviation2EndsOut
        TP.int1_Deviation1ID = int1_Deviation1ID
        TP.int1_Deviation2ID = int1_Deviation2ID
        TP.dc2_ForceOut = dc2_ExtForce
        TP.pt1_ForceOut = pt1_ForceOut 
        TP.str1_ForceOut = str1_ForceOut
        TP.str1_NodeOrderOut = str1_NodeOrderOut
        TP.str1_ConstraintPlaneOut = str1_ConstraintPlaneOut
        TP.pl1_ConstraintPlaneOut = pl1_ConstraintPlaneOut
        TP.str1_OriginNodeOut = str1_OriginNodeOut
        TP.pt1_OriginNodeOut = pt1_OriginNodeOut
        TP.crv1_TrailAux = crv1_TrailAux

def StringToFloat(val):
    try:
        return float(val)
    except (ValueError, TypeError):
        return 1.0

if TP and hasattr(TP, "str1_StructuralBehaviourOut"):
    str1_StructuralBehaviour = TP.str1_StructuralBehaviourOut[:]
    str1_DeviationIndirect = TP.str1_DeviationIndirectOut[:]
    db1_StructuralBehaviour = []
    db1_DeviationIndirect = []
        
    for i in range(len(str1_StructuralBehaviour)):
        db1_StructuralBehaviour.append(StringToFloat(str1_StructuralBehaviour[i]))
    
    for i in range(len(str1_DeviationIndirect)):
        db1_DeviationIndirect.append(StringToFloat(str1_DeviationIndirect[i]))

    del TP.str1_StructuralBehaviourOut
    del TP.str1_DeviationIndirectOut
    
    TP.db1_StructuralBehaviourOut = db1_StructuralBehaviour
    TP.db1_DeviationIndirectOut = db1_DeviationIndirect
# ---------- end cem_build_topology_2_0 ----------

# ----
panel = Panel(cem_build_topology_2_0.TP)
cem_extract_topology_2_0 = PythonNoHint(TP=cem_build_topology_2_0.TP)  # -> nodes, nodesID, trails, trailsID, deviations, deviationsID, auxTrails, auxTrailsID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
# ---------- cem_extract_topology_2_0: Python ----------
"""
Retrieves automatically geometric properties from the topological diagram
    Inputs:
        TP: (topological diagram) The topological diagram used for the calculation of the structural model
    Outputs:
        nodes: (point 3D) The vertices describing the topological diagram
        nodesID: (integer) The corresponding node number
        edges: (edge midpoint) The edges describing the topological diagram
        edgesID: (integer) The corresponding edge number
        constraintPlane: (plane) The planes which are based on the trails normal vectors of the toplogical diagram 
        constraintPlaneID: (integer) The indices of these planes
        originNode: (point 3D) The origin points from the topological diagram
        originNodeID: (integer) The indices of these points
    Remarks:
        This extract geometric information from TP
"""


__author__    = ['Patrick Ole Ohlbrock','Pierluigi D''Acunto' ]
__copyright__ = 'Copyright 2021 - ETH Zurich and Technical University of Munich'
__license__   = 'MIT License'
__email__     = ['ohlbrock@arch.ethz.ch','pierluigi.dacunto@tum.de']
__version__   = "2.00"

"""
If you use the CEM library in a project, please refer to the GitHub repository: 

@Misc{cem2021,
author = {Ohlbrock, Patrick Ole and D'Acunto, Pierluigi},
title = {{CEM: Combinatorial Equilibrium Modeling}},
year = {2021},
note = {Release 2.00},
url = { http://github.com/OleOhlbrock/CEM },
}

"""


if TP and hasattr(TP, "str1_NodeOut") and hasattr(TP, "pt1_NodeOut"):
    nodes = TP.pt1_NodeOut[:len(TP.pt1_NodeOut)-len(TP.crv1_TrailAux)]
    nodesID = TP.str1_NodeOut[:len(TP.str1_NodeOut)-len(TP.crv1_TrailAux)]


if TP and hasattr(TP, "str1_TrailOut") and hasattr(TP, "pt1_TrailOut"):
    trails = TP.crv1_EdgeOut[:len(TP.pt1_TrailOut)-len(TP.crv1_TrailAux)]
    trailsID = TP.str1_TrailOut[:len(TP.str1_TrailOut)-len(TP.crv1_TrailAux)]


if TP and hasattr(TP, "str1_DeviationOut") and hasattr(TP, "pt1_DeviationOut"):
    deviations = TP.crv1_EdgeOut[len(TP.str1_TrailOut):len(TP.pt1_DeviationOut)+len(TP.str1_TrailOut)]
    deviationsID = TP.str1_DeviationOut

if TP and hasattr(TP, "str1_TrailOut") and hasattr(TP, "pt1_TrailOut"):
    auxTrails = TP.crv1_TrailAux
    auxTrailsID = TP.str1_TrailOut[:len(TP.crv1_TrailAux)]


if TP and hasattr(TP, "pt1_ForceOut") and hasattr(TP, "str1_ForceOut"):
    loads = TP.pt1_ForceOut
    loadsID = TP.str1_ForceOut
    


if TP and hasattr(TP, "pl1_ConstraintPlaneOut") and hasattr(TP, "str1_ConstraintPlaneOut"):
    constraintPlane = TP.pl1_ConstraintPlaneOut
    constraintPlaneID = TP.str1_ConstraintPlaneOut


if TP and hasattr(TP, "pt1_OriginNodeOut"):
    originNode = TP.pt1_OriginNodeOut
    originNodeID = TP.str1_OriginNodeOut
# ---------- end cem_extract_topology_2_0 ----------

targetnode = Panel("""V15
V13
V12
V14""")
series = Series(Start=0, Step=1, Count=11)
series_2 = Series(Start=12, Step=1, Count=16)
self_weight = BooleanToggle(False)
yieldstress_kn_m2 = Slider(500000, range=50..1000000)
specific_weight_kn_m3 = Slider(73.5, range=5..500)
targetvectorcoeffmag = Slider(0, range=0..10000)
targetvectorcoeffdir = Slider(0, range=0..10000)
boundscoefficientoriginnode = Slider(0, range=0..1000)
number_slider = Slider(0, range=0..5000)
number_slider_2 = Slider(0, range=0..5000)
number_slider_3 = Slider(10, range=0..5000)
list = ValueList({"LD_AUGLAG", "LD_LBFGS", "LD_SLSQP", "LD_TNEWTON", "LN_BOBYQA", "LN_COBYLA", "LN_SBPLX", "GD_MLSL", "GN_MLSL", "GN_ISRES"}, selected="LD_LBFGS")
minloadpathcoeff = Slider(0.05, range=0.01..10)
boundscoefficientoriginnode_2 = Slider(0.3, range=0..1000)
targetnodes = Point([<point referenced from the Rhino model> x4])
targetvector = Vector()
bounddevid = Integer(series_2)
originnodes = Point([<point referenced from the Rhino model> x4])
boundtrailid = Integer(series)
targetvectorid = Integer()
concat = Concatenate(FragmentA="T", FragmentB=boundtrailid)
concat_2 = Concatenate(FragmentA="D", FragmentB=bounddevid)
cem_bound_origin_node_2_0 = GhPythonScript(
    boundOriginNodeID=flatten(cem_extract_topology_2_0.originNodeID),
    boundUpOriginNodeX=flatten(boundscoefficientoriginnode_2),
    boundLowOriginNodeX=flatten(boundscoefficientoriginnode_2),
    boundUpOriginNodeY=flatten(boundscoefficientoriginnode_2),
    boundLowOriginNodeY=flatten(boundscoefficientoriginnode_2),
    boundUpOriginNodeZ=flatten(boundscoefficientoriginnode),
    boundLowOriginNodeZ=flatten(boundscoefficientoriginnode))  # -> BO; inputs boundOriginNodeID: list, boundUpOriginNodeX: list, boundLowOriginNodeX: list, boundUpOriginNodeY: list, boundLowOriginNodeY: list, boundUpOriginNodeZ: list, boundLowOriginNodeZ: list
# ---------- cem_bound_origin_node_2_0: Python ----------
"""
Assign bounds to origin nodes
    Inputs:
        boundOriginNodeID: (string) The origin nodes ID that are allowed to move
        boundUpOriginNodeX: (float) The upper bound distance in X-direction [m]
        boundLowOriginNodeX: (float) The lower bound distance in X-direction [m]
        boundUpOriginNodeY: (float) The upper bound distance in Y-direction [m]
        boundLowOriginNodeY: (float) The lower bound distance in Y-direction [m]
        boundUpOriginNodeZ: (float) The upper bound distance in Z-direction [m]
        boundLowOriginNodeZ: (float) The lower bound distance in Z-direction [m]
    Outputs:
        BO: (Bounds Origin Nodes) The bounds for the origin nodes.
    Remarks:
        This generates a new instance of bounds for the origin nodes for the optimization
"""

__author__    = ['Patrick Ole Ohlbrock','Pierluigi D''Acunto' ]
__copyright__ = 'Copyright 2021 - ETH Zurich and Technical University of Munich'
__license__   = 'MIT License'
__email__     = ['ohlbrock@arch.ethz.ch','pierluigi.dacunto@tum.de']
__version__   = "2.00"

"""
If you use the CEM library in a project, please refer to the GitHub repository: 

@Misc{cem2021,
author = {Ohlbrock, Patrick Ole and D'Acunto, Pierluigi},
title = {{CEM: Combinatorial Equilibrium Modeling}},
year = {2021},
note = {Release 2.00},
url = { http://github.com/OleOhlbrock/CEM },
}

"""



import Rhino


class BoundOriginNode(object):
    def __repr__(self):
        return self.ToString()
        
    def __str__(self):
        return self.ToString()
        
    def ToString(self):
        if boundOriginNodeID and boundOriginNodeID[0] is not None:
            return "Bound Origin Nodes"
        else:
            return "Bound Origin Nodes not defined"


BO = BoundOriginNode()
BO.ID = []
BO.UpX = []
BO.LowX = []
BO.UpY = []
BO.LowY = []
BO.UpZ = []
BO.LowZ = []

if boundOriginNodeID and boundOriginNodeID[0] is not None:
    boundOriginNodeID = [ int(originNodeID[1:]) for originNodeID in boundOriginNodeID]
    if len(boundOriginNodeID) == len(boundUpOriginNodeX) and len(boundOriginNodeID) == len(boundLowOriginNodeX):
        BO.ID = boundOriginNodeID
        BO.UpX = [abs(boundUpOriginNodeX_i) for boundUpOriginNodeX_i in boundUpOriginNodeX]
        BO.LowX = [-abs(boundLowOriginNodeX_i) for boundLowOriginNodeX_i in boundLowOriginNodeX]
    elif len(boundUpOriginNodeX) == 1 and len(boundLowOriginNodeX) == 1:
        boundUpOriginNodeXC = []
        for i in range(len(boundOriginNodeID)):
            boundUpOriginNodeXC.append(abs(boundUpOriginNodeX[0]))
        boundLowOriginNodeXC = []
        for i in range(len(boundOriginNodeID)):
            boundLowOriginNodeXC.append(-abs(boundLowOriginNodeX[0]))
        BO.ID = boundOriginNodeID
        BO.UpX = boundUpOriginNodeXC
        BO.LowX = boundLowOriginNodeXC
    else:
        boundUpOriginNodeXC = []
        for i in range(len(boundOriginNodeID)):
            boundUpOriginNodeXC.append(0.0)
        boundLowOriginNodeXC = []
        for i in range(len(boundOriginNodeID)):
            boundLowOriginNodeXC.append(0.0)
        BO.ID = boundOriginNodeID
        BO.UpX = boundUpOriginNodeXC
        BO.LowX = boundLowOriginNodeXC

    if len(boundOriginNodeID) == len(boundUpOriginNodeY) and len(boundOriginNodeID) == len(boundLowOriginNodeY):
        BO.ID = boundOriginNodeID
        BO.UpY = [abs(boundUpOriginNodeY_i) for boundUpOriginNodeY_i in boundUpOriginNodeY]
        BO.LowY = [-abs(boundLowOriginNodeY_i) for boundLowOriginNodeY_i in boundLowOriginNodeY]
    elif len(boundUpOriginNodeY) == 1 and len(boundLowOriginNodeY) == 1:
        boundUpOriginNodeYC = []
        for i in range(len(boundOriginNodeID)):
            boundUpOriginNodeYC.append(abs(boundUpOriginNodeY[0]))
        boundLowOriginNodeYC = []
        for i in range(len(boundOriginNodeID)):
            boundLowOriginNodeYC.append(-abs(boundLowOriginNodeY[0]))
        BO.ID = boundOriginNodeID
        BO.UpY = boundUpOriginNodeYC
        BO.LowY = boundLowOriginNodeYC
    else:
        boundUpOriginNodeYC = []
        for i in range(len(boundOriginNodeID)):
            boundUpOriginNodeYC.append(0.0)
        boundLowOriginNodeYC = []
        for i in range(len(boundOriginNodeID)):
            boundLowOriginNodeYC.append(0.0)
        BO.ID = boundOriginNodeID
        BO.UpY = boundUpOriginNodeYC
        BO.LowY = boundLowOriginNodeYC

    if len(boundOriginNodeID) == len(boundUpOriginNodeZ) and len(boundOriginNodeID) == len(boundLowOriginNodeZ):
        BO.ID = boundOriginNodeID
        BO.UpZ = [abs(boundUpOriginNodeZ_i) for boundUpOriginNodeZ_i in boundUpOriginNodeZ]
        BO.LowZ = [-abs(boundLowOriginNodeZ_i) for boundLowOriginNodeZ_i in boundLowOriginNodeZ]
    elif len(boundUpOriginNodeZ) == 1 and len(boundLowOriginNodeZ) == 1:
        boundUpOriginNodeZC = []
        for i in range(len(boundOriginNodeID)):
            boundUpOriginNodeZC.append(abs(boundUpOriginNodeZ[0]))
        boundLowOriginNodeZC = []
        for i in range(len(boundOriginNodeID)):
            boundLowOriginNodeZC.append(-abs(boundLowOriginNodeZ[0]))
        BO.ID = boundOriginNodeID
        BO.UpZ = boundUpOriginNodeZC
        BO.LowZ = boundLowOriginNodeZC
    else:
        boundUpOriginNodeZC = []
        for i in range(len(boundOriginNodeID)):
            boundUpOriginNodeZC.append(0.0)
        boundLowOriginNodeZC = []
        for i in range(len(boundOriginNodeID)):
            boundLowOriginNodeZC.append(0.0)
        BO.ID = boundOriginNodeID
        BO.UpZ = boundUpOriginNodeZC
        BO.LowZ = boundLowOriginNodeZC
        
else:
    boundUpOriginNodeXC = []
    for i in range(len(boundOriginNodeID)):
        boundUpOriginNodeXC.append(0.0)
    boundLowOriginNodeXC = []
    for i in range(len(boundOriginNodeID)):
        boundLowOriginNodeXC.append(0.0)
    boundUpOriginNodeYC = []
    for i in range(len(boundOriginNodeID)):
        boundUpOriginNodeYC.append(0.0)
    boundLowOriginNodeYC = []
    for i in range(len(boundOriginNodeID)):
        boundLowOriginNodeYC.append(0.0)
    boundUpOriginNodeZC = []
    for i in range(len(boundOriginNodeID)):
        boundUpOriginNodeZC.append(0.0)
    boundLowOriginNodeZC = []
    for i in range(len(boundOriginNodeID)):
        boundLowOriginNodeZC.append(0.0)
    BO.ID = boundOriginNodeID
    BO.UpX = boundUpOriginNodeXC
    BO.LowX = boundLowOriginNodeXC
    BO.UpY = boundUpOriginNodeYC
    BO.LowY = boundLowOriginNodeYC
    BO.UpZ = boundUpOriginNodeZC
    BO.LowZ = boundLowOriginNodeZC
# ---------- end cem_bound_origin_node_2_0 ----------
cem_target_vector_2_0 = GhPythonScript(
    targetVector=flatten(targetvector),
    targetVectorID=flatten(targetvectorid),
    targetVectorCoeffMag=flatten(targetvectorcoeffmag),
    targetVectorCoeffDir=flatten(targetvectorcoeffdir))  # -> TV; inputs targetVector: list of Vector3d, targetVectorID: list, targetVectorCoeffMag: list, targetVectorCoeffDir: list
# ---------- cem_target_vector_2_0: Python ----------
"""
Assign targets
    Inputs:
        targetVector: (Vector3D) Describes the desired trail vector in the force diagram
        targetVectorID: (string) The corresponding trail edge ID
        targeVectorCoeffMag: (float) The weight factors for matching the magnitudes of the target vectors
        targeVectorCoeffDir: (float) The weight factors for matching the directions of the target vectors
    Outputs:
        TV: (Targets) The assigned targets, their ID and weights.
    Remarks:
        This generates a new instance of targets for the optimization
"""


__author__    = ['Patrick Ole Ohlbrock','Pierluigi D''Acunto' ]
__copyright__ = 'Copyright 2021 - ETH Zurich and Technical University of Munich'
__license__   = 'MIT License'
__email__     = ['ohlbrock@arch.ethz.ch','pierluigi.dacunto@tum.de']
__version__   = "2.00"

"""
If you use the CEM library in a project, please refer to the GitHub repository: 

@Misc{cem2021,
author = {Ohlbrock, Patrick Ole and D'Acunto, Pierluigi},
title = {{CEM: Combinatorial Equilibrium Modeling}},
year = {2021},
note = {Release 2.00},
url = { http://github.com/OleOhlbrock/CEM },
}

"""



import Rhino


class TargetOptVector(object):
    def __repr__(self):
        return self.ToString()
        
    def __str__(self):
        return self.ToString()
        
    def ToString(self):
        bl0_targetVector = False
        if targetVector and targetVectorID and targetVectorID[0] is not None and len(targetVector) == len(targetVectorID):
                bl0_targetVector = True
        if bl0_targetVector:
            return "Target Vector"
        else:
            return "Target Vector not defined"


TV = TargetOptVector()
if targetVector and targetVectorID and targetVectorID[0] is not None and len(targetVector) == len(targetVectorID):
    
    targetVectorID = [ int(vectorID[1:]) for vectorID in targetVectorID]
    
    TV.targetVector = targetVector
    TV.targetVectorID = targetVectorID
    TV.targetVectorCoeffMag = [0.0 for i in range(len(targetVector))]
    TV.targetVectorCoeffDir = [0.0 for i in range(len(targetVector))]

    if targetVectorCoeffMag and not(targetVectorCoeffMag.Contains(None)):
        if len(targetVectorCoeffMag) == len(targetVectorID) :
            targetVectorCoeffMagC = []
            for i in range(len(targetVectorID)):
                targetVectorCoeffMagC.append( targetVectorCoeffMag[i] )
            TV.targetVectorCoeffMag  = targetVectorCoeffMagC
        elif len(targetVectorCoeffMag) == 1:
            targetVectorCoeffMagC = []
            for i in range(len(targetVectorID)):
                targetVectorCoeffMagC.append( targetVectorCoeffMag[0] )
            TV.targetVectorCoeffMag = targetVectorCoeffMagC


    if targetVectorCoeffDir and not(targetVectorCoeffDir.Contains(None)):
        if len(targetVectorCoeffDir) == len(targetVectorID):
            targetVectorCoeffDirC = []
            for i in range(len(targetVectorID)):
                targetVectorCoeffDirC.append( targetVectorCoeffDir[i] )
            TV.targetVectorCoeffDir  = targetVectorCoeffDirC
        elif len(targetVectorCoeffDir) == 1:
            targetVectorCoeffDirC = []
            for i in range(len(targetVectorID)):
                targetVectorCoeffDirC.append( targetVectorCoeffDir[0] )
            TV.targetVectorCoeffDir = targetVectorCoeffDirC
# ---------- end cem_target_vector_2_0 ----------
cem_constraint_plane_2_0 = GhPythonScript(
    constraintPlane=flatten(cem_extract_topology_2_0.constraintPlane),
    constraintPlaneID=flatten(cem_extract_topology_2_0.constraintPlaneID))  # -> CPL; inputs constraintPlane: list of Plane, constraintPlaneID: list of Int32
# ---------- cem_constraint_plane_2_0: Python ----------
"""
Assign self weight
    Inputs:
        selfWeight: (bool) Activate the self weight of the structure
        yieldStress: (double) The yield stress of the structural members
        specWeight: (double) The specific weight of the structural members
    Outputs:
        SW: (self-weight) The assigned self weight properties 
    Remarks:
        This generates a new instance of self weight
"""
        
        
__author__    = ['Patrick Ole Ohlbrock','Pierluigi D''Acunto' ]
__copyright__ = 'Copyright 2021 - ETH Zurich and Technical University of Munich'
__license__   = 'MIT License'
__email__     = ['ohlbrock@arch.ethz.ch','pierluigi.dacunto@tum.de']
__version__   = "2.00"
        
"""
If you use the CEM library in a project, please refer to the GitHub repository: 
        
@Misc{cem2021,
author = {Ohlbrock, Patrick Ole and D'Acunto, Pierluigi},
title = {{CEM: Combinatorial Equilibrium Modeling}},
year = {2021},
note = {Release 2.00},
url = { http://github.com/OleOhlbrock/CEM },
}
        
"""
        
        
class CPlane(object):
    def __repr__(self):
        return self.ToString()
                
    def __str__(self):
        return self.ToString()
                
    def ToString(self):
        if constraintPlane and constraintPlane[0] is not None and len(constraintPlane) == len(constraintPlaneID):
            return str(len(constraintPlane)) + " Constraint Planes"
        else:
            return "Invalid Constraint Planes"
                    
        
CPL = CPlane()
        
if constraintPlane and constraintPlane[0] is not None and len(constraintPlane) == len(constraintPlaneID):
    CPL.constraintPlane = constraintPlane
    CPL.constraintPlaneID = constraintPlaneID
# ---------- end cem_constraint_plane_2_0 ----------
cem_min_load_path_2_0 = GhPythonScript(minLoadPath=flatten(Toggle(True)), minLoadPathCoeff=flatten(minloadpathcoeff))  # -> LP; inputs minLoadPath: Boolean
# ---------- cem_min_load_path_2_0: Python ----------
"""
Assign targets
    Inputs:
        minLoadPath: (bool) Minimize the absolute load path of the structure
        minLoadPathCoeff: (float) The weight factor for minimizing the load path
    Outputs:
        LP: (LoadPath) The minimization objective.
    Remarks:
        This generates a new objective for the optimization
"""


__author__    = ['Patrick Ole Ohlbrock','Pierluigi D''Acunto' ]
__copyright__ = 'Copyright 2021 - ETH Zurich and Technical University of Munich'
__license__   = 'MIT License'
__email__     = ['ohlbrock@arch.ethz.ch','pierluigi.dacunto@tum.de']
__version__   = "2.00"

"""
If you use the CEM library in a project, please refer to the GitHub repository: 

@Misc{cem2021,
author = {Ohlbrock, Patrick Ole and D'Acunto, Pierluigi},
title = {{CEM: Combinatorial Equilibrium Modeling}},
year = {2021},
note = {Release 2.00},
url = { http://github.com/OleOhlbrock/CEM },
}

"""



class LoadPathOpt(object):
    def __repr__(self):
        return self.ToString()
        
    def __str__(self):
        return self.ToString()
        
    def ToString(self):
        if minLoadPath is not None:
            return "Minimize Load Path"
        else:
            return "No Load Path Optimization"


LP = LoadPathOpt()
if minLoadPath is not None:
    LP.minLoadPath = minLoadPath
    if minLoadPathCoeff is None:
        LP.minLoadPathCoeff = 0.0
    elif minLoadPathCoeff < 0.0:
        LP.minLoadPathCoeff = 0.0
    else:
        LP.minLoadPathCoeff = minLoadPathCoeff
# ---------- end cem_min_load_path_2_0 ----------
cem_target_node_2_0 = GhPythonScript(targetNode=flatten(targetnodes), targetNodeID=flatten(targetnode), targetNodeCoeff=flatten(Slider(1, range=0..10000)))  # -> TN; inputs targetNode: list, targetNodeID: list, targetNodeCoeff: list
# ---------- cem_target_node_2_0: Python ----------
"""
Assign targets
    Inputs:
        targetNode: (Point3D or Line or Surface) Describes the desired location of a node in the form diagram
        targetNodeID: (string) The corresponding node ID
        targeNodeCoeff: (float) The weight factors for matching target nodes
    Outputs:
        TN: (Targets) The assigned targets, their ID and weights.
    Remarks:
        This generates a new instance of targets for the optimization
"""


__author__    = ['Patrick Ole Ohlbrock','Pierluigi D''Acunto' ]
__copyright__ = 'Copyright 2021 - ETH Zurich and Technical University of Munich'
__license__   = 'MIT License'
__email__     = ['ohlbrock@arch.ethz.ch','pierluigi.dacunto@tum.de']
__version__   = "2.00"

"""
If you use the CEM library in a project, please refer to the GitHub repository: 

@Misc{cem2021,
author = {Ohlbrock, Patrick Ole and D'Acunto, Pierluigi},
title = {{CEM: Combinatorial Equilibrium Modeling}},
year = {2021},
note = {Release 2.00},
url = { http://github.com/OleOhlbrock/CEM },
}

"""



import Rhino


class TargetOptNode(object):
    def __repr__(self):
        return self.ToString()
        
    def __str__(self):
        return self.ToString()
        
    def ToString(self):
        bl0_targetNode = False
        if targetNode and targetNodeID and targetNodeID[0] is not None and len(targetNode) == len(targetNodeID):
                bl0_targetNode = True
        if bl0_targetNode:
            return "Target Node"
        else:
            return "Target Node not defined"


TN = TargetOptNode()
if targetNode and targetNodeID and targetNodeID[0] is not None and len(targetNode) == len(targetNodeID):
    
    targetNodeID = [ int(nodeID[1:]) for nodeID in targetNodeID]
    
    TN.targetNode = targetNode
    TN.targetNodeID = targetNodeID
    TN.targetNodeCoeff = [0.0 for i in range(len(targetNode))]

    if targetNodeCoeff and not(targetNodeCoeff.Contains(None)):
        if len(targetNodeCoeff) == len(targetNodeID):
            targetNodeCoeffC = []
            for i in range(len(targetNodeID)):
                targetNodeCoeffC.append( targetNodeCoeff[i] )
            TN.targetNodeCoeff  = targetNodeCoeffC
        elif len(targetNodeCoeff) == 1:
            targetNodeCoeffC = []
            for i in range(len(targetNodeID)):
                targetNodeCoeffC.append( targetNodeCoeff[0] )
            TN.targetNodeCoeff = targetNodeCoeffC
# ---------- end cem_target_node_2_0 ----------
cem_bound_load_2_0 = GhPythonScript(
    boundLoadID=flatten(cem_extract_topology_2_0.loadsID),
    boundUpLoadX=flatten(number_slider),
    boundLowLoadX=flatten(number_slider),
    boundUpLoadY=flatten(number_slider),
    boundLowLoadY=flatten(number_slider),
    boundUpLoadZ=flatten(number_slider_2),
    boundLowLoadZ=flatten(number_slider_2))  # -> BL; inputs boundLoadID: list, boundUpLoadX: list, boundLowLoadX: list, boundUpLoadY: list, boundLowLoadY: list, boundUpLoadZ: list, boundLowLoadZ: list
# ---------- cem_bound_load_2_0: Python ----------
"""
Assign bounds to loads
    Inputs:
        boundLoadID: (string) The loads ID that are allowed to move
        boundUpLoadX: (float) The upper bound distance in X-direction [m]
        boundLowLoadX: (float) The lower bound distance in X-direction [m]
        boundUpLoadY: (float) The upper bound distance in Y-direction [m]
        boundLowLoadY: (float) The lower bound distance in Y-direction [m]
        boundUpLoadZ: (float) The upper bound distance in Z-direction [m]
        boundLowLoadZ: (float) The lower bound distance in Z-direction [m]
    Outputs:
        BL: (Bounds Loads) The bounds for the loads.
    Remarks:
        This generates a new instance of bounds for the loads for the optimization
"""

__author__    = ['Patrick Ole Ohlbrock','Pierluigi D''Acunto' ]
__copyright__ = 'Copyright 2021 - ETH Zurich and Technical University of Munich'
__license__   = 'MIT License'
__email__     = ['ohlbrock@arch.ethz.ch','pierluigi.dacunto@tum.de']
__version__   = "2.00"

"""
If you use the CEM library in a project, please refer to the GitHub repository: 

@Misc{cem2021,
author = {Ohlbrock, Patrick Ole and D'Acunto, Pierluigi},
title = {{CEM: Combinatorial Equilibrium Modeling}},
year = {2021},
note = {Release 2.00},
url = { http://github.com/OleOhlbrock/CEM },
}

"""


import Rhino


class BoundLoad(object):
    def __repr__(self):
        return self.ToString()
        
    def __str__(self):
        return self.ToString()
        
    def ToString(self):
        return "Bound Loads"


BL = BoundLoad()
BL.ID = []
BL.UpX = []
BL.LowX = []
BL.UpY = []
BL.LowY = []
BL.UpZ = []
BL.LowZ = []

if boundLoadID:
    boundLoadID = [ int(loadID[1:]) for loadID in boundLoadID]
    if len(boundLoadID) == len(boundUpLoadX) and len(boundLoadID) == len(boundLowLoadX):
        BL.ID = boundLoadID
        BL.UpX = [abs(boundUpLoadX_i) for boundUpLoadX_i in boundUpLoadX]
        BL.LowX = [-abs(boundLowLoadX_i) for boundLowLoadX_i in boundLowLoadX]
    elif len(boundUpLoadX) == 1 and len(boundLowLoadX) == 1:
        boundUpLoadXC = []
        for i in range(len(boundLoadID)):
            boundUpLoadXC.append(abs(boundUpLoadX[0]))
        boundLowLoadXC = []
        for i in range(len(boundLoadID)):
            boundLowLoadXC.append(-abs(boundLowLoadX[0]))
        BL.ID = boundLoadID
        BL.UpX = boundUpLoadXC
        BL.LowX = boundLowLoadXC
    else:
        boundUpLoadXC = []
        for i in range(len(boundLoadID)):
            boundUpLoadXC.append(0.0)
        boundLowLoadXC = []
        for i in range(len(boundLoadID)):
            boundLowLoadXC.append(0.0)
        BL.ID = boundLoadID
        BL.UpX = boundUpLoadXC
        BL.LowX = boundLowLoadXC

    if len(boundLoadID) == len(boundUpLoadY) and len(boundLoadID) == len(boundLowLoadY):
        BL.ID = boundLoadID
        BL.UpY = [abs(boundUpLoadY_i) for boundUpLoadY_i in boundUpLoadY]
        BL.LowY = [-abs(boundLowLoadY_i) for boundLowLoadY_i in boundLowLoadY]
    elif len(boundUpLoadY) == 1 and len(boundLowLoadY) == 1:
        boundUpLoadYC = []
        for i in range(len(boundLoadID)):
            boundUpLoadYC.append(abs(boundUpLoadY[0]))
        boundLowLoadYC = []
        for i in range(len(boundLoadID)):
            boundLowLoadYC.append(-abs(boundLowLoadY[0]))
        BL.ID = boundLoadID
        BL.UpY = boundUpLoadYC
        BL.LowY = boundLowLoadYC
    else:
        boundUpLoadYC = []
        for i in range(len(boundLoadID)):
            boundUpLoadYC.append(0.0)
        boundLowLoadYC = []
        for i in range(len(boundLoadID)):
            boundLowLoadYC.append(0.0)
        BL.ID = boundLoadID
        BL.UpY = boundUpLoadYC
        BL.LowY = boundLowLoadYC

    if len(boundLoadID) == len(boundUpLoadZ) and len(boundLoadID) == len(boundLowLoadZ):
        BL.ID = boundLoadID
        BL.UpZ = [abs(boundUpLoadZ_i) for boundUpLoadZ_i in boundUpLoadZ]
        BL.LowZ = [-abs(boundLowLoadZ_i) for boundLowLoadZ_i in boundLowLoadZ]
    elif len(boundUpLoadZ) == 1 and len(boundLowLoadZ) == 1:
        boundUpLoadZC = []
        for i in range(len(boundLoadID)):
            boundUpLoadZC.append(abs(boundUpLoadZ[0]))
        boundLowLoadZC = []
        for i in range(len(boundLoadID)):
            boundLowLoadZC.append(-abs(boundLowLoadZ[0]))
        BL.ID = boundLoadID
        BL.UpZ = boundUpLoadZC
        BL.LowZ = boundLowLoadZC
    else:
        boundUpLoadZC = []
        for i in range(len(boundLoadID)):
            boundUpLoadZC.append(0.0)
        boundLowLoadZC = []
        for i in range(len(boundLoadID)):
            boundLowLoadZC.append(0.0)
        BL.ID = boundLoadID
        BL.UpZ = boundUpLoadZC
        BL.LowZ = boundLowLoadZC
        
else:
    boundUpLoadXC = []
    for i in range(len(boundLoadID)):
        boundUpLoadXC.append(0.0)
    boundLowLoadXC = []
    for i in range(len(boundLoadID)):
        boundLowLoadXC.append(0.0)
    boundUpLoadYC = []
    for i in range(len(boundLoadID)):
        boundUpLoadYC.append(0.0)
    boundLowLoadYC = []
    for i in range(len(boundLoadID)):
        boundLowLoadYC.append(0.0)
    boundUpLoadZC = []
    for i in range(len(boundLoadID)):
        boundUpLoadZC.append(0.0)
    boundLowLoadZC = []
    for i in range(len(boundLoadID)):
        boundLowLoadZC.append(0.0)
    BL.ID = boundLoadID
    BL.UpX = boundUpLoadXC
    BL.LowX = boundLowLoadXC
    BL.UpY = boundUpLoadYC
    BL.LowY = boundLowLoadYC
    BL.UpZ = boundUpLoadZC
    BL.LowZ = boundLowLoadZC
# ---------- end cem_bound_load_2_0 ----------
cem_bound_trail_2_0 = GhPythonScript(
    boundTrailID=flatten(concat),
    boundUpTrail=flatten(Slider(10, range=0..5000)),
    boundLowTrail=flatten(Slider(10, range=0..5000)))  # -> BT; inputs boundTrailID: list, boundUpTrail: list, boundLowTrail: list
# ---------- cem_bound_trail_2_0: Python ----------
"""
Assign bounds to trail lengths
    Inputs:
        boundTrailID: (string) The trail edges ID that are allowed to change their length
        boundUpTrail: (float) The upper bound of allowable change of lengths for trail edges [m]
        boundLowTrail: (float) The lower bound of allowable change of lengths for trail edges [m]
    Outputs:
        BT: (Bounds Trail Lengths) The bounds for the trail edges lengths
    Remarks:
        This generates a new instance of bounds for the trail edges for the optimization
"""

__author__    = ['Patrick Ole Ohlbrock','Pierluigi D''Acunto' ]
__copyright__ = 'Copyright 2021 - ETH Zurich and Technical University of Munich'
__license__   = 'MIT License'
__email__     = ['ohlbrock@arch.ethz.ch','pierluigi.dacunto@tum.de']
__version__   = "2.00"

"""
If you use the CEM library in a project, please refer to the GitHub repository: 

@Misc{cem2021,
author = {Ohlbrock, Patrick Ole and D'Acunto, Pierluigi},
title = {{CEM: Combinatorial Equilibrium Modeling}},
year = {2021},
note = {Release 2.00},
url = { http://github.com/OleOhlbrock/CEM },
}

"""


import Rhino


class BoundTrail(object):
    def __repr__(self):
        return self.ToString()
        
    def __str__(self):
        return self.ToString()
        
    def ToString(self):
        if boundTrailID and boundTrailID[0] is not None:
            return "Bound Trail"
        else:
            return "Bound Trail not defined"


BT = BoundTrail()
BT.ID = []
BT.Up = []
BT.Low = []


if boundTrailID and boundTrailID[0] is not None:
    boundTrailID = [ int(trailID[1:]) for trailID in boundTrailID]
    if len(boundTrailID) == len(boundUpTrail) and len(boundTrailID) == len(boundLowTrail):
        BT.ID = boundTrailID
        BT.Up = [abs(boundUpTrail_i) for boundUpTrail_i in boundUpTrail]
        BT.Low = [-abs(boundLowTrail_i) for boundLowTrail_i in boundLowTrail]
    elif len(boundUpTrail) == 1 and len(boundLowTrail) == 1:
        boundUpTrailC = []
        for i in range(len(boundTrailID)):
            boundUpTrailC.append(abs(boundUpTrail[0]))
        boundLowTrailC = []
        for i in range(len(boundTrailID)):
            boundLowTrailC.append(-abs(boundLowTrail[0]))
        BT.ID = boundTrailID
        BT.Up = boundUpTrailC
        BT.Low = boundLowTrailC
    else:
        boundUpTrailC = []
        for i in range(len(boundTrailID)):
            boundUpTrailC.append(0.0)
        boundLowTrailC = []
        for i in range(len(boundTrailID)):
            boundLowTrailC.append(0.0)
        BT.ID = boundTrailID
        BT.Up = boundUpTrailC
        BT.Low = boundLowTrailC
else:
    boundUpTrailC = []
    for i in range(len(boundTrailID)):
        boundUpTrailC.append(0.0)
    boundLowTrailC = []
    for i in range(len(boundTrailID)):
        boundLowTrailC.append(0.0)
    BT.ID = boundTrailID
    BT.Up = boundUpTrailC
    BT.Low = boundLowTrailC
# ---------- end cem_bound_trail_2_0 ----------
cem_bound_deviation_2_0 = GhPythonScript(boundDevID=flatten(concat_2), boundUpDev=flatten(number_slider_3), boundLowDev=flatten(number_slider_3))  # -> BD; inputs boundDevID: list, boundUpDev: list, boundLowDev: list
# ---------- cem_bound_deviation_2_0: Python ----------
"""
Assign bounds to deviation forces
    Inputs:
        boundDevID: (string) The deviation edges ID that are allowed to change their force magnitude
        boundUpDev: (float) The upper bound of allowable change of force magnitudes [kN]
        boundLowDev: (float) The lower bound of allowable change of force magnitudes [kN]
    Outputs:
        BD: (Bounds Deviation Edges) The bounds for the deviation edges force magnitudes
    Remarks:
        This generates a new instance of bounds for the deviation edges for the optimization
"""


__author__    = ['Patrick Ole Ohlbrock','Pierluigi D''Acunto' ]
__copyright__ = 'Copyright 2021 - ETH Zurich and Technical University of Munich'
__license__   = 'MIT License'
__email__     = ['ohlbrock@arch.ethz.ch','pierluigi.dacunto@tum.de']
__version__   = "2.00"

"""
If you use the CEM library in a project, please refer to the GitHub repository: 

@Misc{cem2021,
author = {Ohlbrock, Patrick Ole and D'Acunto, Pierluigi},
title = {{CEM: Combinatorial Equilibrium Modeling}},
year = {2021},
note = {Release 2.00},
url = { http://github.com/OleOhlbrock/CEM },
}

"""


import Rhino


class BoundDev(object):
    def __repr__(self):
        return self.ToString()
        
    def __str__(self):
        return self.ToString()
        
    def ToString(self):
        if boundDevID and boundDevID[0] is not None:
            return "Bound Deviation"
        else:
            return "Bound Deviation not defined"


BD = BoundDev()
BD.ID = []
BD.Up = []
BD.Low = []

if boundDevID and boundDevID[0] is not None:
    boundDevID = [ int(devID[1:]) for devID in boundDevID]
    if len(boundDevID) == len(boundUpDev) and len(boundDevID) == len(boundLowDev):
        BD.ID = boundDevID
        BD.Up = [abs(boundUpDev_i) for boundUpDev_i in boundUpDev]
        BD.Low = [-abs(boundLowDev_i) for boundLowDev_i in boundLowDev]
    elif len(boundUpDev) == 1 and len(boundLowDev) == 1:
        boundUpDevC = []
        for i in range(len(boundDevID)):
            boundUpDevC.append(abs(boundUpDev[0]))
        boundLowDevC = []
        for i in range(len(boundDevID)):
            boundLowDevC.append(-abs(boundLowDev[0]))
        BD.ID = boundDevID
        BD.Up = boundUpDevC
        BD.Low = boundLowDevC
    else:
        boundUpDevC = []
        for i in range(len(boundDevID)):
            boundUpDevC.append(0.0)
        boundLowDevC = []
        for i in range(len(boundDevID)):
            boundLowDevC.append(0.0)
        BD.ID = boundDevID
        BD.Up = boundUpDevC
        BD.Low = boundLowDevC
else:
    boundUpDevC = []
    for i in range(len(boundDevID)):
        boundUpDevC.append(0.0)
    boundLowDevC = []
    for i in range(len(boundDevID)):
        boundLowDevC.append(0.0)
    BD.ID = boundDevID
    BD.Up = boundUpDevC
    BD.Low = boundLowDevC
# ---------- end cem_bound_deviation_2_0 ----------
cem_origin_node_2_0 = GhPythonScript(originNode=flatten(originnodes), originNodeID=flatten(cem_extract_topology_2_0.originNodeID))  # -> N; inputs originNode: list of Point3d, originNodeID: list
# ---------- cem_origin_node_2_0: Python ----------
"""
Locate origin nodes
    Inputs:
        originNode: (point3d) position of origin node in form diagram
        originNodeID: (integer) index of corresponding node
    Outputs:
        N: (origin-nodes) The assigned origin nodes
    Remarks:
        This generates a new instance of origin nodes
"""


__author__    = ['Patrick Ole Ohlbrock','Pierluigi D''Acunto' ]
__copyright__ = 'Copyright 2021 - ETH Zurich and Technical University of Munich'
__license__   = 'MIT License'
__email__     = ['ohlbrock@arch.ethz.ch','pierluigi.dacunto@tum.de']
__version__   = "2.00"

"""
If you use the CEM library in a project, please refer to the GitHub repository: 

@Misc{cem2021,
author = {Ohlbrock, Patrick Ole and D'Acunto, Pierluigi},
title = {{CEM: Combinatorial Equilibrium Modeling}},
year = {2021},
note = {Release 2.00},
url = { http://github.com/OleOhlbrock/CEM },
}

"""


import Rhino


class ONode(object):
    def __repr__(self):
        return self.ToString()
        
    def __str__(self):
        return self.ToString()
        
    def ToString(self):
        if originNode and originNode[0] is not None and len(originNode) == len(originNodeID):
            return str(len(originNode)) + " Defined Origin Nodes"
        else:
            return "Undefined Origin Nodes"


N = ONode()

if originNode and originNode[0] is not None and len(originNode) == len(originNodeID):
    N.originNode = originNode
    originNodeID = [ int(nodeID[1:]) for nodeID in originNodeID]
    N.originNodeID = originNodeID
# ---------- end cem_origin_node_2_0 ----------
cem_material_properties_2_0 = GhPythonScript(selfWeight=self_weight, yieldStress=yieldstress_kn_m2, specWeight=specific_weight_kn_m3)  # -> SW; inputs selfWeight: Boolean
# ---------- cem_material_properties_2_0: Python ----------
"""
Assign self weight
    Inputs:
        selfWeight: (bool) Activate the self weight of the structure
        yieldStress: (double) The yield stress of the structural members
        specWeight: (double) The specific weight of the structural members
    Outputs:
        SW: (self-weight) The assigned self weight properties 
    Remarks:
        This generates a new instance of self weight
"""


__author__    = ['Patrick Ole Ohlbrock','Pierluigi D''Acunto' ]
__copyright__ = 'Copyright 2021 - ETH Zurich and Technical University of Munich'
__license__   = 'MIT License'
__email__     = ['ohlbrock@arch.ethz.ch','pierluigi.dacunto@tum.de']
__version__   = "2.00"

"""
If you use the CEM library in a project, please refer to the GitHub repository: 

@Misc{cem2021,
author = {Ohlbrock, Patrick Ole and D'Acunto, Pierluigi},
title = {{CEM: Combinatorial Equilibrium Modeling}},
year = {2021},
note = {Release 2.00},
url = { http://github.com/OleOhlbrock/CEM },
}

"""



import Rhino


class SWeight(object):
    def __repr__(self):
        return self.ToString()
        
    def __str__(self):
        return self.ToString()
        
    def ToString(self):
        if selfWeight and yieldStress and specWeight:
                return "Self Weight"
        else:
            return "No Self Weight"

SW = SWeight()
if selfWeight and yieldStress and specWeight:
    SW.yieldStress = yieldStress
    SW.specWeight = specWeight
# ---------- end cem_material_properties_2_0 ----------
cem_optimization_setup_2_0 = GhPythonScript(
    TN=cem_target_node_2_0,
    TV=cem_target_vector_2_0,
    LP=cem_min_load_path_2_0,
    BO=cem_bound_origin_node_2_0,
    BL=cem_bound_load_2_0,
    BT=cem_bound_trail_2_0,
    BD=cem_bound_deviation_2_0,
    gradientDelta=Slider(0.0001, range=0.0001..1),
    relativeTolerance=Slider(1e-06, range=1e-06..1),
    maxIterations=Slider(40, range=1..1000),
    optimAlgorithm=list)  # -> O; inputs maxIterations: Int32
# ---------- cem_optimization_setup_2_0: Python ----------
"""
Combines the Optimization settings
    Inputs:
        TN: (target nodes) The assigned target nodes, their ID and weights
        TV: (target vectors) The assigned target vectors, their ID and weights
        BO: (boundsoriginnodeObject) The bounds for the origin nodes
        BT: (boundstrailObject) The bounds for the trail edges lengths
        BD: (boundsdeviationObject) The bounds for the deviation edges force magnitudes
        gradientDelta: (float) The delta for the determination of the gradient through finite differences
        relativeTolerance: (float) The threshold which describes one stoping criteria
        maxIterations: (Integer) The maximum number of iteration steps
        optimAlgorithm: (AlgorithmType) The type of solver from the NLOpt library
    Outputs:
        O: (optimization set-up) The settings for an optimization that can be performed 
    Remarks:
        This generates a new instance of the optimization set-up
"""


__author__    = ['Patrick Ole Ohlbrock','Pierluigi D''Acunto' ]
__copyright__ = 'Copyright 2021 - ETH Zurich and Technical University of Munich'
__license__   = 'MIT License'
__email__     = ['ohlbrock@arch.ethz.ch','pierluigi.dacunto@tum.de']
__version__   = "2.00"

"""
If you use the CEM library in a project, please refer to the GitHub repository: 

@Misc{cem2021,
author = {Ohlbrock, Patrick Ole and D'Acunto, Pierluigi},
title = {{CEM: Combinatorial Equilibrium Modeling}},
year = {2021},
note = {Release 2.00},
url = { http://github.com/OleOhlbrock/CEM },
}

"""


import Rhino


class Opt(object):
    def __repr__(self):
        return self.ToString()
        
    def __str__(self):
        return self.ToString()
        
    def ToString(self):
        bl0_targetNode = False
        bl0_targetVector = False
        if TN and hasattr(TN, "targetNode") and hasattr(TN, "targetNodeID") and len(TN.targetNode) == len(TN.targetNodeID):
                bl0_targetNode = True
        if TV and hasattr(TV, "targetVector") and hasattr(TV, "targetVectorID") and len(TV.targetVector) == len(TV.targetVectorID):
                bl0_targetVector = True
        if bl0_targetNode and bl0_targetVector:
            return "Target Node and Target Vector"
        if bl0_targetNode and not bl0_targetVector:
            return "Target Node"
        if not bl0_targetNode and bl0_targetVector:
            return "Target Vector"
        else:
            return "No Target"

O = Opt()

if TN and hasattr(TN, "targetNode") and hasattr(TN, "targetNodeID"):
    O.targetNode = TN.targetNode
    O.targetNodeID = TN.targetNodeID
    O.targetNodeCoeff = TN.targetNodeCoeff
    
if TV and hasattr(TV, "targetVector") and hasattr(TV, "targetVectorID"):
    O.targetVector = TV.targetVector
    O.targetVectorID = TV.targetVectorID
    O.targetVectorCoeffMag = TV.targetVectorCoeffMag
    O.targetVectorCoeffDir = TV.targetVectorCoeffDir

if LP and hasattr(LP, "minLoadPath"):
    O.minLoadPath = LP.minLoadPath
    O.minLoadPathCoeff = LP.minLoadPathCoeff
else:
    O.minLoadPath = False

if BO and hasattr(BO, "ID"):
    O.boundsOriginNodeID = BO.ID
    O.boundsOriginNodeUpX = BO.UpX
    O.boundsOriginNodeLowX = BO.LowX
    O.boundsOriginNodeUpY = BO.UpY
    O.boundsOriginNodeLowY = BO.LowY
    O.boundsOriginNodeUpZ = BO.UpZ
    O.boundsOriginNodeLowZ = BO.LowZ
else:
    O.boundsOriginNodeID = []
    O.boundsOriginNodeUpX = []
    O.boundsOriginNodeLowX = []
    O.boundsOriginNodeUpY = []
    O.boundsOriginNodeLowY = []
    O.boundsOriginNodeUpZ = []
    O.boundsOriginNodeLowZ = []

if BL and hasattr(BL, "ID"):
    O.boundsLoadID = BL.ID
    O.boundsLoadUpX = BL.UpX
    O.boundsLoadLowX = BL.LowX
    O.boundsLoadUpY = BL.UpY
    O.boundsLoadLowY = BL.LowY
    O.boundsLoadUpZ = BL.UpZ
    O.boundsLoadLowZ = BL.LowZ
else:
    O.boundsLoadID = []
    O.boundsLoadUpX = []
    O.boundsLoadLowX = []
    O.boundsLoadUpY = []
    O.boundsLoadLowY = []
    O.boundsLoadUpZ = []
    O.boundsLoadLowZ = []

if BT and hasattr(BT, "ID"):
    O.boundsTrailID = BT.ID
    O.boundsTrailUp = BT.Up
    O.boundsTrailLow = BT.Low
else:
    O.boundsTrailID = []
    O.boundsTrailUp = []
    O.boundsTrailLow = []

if BD and hasattr(BD, "ID"):
    O.boundsDevID = BD.ID
    O.boundsDevUp = BD.Up
    O.boundsDevLow = BD.Low
else:
    O.boundsDevID = []
    O.boundsDevUp = []
    O.boundsDevLow = []


if gradientDelta is None:
    O.gradientDelta = 0.001
else:
    O.gradientDelta = gradientDelta

if relativeTolerance is None:
    O.relativeTolerance = 0.001
else:
    O.relativeTolerance = relativeTolerance

if maxIterations is None:
    O.maxIterations = 20
else:
    O.maxIterations = maxIterations

if optimAlgorithm is None:
    O.optimAlgorithm = "LN_BOBYQA"
else:
    O.optimAlgorithm = optimAlgorithm
# ---------- end cem_optimization_setup_2_0 ----------
cem_calculate_structure_2_0 = PythonScript(
    TP=cem_build_topology_2_0.TP,
    CPL=cem_constraint_plane_2_0,
    N=cem_origin_node_2_0,
    SW=cem_material_properties_2_0,
    O=cem_optimization_setup_2_0)  # -> M
# ---------- cem_calculate_structure_2_0: Python ----------
"""
Calculate the structural model
    Inputs:
        TP: (topological diagram) The topological diagram used for the calculation of the structural model
        CPL: (constraintPlaneObject) The constraint planes and their Indices
        N: (originnodeObject) The origin nodes and their Indices
        SW: (selfWeightObject) The Activation of self weight of the structure and their yield stress and specific weight attributes
        O: (optimizationObject) The Settings for an Optimization that can be performed 
    Outputs:
        M: (structural model) The calculated structural model (empty model on error)
    Remarks:
        This generates a new instance of the structural model for a given topological diagram
"""
        
__author__    = ['Patrick Ole Ohlbrock','Pierluigi D''Acunto' ]
__copyright__ = 'Copyright 2021 - ETH Zurich and Technical University of Munich'
__license__   = 'MIT License'
__email__     = ['ohlbrock@arch.ethz.ch','pierluigi.dacunto@tum.de']
__version__   = "2.00"
        
"""
If you use the CEM library in a project, please refer to the GitHub repository: 
        
@Misc{cem2021,
author = {Ohlbrock, Patrick Ole and D'Acunto, Pierluigi},
title = {{CEM: Combinatorial Equilibrium Modeling}},
year = {2021},
note = {Release 2.00},
url = { http://github.com/OleOhlbrock/CEM },
}
        
"""
        
import Grasshopper, GhPython
import System
import rhinoscriptsyntax as rs
import Rhino.Geometry as rh
import math
import System.Drawing.Color
import copy
import time
import clr
import os
import collections
from os.path import expanduser
from System import Array, Func
        
path = expanduser(str(os.getenv('APPDATA')) + ("\\Grasshopper\\Libraries\\NLoptNet\\NLoptNet.dll"))
path = expanduser(path)
        
clr.AddReferenceToFileAndPath(path)
clr.AddReference('System.Core')
        
import NLoptNet as nl
        
global int0_Counter
global pt2_Trails
global pt1_GlobNodeOut
global ln1_GlobTrailEdgeOut
global ln1_GlobDeviation1EdgeOut
global ln1_GlobDeviation2EdgeOut
global vc2_GlobTrailForce
global ln2_GlobExtEdge
global pt2_GlobNode
global pt2_GlobNodeIteration
global ln2_GlobTrailEdge
global cl2_GlobTrailEdge
global db2_GlobTrailEdge
global ln2_GlobDeviation1Edge
global cl2_GlobDeviation1Edge
global db2_GlobDeviation1Edge
global ln2_GlobDeviation2Edge
global cl2_GlobDeviation2Edge
global db2_GlobDeviation2Edge
global ln2_GlobExtFOEdge
global cl2_GlobExtFOEdge
global db2_GlobExtFOEdge
global int0_CounterOpt 
global db0_DistanceBest
global db1_VariableBest
global str1_TrailEdgeID
global str1_Dev1EdgeID
global str1_Dev2EdgeID
global int1_DevEdgeInputID
global str0_GlobSolver
global str0_GlobDivergence
global str0_GlobIteration
global db0_GlobLoadPath
        
class model(object):
    def __repr__(self):
        return self.ToString()
                
    def __str__(self):
        return self.ToString()
                
    def ToString(self):
        if TPC and hasattr(TPC, "db1_StructuralBehaviourOut"):
            str0_Description = "Structural Model\n"
            if db0_GlobLoadPath:
                str0_Description += "\nload path: " + str(db0_GlobLoadPath) + ' kNm'
            if str0_GlobSolver:
                str0_Description += "\nsolver: " +  str0_GlobSolver
                if str0_GlobDivergence:
                    str0_Description += "\ndivergence: " +  str0_GlobDivergence
            return str0_Description
        else:
            return "Empty Structural Model"

        
        
        
### AUXILIARY FUNCTIONS
def ListListToList(xx2_Data):
    xx1_DataOut = []
    for xx1_Data in xx2_Data:
        xx1_DataOut.extend(xx1_Data)
    return xx1_DataOut
        
def TransposeListList(xx2_Data):
    xx2_DataOut = list(map(list, zip(*xx2_Data)))
    return xx2_DataOut
            
def ListToListList(xx1_Data, int0_R, int0_C):
    xx2_DataOut = []
    for i in range(int0_R):
        xx1_DataOut = []
        for j in range(int0_C):
            xx1_DataOut.append(xx1_Data[j+i*int0_C])
        xx2_DataOut.append(xx1_DataOut)
    return xx2_DataOut
        
def DataTreeToListList(dt2_Data):
    xx2_DataOut = []
    for i in range(dt2_Data.BranchCount):
        xx1_DataOut = []
        for j in range(len(dt2_Data.Branch(i))):
            xx1_DataOut.append(dt2_Data.Branch(i)[j])
        xx2_DataOut.append(xx1_DataOut)
    return xx2_DataOut
        
        
constraintPlane = []
constraintPlaneID = []
        
if CPL and CPL.ToString() != "Invalid Constraint Planes":
    constraintPlane = CPL.constraintPlane
    constraintPlaneID = CPL.constraintPlaneID
        
        
targetNode = []
targetNodeID = []
targetNodeCoeff = []
        
if O and O.ToString() != "No Target" and hasattr(O, "targetNode") and hasattr(O, "targetNodeID"):
    targetNode = O.targetNode
    targetNodeID = O.targetNodeID
    targetNodeCoeff = O.targetNodeCoeff
        
targetVector = []
targetVectorID = []
targetVectorCoeffMag = []
targetVectorCoeffDir = []
        
if O and O.ToString() != "No Target" and hasattr(O, "targetVector") and hasattr(O, "targetVectorID"):
    targetVector = O.targetVector
    targetVectorID = O.targetVectorID
    targetVectorCoeffMag = O.targetVectorCoeffMag
    targetVectorCoeffDir = O.targetVectorCoeffDir
        
minLoadPath = False
minLoadPathCoeff = 0.0
        
if O and hasattr(O, "minLoadPath") and hasattr(O, "minLoadPathCoeff"):
    minLoadPath = O.minLoadPath
    minLoadPathCoeff = O.minLoadPathCoeff
        
yieldStress = None
specWeight = None
        
if SW and SW.ToString() != "No Self Weight" and hasattr(SW, "yieldStress") and hasattr(SW, "specWeight"):
    yieldStress = SW.yieldStress
    specWeight = SW.specWeight
        
TPC = copy.deepcopy(TP)
        
if TPC and TPC.ToString() != "Empty Topology" and hasattr(TPC, "db1_StructuralBehaviourOut"):
    if len(constraintPlane) > 0:
        if len(constraintPlane) == len(constraintPlaneID):
            TPC.pl1_ConstraintPlaneOut = constraintPlane
            TPC.int1_ConstraintPlaneOut = constraintPlaneID
        else:
            TPC.pl1_ConstraintPlaneOut = None
            TPC.int1_ConstraintPlaneOut = None
    else:
        TPC.pl1_ConstraintPlaneOut = None
        TPC.int1_ConstraintPlaneOut = None
        
    if N and N.ToString() != "Undefined Origin Nodes" and hasattr(N, "originNode"):
        if len(N.originNode) == len(TPC.pt1_OriginNodeOut):
            TPC.pt1_OriginNodeOut = N.originNode
        if hasattr(N, "originNodeID") and len(N.originNodeID) == len(TPC.str1_OriginNodeOut):
            int1_OriginNodeOut = [int(str0_OriginNodeOut[1:]) for str0_OriginNodeOut in TPC.str1_OriginNodeOut]
            pt1_OriginNodeShift = []
            if collections.Counter(N.originNodeID) == collections.Counter(int1_OriginNodeOut):
                for int0_OriginNodeID in N.originNodeID:
                    pt1_OriginNodeShift.append(TPC.pt1_OriginNodeOut[int1_OriginNodeOut.index(int0_OriginNodeID)])
                TPC.pt1_OriginNodeOut = pt1_OriginNodeShift
        
        
## CREATE LIST OF EDGES IDS
        
if TPC and hasattr(TPC, "dc2_TrailEndsOut"):
    dc2_TrailEdge = dict( [ [tuple(v),k] for k, v in TPC.dc2_TrailEndsOut.items() ] )
        
str1_NodeOrder = []
if TPC and hasattr(TPC, "db1_StructuralBehaviourOut"):
    str1_NodeOrder = TPC.str1_NodeOrderOut[:]
        
    # Trail Edge
    str1_TrailEdgeID = []
    for str0_NodeOrder in str1_NodeOrder:
        for key in dc2_TrailEdge:
            if str0_NodeOrder == key[0] and dc2_TrailEdge[key] != "X":
                str1_TrailEdgeID.append( dc2_TrailEdge[key] )
                dc2_TrailEdge[key] = "X"
            if str0_NodeOrder == key[1] and dc2_TrailEdge[key] != "X":
                str1_TrailEdgeID.append( dc2_TrailEdge[key] )
                dc2_TrailEdge[key] = "X"
        
# Direct Deviation Edges
        
dc2_Deviation1EndsOut = []
dc2_Deviation2EndsOut = []
db1_StructuralBehaviourOut = []
pt1_OriginNodeOut = []
        
if TPC and hasattr(TPC, "db1_StructuralBehaviourOut"):
    dc2_Deviation1EndsOut = TPC.dc2_Deviation1EndsOut
    dc2_Deviation2EndsOut = TPC.dc2_Deviation2EndsOut
    db1_StructuralBehaviourOut = TPC.db1_StructuralBehaviourOut
    pt1_OriginNodeOut = TPC.pt1_OriginNodeOut
        
        
    dc2_Dev1Edge = dict( [ [tuple(v),k] for k, v in dc2_Deviation1EndsOut.items() ] )
    dc2_Dev2Edge = dict( [ [tuple(v),k] for k, v in dc2_Deviation2EndsOut.items() ] )
        
    str1_Dev1EdgeID = []
    db2_StructuralBehaviourOut = []
    for i in range(len(str1_NodeOrder)):
        db1_StructuralBehaviourOutRow = db1_StructuralBehaviourOut[i*(3+len(pt1_OriginNodeOut)+1):(i+1)*(3+len(pt1_OriginNodeOut)+1)]
        db2_StructuralBehaviourOut.append(db1_StructuralBehaviourOutRow)
            
    for i in range(len(db2_StructuralBehaviourOut)):
        for j in range(4+(i % (len(db2_StructuralBehaviourOut[i])-4) ) ,len(db2_StructuralBehaviourOut[i])-1):
            if db2_StructuralBehaviourOut[i][j] != 0:
                id_i = str1_NodeOrder[i]
                id_j = str1_NodeOrder[ (i // (len(db2_StructuralBehaviourOut[i])-4)) * (len(db2_StructuralBehaviourOut[i])-4) + j-3]
                if (id_i,id_j) in dc2_Dev1Edge:
                    str1_Dev1EdgeID.append(dc2_Dev1Edge[(id_i,id_j)])
                else:
                    str1_Dev1EdgeID.append(dc2_Dev1Edge[(id_j,id_i)])
            
    # Indirect Deviation Edges
    int1_Dev2EdgeID = sorted([int(key) for key in dc2_Deviation2EndsOut.copy()])
    str1_Dev2EdgeID = [str(key) for key in int1_Dev2EdgeID]
            
    int1_DevEdgeInputID = []
    if TPC and hasattr(TPC, "db1_StructuralBehaviourOut"):
        int1_DevEdgeInputID = TPC.int1_Deviation1ID[:]
        int1_DevEdgeInputID.extend(TPC.int1_Deviation2ID)
        
        
# Add External Forces to StructuralBehaviourOut
                
int0_TrailNumber = len(pt1_OriginNodeOut)
int0_C = 3+int0_TrailNumber+1
int0_R = int(len(db1_StructuralBehaviourOut)/int0_C)
        
dc2_ForceOut = []
        
if TPC and hasattr(TPC, "dc2_ForceOut"):
    dc2_ForceOut = TPC.dc2_ForceOut
            
    for key in dc2_ForceOut:
        int0_StructuralBehaviourRow = int(str1_NodeOrder.index(dc2_ForceOut[key][3]))
        int0_ExtForcePosX = int0_StructuralBehaviourRow*(int0_C)
        int0_ExtForcePosY = int0_StructuralBehaviourRow*(int0_C)+1 
        int0_ExtForcePosZ = int0_StructuralBehaviourRow*(int0_C)+2
                
        db1_StructuralBehaviourOut[int0_ExtForcePosX] += dc2_ForceOut[key][0]
        db1_StructuralBehaviourOut[int0_ExtForcePosY] += dc2_ForceOut[key][1]
        db1_StructuralBehaviourOut[int0_ExtForcePosZ] += dc2_ForceOut[key][2]
        
db2_StructuralBehaviour = ListToListList(db1_StructuralBehaviourOut, int0_R, int0_C)

# Initialize Load Path        
db0_GlobLoadPath = 0.0
        
### EQUILIBRIUM FUNCTION
def Equilibrium(db1_StructuralBehaviour, xx1_Bracing, pt1_OriginNode, pl1_ConstraintPlane):
            
            
    global int0_Counter     # global counter
            
            
    g = 0                                   
    ### ITERATE FOR EACH LAYER OF THE STRUCTURE
            
    ## Initialize
    pt1_InputNode = []
            
            
    for g in range(int0_LayerCount):
                
        vc1_TrailForceIn = []
                
        if g == 0:
            pt1_InputNode = pt1_OriginNode
            for i in range(int0_TrailNumber):
                vc1_TrailForceIn.append(rh.Vector3d(0,0,0)) 
        else:
            pt1_InputNode = pt2_GlobNode[g-1]
            for i in range(int0_TrailNumber):
                vc1_TrailForceIn.append(-vc2_GlobTrailForce[g-1][i])
            
        # Extract Deviation Matrix
        db2_DevForceMag = []
        
        for i in range(g * int0_TrailNumber, (g + 1) * int0_TrailNumber):
            db1_DevForceMag = []
            for j in range(3, int0_TrailNumber + 3):
                db1_DevForceMag.append(db2_StructuralBehaviour[i][j])
            db2_DevForceMag.append(db1_DevForceMag)
            
            
        ### LAYER DEVELOPMENT
                
        ## Initialize Layer
                
                
        # Create Deviation Length and Unit Vector Matrix
        vc2_DevLengthVector = []
        vc2_DevUnitVector = []
        db2_DevLengthVector = []
                
        vc2_DevLengthVector = [ [rh.Vector3d(0.0,0.0,0.0) for i in range(int0_TrailNumber)] for i in range(int0_TrailNumber)]
        vc2_DevUnitVector = [ [rh.Vector3d(0.0,0.0,0.0) for i in range(int0_TrailNumber)] for i in range(int0_TrailNumber)]
        db2_DevLengthVector = [ [0.0 for i in range(int0_TrailNumber)] for i in range(int0_TrailNumber)]
                
        for i in range(int0_TrailNumber):
            for j in range(int0_TrailNumber):
                if abs(db2_DevForceMag[i][j]) > db0_Threshold:
                    vc0_InputNode_j = rh.Vector3d(pt1_InputNode[j])
                    vc0_InputNode_i = rh.Vector3d(pt1_InputNode[i])
                    vc0_DevLengthVector = vc0_InputNode_j - vc0_InputNode_i
                    vc2_DevLengthVector[i][j] = vc0_DevLengthVector
                    vc2_DevLengthVector[j][i] = -vc0_DevLengthVector
                    db0_DevLengthVector = vc0_DevLengthVector.Length
                    db2_DevLengthVector[i][j] = db0_DevLengthVector
                    db2_DevLengthVector[j][i] = db0_DevLengthVector
                    vc0_DevUnitVector = rh.Vector3d(vc0_DevLengthVector.X/db0_DevLengthVector, vc0_DevLengthVector.Y/db0_DevLengthVector, vc0_DevLengthVector.Z/db0_DevLengthVector)
                    vc2_DevUnitVector[i][j] = vc0_DevUnitVector
                    vc2_DevUnitVector[j][i] = -vc0_DevUnitVector
                
                
        # Create List of External Forces
        # list for external and bracing forces
        db1_ExtForceX = []
        db1_ExtForceY = []
        db1_ExtForceZ = []
                
        # list for external forces only
        db1_ExtFOX = []
        db1_ExtFOY = []
        db1_ExtFOZ = []
                
        # Add External Forces from Matrix    
        for i in range(g*int0_TrailNumber,(g+1)*int0_TrailNumber):
            db1_ExtFOX.append(db2_StructuralBehaviour[i][0])
            db1_ExtFOY.append(db2_StructuralBehaviour[i][1])
            db1_ExtFOZ.append(db2_StructuralBehaviour[i][2])
                    
        for i in range(g*int0_TrailNumber,(g+1)*int0_TrailNumber):
            db1_ExtForceX.append(db2_StructuralBehaviour[i][0])
            db1_ExtForceY.append(db2_StructuralBehaviour[i][1])
            db1_ExtForceZ.append(db2_StructuralBehaviour[i][2])
        
        
            # Add Magnitudes of Bracing Forces as External Forces
            # Start node of bracing
            if len(xx1_Bracing) > 0:
                if int0_Counter != 0:
                    for j in range(0,len(xx1_Bracing),3):
                        int0_BracingFromLayerIndex = int(xx1_Bracing[j]) // int0_TrailNumber
                        if i == int(xx1_Bracing[j]):
                            pt0_BracingFrom = pt2_GlobNodeIteration[g][i-g*int0_TrailNumber]
                            int0_BracingToLayerIndex = int(xx1_Bracing[j+1]) // int0_TrailNumber
                            int0_BracingToTrailIndex = int(xx1_Bracing[j+1]) % int0_TrailNumber
                            pt0_BracingTo = pt2_GlobNodeIteration[int0_BracingToLayerIndex][int0_BracingToTrailIndex]
                            vc0_ForceA = rh.Vector3d(pt0_BracingTo-pt0_BracingFrom)
                            rh.Vector3d.Unitize(vc0_ForceA)
                            vc0_ForceA = float(xx1_Bracing[j+2])*vc0_ForceA
                            db1_ExtForceX[i-g*int0_TrailNumber] += vc0_ForceA.X
                            db1_ExtForceY[i-g*int0_TrailNumber] += vc0_ForceA.Y
                            db1_ExtForceZ[i-g*int0_TrailNumber] += vc0_ForceA.Z
                                
            # End node of bracing
            if len(xx1_Bracing) > 0:
                if int0_Counter != 0:
                    for j in range(1,len(xx1_Bracing),3):
                        int0_BracingFromLayerIndex = int(xx1_Bracing[j]) // int0_TrailNumber
                        if i == int(xx1_Bracing[j]):
                            pt0_BracingFrom = pt2_GlobNodeIteration[g][i-g*int0_TrailNumber]
                            int0_BracingToLayerIndex = int(xx1_Bracing[j-1]) // int0_TrailNumber
                            int0_BracingToTrailIndex = int(xx1_Bracing[j-1]) % int0_TrailNumber
                            pt0_BracingTo = pt2_GlobNodeIteration[int0_BracingToLayerIndex][int0_BracingToTrailIndex]
                            vc0_ForceA = rh.Vector3d(pt0_BracingTo-pt0_BracingFrom)
                            rh.Vector3d.Unitize(vc0_ForceA)
                            vc0_ForceA = float(xx1_Bracing[j+1])*vc0_ForceA
                            db1_ExtForceX[i-g*int0_TrailNumber] += vc0_ForceA.X
                            db1_ExtForceY[i-g*int0_TrailNumber] += vc0_ForceA.Y
                            db1_ExtForceZ[i-g*int0_TrailNumber] += vc0_ForceA.Z
                
        # Vector sum of external and bracing forces for the equilibrium calculation
        vc1_ExtForce = []
        for i in range(int0_TrailNumber):
            vc0_ExtForce = rh.Vector3d(db1_ExtForceX[i],db1_ExtForceY[i],db1_ExtForceZ[i])
            vc1_ExtForce.append(vc0_ExtForce)
                
                
        # Extract Deviation Matrix
        db2_DevForceMag = []
                
        for i in range(g*int0_TrailNumber,(g+1)*int0_TrailNumber):
            db1_DevForceMag = []
            for j in range(3,int0_TrailNumber+3):
                db1_DevForceMag.append(db2_StructuralBehaviour[i][j])
            db2_DevForceMag.append(db1_DevForceMag)
                
                
        # Create Trail Length and Static Action Matrix from Input Origin Points
        db1_TrailLength = []
        db1_TrailStatAct = []
                
        for i in range(g*int0_TrailNumber,(g+1)*int0_TrailNumber):
            db1_TrailLength.append(db2_StructuralBehaviour[i][int0_TrailNumber+3])
            if g == 0:
                db1_TrailStatAct.append(0)
            else:
                db1_TrailStatAct.append(abs((db2_StructuralBehaviour[i-int0_TrailNumber][int0_TrailNumber+3]*vc1_TrailForceIn[i-g*int0_TrailNumber]).Length))
                
        # Calculate Hadamard Product of Deviation Length Matrix and Deviation Matrix
        vc2_DevForce = []
        db2_DevStatAct = []
                
        for i in range(int0_TrailNumber):
            vc1_DevForce = []
            db1_DevStatAct = []
            for j in range(int0_TrailNumber):
                vc0_DevForce = vc2_DevUnitVector[i][j]*db2_DevForceMag[i][j]
                db0_DevStatAct = abs(db2_DevLengthVector[i][j]*db2_DevForceMag[i][j])
                vc1_DevForce.append(vc0_DevForce)
                db1_DevStatAct.append(db0_DevStatAct)
            vc2_DevForce.append(vc1_DevForce)
            db2_DevStatAct.append(db1_DevStatAct)
        
                
        # Sum Deviation Vectors and Static Action per each Node
        vc1_DevForceSum = []
        db1_DevStatActSum = []
        db1_IndDevStatActSum = []
                
        for i in range(int0_TrailNumber):
            vc0_DevForceSum = rh.Vector3d(0,0,0)
            db0_DevStatActSum = 0
            for j in range(int0_TrailNumber):
                vc0_DevForceSum += vc2_DevForce[i][j]
                db0_DevStatActSum += db2_DevStatAct[i][j]
            vc1_DevForceSum.append(vc0_DevForceSum)
            db1_DevStatActSum.append(db0_DevStatActSum)
        # Get Static Action per Node for Indirect Deviations
        # Start Node of Inderect Deviations
        if specWeight and yieldStress and len(xx1_Bracing) > 0:
            int1_StartBracingIndex = []
            int1_EndBracingIndex = []
            db1_BracingValue = []
            for i in range(0,len(xx1_Bracing),3):
                int1_StartBracingIndex.append(int(xx1_Bracing[i]))
                int1_EndBracingIndex.append(int(xx1_Bracing[i+1]))
                db1_BracingValue.append(float(xx1_Bracing[i+2]))
            for i in range(int0_TrailNumber):
                if int0_Counter != 0:
                    int1_StartBracingIndex_C = int1_StartBracingIndex[:]
                    int1_EndBracingIndex_C = int1_EndBracingIndex[:]
                    db1_BracingValue_C = db1_BracingValue[:]
                    db0_IndDevStatActSum = 0
                    for j in int1_StartBracingIndex:
                        if g*int0_TrailNumber + i == j:
                            int0_StartBracingIndex = int1_StartBracingIndex_C.index(g*int0_TrailNumber + i)
                            int0_StartBracingGlobIndex = g*int0_TrailNumber + i
                            int0_EndBracingGlobIndex = int1_EndBracingIndex_C[ int0_StartBracingIndex ]
                            db0_ValueBracingGlobIndex = db1_BracingValue_C[ int0_StartBracingIndex ]
                            int1_StartBracingIndex_C.pop( int0_StartBracingIndex )
                            int1_EndBracingIndex_C.pop( int0_StartBracingIndex )
                            db1_BracingValue_C.pop( int0_StartBracingIndex )
                            # Get Start and End Nodes of Bracing
                            int0_StartBracingLayer = g
                            int0_StartBracingTrail = i
                            int0_EndBracingLayer = int0_EndBracingGlobIndex // int0_TrailNumber
                            int0_EndBracingTrail = int0_EndBracingGlobIndex % int0_TrailNumber
                            pt0_StartBracing = pt2_GlobNodeIteration[int0_StartBracingLayer][int0_StartBracingTrail]
                            pt0_EndBracing = pt2_GlobNodeIteration[int0_EndBracingLayer][int0_EndBracingTrail]
                            db0_IndDevStatActSum += abs(db0_ValueBracingGlobIndex*pt0_StartBracing.DistanceTo(pt0_EndBracing))
                    db1_IndDevStatActSum.append(db0_IndDevStatActSum)
                                
            # End Node of Inderect Deviations
            int1_StartBracingIndex = []
            int1_EndBracingIndex = []
            db1_BracingValue = []
            for i in range(1,len(xx1_Bracing),3):
                int1_StartBracingIndex.append(int(xx1_Bracing[i-1]))
                int1_EndBracingIndex.append(int(xx1_Bracing[i]))
                db1_BracingValue.append(float(xx1_Bracing[i+1]))
            for i in range(int0_TrailNumber):
                if int0_Counter != 0:
                    int1_StartBracingIndex_C = int1_StartBracingIndex[:]
                    int1_EndBracingIndex_C = int1_EndBracingIndex[:]
                    db1_BracingValue_C = db1_BracingValue[:]
                    db0_IndDevStatActSum = 0
                    for j in int1_EndBracingIndex:
                        if g*int0_TrailNumber + i == j:
                            int0_EndBracingIndex = int1_EndBracingIndex_C.index(g*int0_TrailNumber + i)
                            int0_EndBracingGlobIndex = g*int0_TrailNumber + i
                            int0_StartBracingGlobIndex = int1_StartBracingIndex_C[ int0_EndBracingIndex ]
                            db0_ValueBracingGlobIndex = db1_BracingValue_C[ int0_EndBracingIndex ]
                            int1_StartBracingIndex_C.pop( int0_EndBracingIndex )
                            int1_EndBracingIndex_C.pop( int0_EndBracingIndex )
                            db1_BracingValue_C.pop( int0_EndBracingIndex )
                            # Get Start and End Nodes of Bracing
                            int0_EndBracingLayer = g
                            int0_EndBracingTrail = i
                            int0_StartBracingLayer = int0_StartBracingGlobIndex // int0_TrailNumber
                            int0_StartBracingTrail = int0_StartBracingGlobIndex % int0_TrailNumber
                            pt0_StartBracing = pt2_GlobNodeIteration[int0_StartBracingLayer][int0_StartBracingTrail]
                            pt0_EndBracing = pt2_GlobNodeIteration[int0_EndBracingLayer][int0_EndBracingTrail]
                            db0_IndDevStatActSum += abs(db0_ValueBracingGlobIndex*pt0_StartBracing.DistanceTo(pt0_EndBracing))
                    db1_IndDevStatActSum[i] += db0_IndDevStatActSum
        else:
            db1_IndDevStatActSum = [0.0 for i in range(int0_TrailNumber)]
                
        # Construct Equilibrium per each Node
        vc1_TrailForceOut = []
        vc1_SelfWeight = []
        
                
        for i in range(int0_TrailNumber):
            if int0_Counter == 0 and len(xx1_Bracing) > 0:
                if specWeight and yieldStress:
                    vc0_SelfWeight = rh.Vector3d(((db1_TrailStatAct[i] + db1_DevStatActSum[i]/2)*specWeight/yieldStress)*(-rh.Vector3d.ZAxis))
                    vc0_TrailForceOut = -(vc1_ExtForce[i] + vc1_DevForceSum[i] + vc1_TrailForceIn[i] + vc0_SelfWeight)
                    vc1_TrailForceOut.append(vc0_TrailForceOut)
                    vc1_SelfWeight.append(vc0_SelfWeight)
                else:
                    vc0_TrailForceOut = -(vc1_ExtForce[i] + vc1_DevForceSum[i] + vc1_TrailForceIn[i])
                    vc1_TrailForceOut.append(vc0_TrailForceOut)
            else:
                if specWeight and yieldStress:
                    vc0_SelfWeight = rh.Vector3d(((db1_TrailStatAct[i] + db1_DevStatActSum[i]/2 + db1_IndDevStatActSum[i]/2 )*specWeight/yieldStress)*(-rh.Vector3d.ZAxis))
                    vc0_TrailForceOut = -(vc1_ExtForce[i] + vc1_DevForceSum[i] + vc1_TrailForceIn[i] + vc0_SelfWeight)
                    vc1_TrailForceOut.append(vc0_TrailForceOut)
                    vc1_SelfWeight.append(vc0_SelfWeight)
                else:
                    vc0_TrailForceOut = -(vc1_ExtForce[i] + vc1_DevForceSum[i] + vc1_TrailForceIn[i])
                    vc1_TrailForceOut.append(vc0_TrailForceOut)
                        
        
        
        # Add External Forces to the Form Diagram
        ln1_ExtFOEdge = []
        cl1_ExtFOEdge = []
        db1_ExtFOEdge = []
        
        
        # Vector sum of external forces only for visualization
        vc1_ExtFO = []
        for i in range(int0_TrailNumber):
            vc0_ExtFO = rh.Vector3d(db1_ExtFOX[i],db1_ExtFOY[i],db1_ExtFOZ[i])
            vc1_ExtFO.append(vc0_ExtFO)
                
        for i in range(len(vc1_ExtFO)):
            if len(vc1_SelfWeight) == len(vc1_ExtFO):
                ln1_ExtFOEdge.append(rh.Line(pt1_InputNode[i],(pt1_InputNode[i] + vc1_SelfWeight[i] + vc1_ExtFO[i])))
                cl1_ExtFOEdge.append(System.Drawing.Color.DarkGreen)
                db1_ExtFOEdge.append(abs(vc1_SelfWeight[i].Length + vc1_ExtFO[i].Length))
            else:
                ln1_ExtFOEdge.append(rh.Line(pt1_InputNode[i],(pt1_InputNode[i] + vc1_ExtFO[i])))
                cl1_ExtFOEdge.append(System.Drawing.Color.DarkGreen)
                db1_ExtFOEdge.append(abs(vc1_ExtFO[i].Length))
        
        
                
        ## Construction Form Diagram
                
        # Find New Nodes
               
        pt1_Node = []
                
        for i in range(int0_TrailNumber):
            vc0_TrailForceOutUn = rh.Vector3d(vc1_TrailForceOut[i])
            rh.Vector3d.Unitize(vc0_TrailForceOutUn)
            ln0_TrailOut = rh.Line(pt1_InputNode[i],vc0_TrailForceOutUn)
            pt0_Node = pt1_InputNode[i] + vc0_TrailForceOutUn*db1_TrailLength[i]
            pt1_Node.append(pt0_Node)
                    
            # Modify result in case of constraint planes
            if pl1_ConstraintPlane:
                if g != int0_LayerCount-1:
                    for j in range(len(id_NodePlane)):
                        if str(str1_NodeOrderC[((g+1)*int0_TrailNumber)+i]) == str(id_NodePlane[j]):
                            pl0_PlaneTrailOut = pl1_ConstraintPlane[j]
                            if pl0_PlaneTrailOut is not None:
                                xx1_Intersect = rh.Intersect.Intersection.LinePlane(ln0_TrailOut,pl0_PlaneTrailOut)
                                bl0_Intersect = xx1_Intersect[0]
                                db0_Intersect = xx1_Intersect[1]
                                if abs(db0_Intersect) < abs(db0_Threshold):
                                    db1_TrailLength[i] = 0.0
                                    pt0_Node = pt1_InputNode[i]
                                if bl0_Intersect and abs(db0_Intersect) > abs(db0_Threshold):
                                    pt0_Node = ln0_TrailOut.PointAt(db0_Intersect)
                                    db1_TrailLength[i] = pt1_InputNode[i].DistanceTo(pt0_Node)*db0_Intersect/abs(db0_Intersect)
                    pt1_Node[len(pt1_Node)-1] = pt0_Node
                
        # Build Trail Edges
        ln1_TrailEdge = []
        cl1_TrailEdge = []
        db1_TrailEdge = []
                
        for i in range(int0_TrailNumber):
            ln0_TrailEdge = rh.Line(pt1_InputNode[i],pt1_Node[i])
            ln1_TrailEdge.append(ln0_TrailEdge)
            if db1_TrailLength[i] > 0.0:
                cl1_TrailEdge.append(System.Drawing.Color.Red)
                db1_TrailEdge.append(vc1_TrailForceOut[i].Length)
            elif db1_TrailLength[i] < 0.0:
                cl1_TrailEdge.append(System.Drawing.Color.Blue)
                db1_TrailEdge.append(-vc1_TrailForceOut[i].Length)
            else:
                cl1_TrailEdge.append(System.Drawing.Color.Black)
                db1_TrailEdge.append(0.0)
            #db1_TrailEdge.append(abs(vc1_TrailForceOut[i].Length))
        
        
        # Build Deviation Edges
        ln1_Deviation1Edge = []
        cl1_Deviation1Edge = []
        db1_Deviation1Edge = []
        k = 3
                
        for i in range(g*int0_TrailNumber,(g+1)*int0_TrailNumber):
            k += 1
            for j in range(k,int0_TrailNumber+3):
                if db2_StructuralBehaviour[i][j] != 0:
                    ln0_Deviation1Edge = rh.Line(pt1_InputNode[i % int0_TrailNumber],pt1_InputNode[j-3])
                    ln1_Deviation1Edge.append(ln0_Deviation1Edge)
                    if db2_StructuralBehaviour[i][j] > 0.0:
                        cl1_Deviation1Edge.append(System.Drawing.Color.Red)
                    else:
                        cl1_Deviation1Edge.append(System.Drawing.Color.Blue)
                    #db1_Deviation1Edge.append(abs(db2_StructuralBehaviour[i][j]))
                    db1_Deviation1Edge.append(db2_StructuralBehaviour[i][j])
        vc2_GlobTrailForce.append(vc1_TrailForceOut)
        
        
        # Form Diagram
        ln2_GlobTrailEdge.append(ln1_TrailEdge)
        db2_GlobTrailEdge.append(db1_TrailEdge)
        cl2_GlobTrailEdge.append(cl1_TrailEdge)
        ln2_GlobDeviation1Edge.append(ln1_Deviation1Edge)
        cl2_GlobDeviation1Edge.append(cl1_Deviation1Edge)
        db2_GlobDeviation1Edge.append(db1_Deviation1Edge)
        ln2_GlobExtFOEdge.append(ln1_ExtFOEdge)
        cl2_GlobExtFOEdge.append(cl1_ExtFOEdge)
        db2_GlobExtFOEdge.append(db1_ExtFOEdge)
        pt2_GlobNode.append(pt1_Node)
        
        g += 1
            
    # Add Reactions to Form Diagram
    for i in range(len(vc2_GlobTrailForce[g-1])):
        if cl2_GlobTrailEdge[g-1][i] != System.Drawing.Color.Blue:
            ln1_ExtFOEdge.append(rh.Line(pt2_GlobNode[g-1][i],(pt2_GlobNode[g-1][i] + vc2_GlobTrailForce[g-1][i])))
            db1_ExtFOEdge.append(abs(ln1_ExtFOEdge[len(ln1_ExtFOEdge)-1].Length))
        else:
            ln1_ExtFOEdge.append(rh.Line((pt2_GlobNode[g-1][i] - vc2_GlobTrailForce[g-1][i]),pt2_GlobNode[g-1][i]))
            db1_ExtFOEdge.append(abs(ln1_ExtFOEdge[len(ln1_ExtFOEdge)-1].Length))
        cl1_ExtFOEdge.append(System.Drawing.Color.DarkGreen)
                
    # Update Counter
    int0_Counter += 1
            
            
    return
        
        
### MAIN FUNCTION
def Main(db1_StructuralBehaviour, str1_NodeOrderC, str1_Load, xx1_Bracing, pl1_ConstraintPlane, id_NodePlane, pt1_OriginNode, str1_Edge, db0_Divergence, db0_Threshold, int0_CounterBracing, int0_TrailNumber, int0_C, int0_R, db2_StructuralBehaviour, int0_LayerCount, db1_Variable, bl0_Print):
        
    ### GLOBAL VARIABLES
            
    global pt2_Trails
    global pt1_GlobNodeOut
    global ln1_GlobTrailEdgeOut
    global ln1_GlobDeviation1EdgeOut
    global ln1_GlobDeviation2EdgeOut
    global vc2_GlobTrailForce
    global ln2_GlobExtEdge
    global pt2_GlobNode
    global pt2_GlobNodeIteration
    global ln2_GlobTrailEdge
    global cl2_GlobTrailEdge
    global db2_GlobTrailEdge
    global ln2_GlobDeviation1Edge
    global cl2_GlobDeviation1Edge
    global db2_GlobDeviation1Edge
    global ln2_GlobDeviation2Edge
    global cl2_GlobDeviation2Edge
    global db2_GlobDeviation2Edge
    global ln2_GlobExtFOEdge
    global cl2_GlobExtFOEdge
    global db2_GlobExtFOEdge
    global int0_CounterOpt 
    global db0_DistanceBest
    global db1_VariableBest
    global str1_TrailEdgeID
    global str1_Dev1EdgeID
    global str1_Dev2EdgeID
    global int1_DevEdgeInputID
    global str0_GlobSolver
    global str0_GlobDivergence
    global str0_GlobIteration
    global db0_GlobLoadPath
            
            
    if bl0_Print:
        int0_CounterOpt += 1
        str0_DescriptionOpt = ""
        str0_DescriptionOpt += "\niteration: " + str(int0_CounterOpt)
            
    str0_GlobIteration = str(int0_CounterOpt)
            
            
    # Initialization of Nodes' Position
    for j in range(int0_LayerCount+1):
        pt1_GlobNodeIteration = []
        pt2_GlobNodeIteration.append(pt1_GlobNodeIteration)
            
            
    # Re-Inatialize Global Variables
    dbl0_Divergence = 0
    vc2_GlobTrailForce = []
    ln2_GlobExtEdge = []
    pt2_GlobNode = []
    ln2_GlobTrailEdge = []
    cl2_GlobTrailEdge = []
    db2_GlobTrailEdge = []
    ln2_GlobDeviation1Edge = []
    cl2_GlobDeviation1Edge = []
    db2_GlobDeviation1Edge = []
    ln2_GlobDeviation2Edge = []
    cl2_GlobDeviation2Edge = []
    db2_GlobDeviation2Edge = []
    ln2_GlobExtFOEdge = []
    cl2_GlobExtFOEdge = []
    db2_GlobExtFOEdge = []
            
            
    # Initial Check
    int0_StructuralLayersMatrix = int(len(db1_StructuralBehaviour)/(3+len(pt1_OriginNode)+1)/len(pt1_OriginNode))
    if db1_StructuralBehaviour == None or int0_StructuralLayersMatrix == 0:
        print(str("Please input Matrix of Structural Behaviour"))
        if len(pt1_OriginNode) == 0:
            print(str("Please input Origin Points"))
    else:
        if len(pt1_OriginNode) == 0:
            print(str("Please input Origin Points"))
        else:
            pt1_OriginNodeMod = [pt0_OriginNode for pt0_OriginNode in pt1_OriginNode]
                    
                    
            # Update Variables for Optimization
            if len(db1_Variable) > 0:
                int0_CountVar = 0
                        
                for i in range(len(int2_Deviation1Edge)):
                    key1 = int2_Deviation1Edge[i][0] % int0_TrailNumber + 3
                    key0 = (int2_Deviation1Edge[i][0] // int0_TrailNumber)*int0_TrailNumber + int2_Deviation1Edge[i][1] - 3
                    db2_StructuralBehaviour[int2_Deviation1Edge[i][0]][int2_Deviation1Edge[i][1]] =  db1_Variable[int0_CountVar]
                    db2_StructuralBehaviour[key0][key1] = db1_Variable[int0_CountVar]
                    int0_CountVar += 1
                for i in range(len(int2_TrailEdge)):
                    db2_StructuralBehaviour[ int2_TrailEdge[i][0] ][ int2_TrailEdge[i][1]]  =  db1_Variable[int0_CountVar]
                    int0_CountVar += 1
                for i in range(2,len(xx1_Bracing),3):
                    xx1_Bracing[i] = db1_Variable[int0_CountVar]
                    int0_CountVar += 1
                for i in range(len(pt1_OriginNode)):
                    pt1_OriginNodeMod[i] = rh.Point3d(db1_Variable[int0_CountVar], pt1_OriginNode[i].Y, pt1_OriginNode[i].Z)
                    int0_CountVar += 1
                for i in range(len(pt1_OriginNode)):
                    pt1_OriginNodeMod[i] = rh.Point3d(pt1_OriginNodeMod[i].X, db1_Variable[int0_CountVar], pt1_OriginNode[i].Z)
                    int0_CountVar += 1
                for i in range(len(pt1_OriginNode)):
                    pt1_OriginNodeMod[i] = rh.Point3d(pt1_OriginNodeMod[i].X, pt1_OriginNodeMod[i].Y, db1_Variable[int0_CountVar])
                    int0_CountVar += 1
                            
                for i in range(len(str1_Load)):
                    dc2_ExtForce[str1_Load[i]][0] = db1_Variable[int0_CountVar]
                    dc2_ExtForce[str1_Load[i]][1] = db1_Variable[int0_CountVar + len(str1_Load)]
                    dc2_ExtForce[str1_Load[i]][2] = db1_Variable[int0_CountVar + 2*len(str1_Load)]
                    int0_CountVar += 1
                            
                dc2_ExtForceSum = {}
                for i in range(len(str1_Load)):
                            
                    key = dc2_ExtForce[str1_Load[i]][3]
                    if key not in dc2_ExtForceSum:
                        dc2_ExtForceSum[key] = [ dc2_ExtForce[str1_Load[i]][0], dc2_ExtForce[str1_Load[i]][1], dc2_ExtForce[str1_Load[i]][2] ]
                    else:
                        dc2_ExtForceSum[key][0] += dc2_ExtForce[str1_Load[i]][0]
                        dc2_ExtForceSum[key][1] += dc2_ExtForce[str1_Load[i]][1]
                        dc2_ExtForceSum[key][2] += dc2_ExtForce[str1_Load[i]][2]
                            
                for key in dc2_ExtForceSum:
                    int0_Row = int(str1_NodeOrder.index(key))
                    db2_StructuralBehaviour[int0_Row][0] = dc2_ExtForceSum[key][0]
                    db2_StructuralBehaviour[int0_Row][1] = dc2_ExtForceSum[key][1]
                    db2_StructuralBehaviour[int0_Row][2] = dc2_ExtForceSum[key][2]
                    int0_CountVar += 1
        
            # Start Iteration
            while int0_Counter < int0_CounterBracing and db0_Divergence > db0_Threshold:
        
                # Call Main Function
                Equilibrium(db1_StructuralBehaviour, xx1_Bracing, pt1_OriginNodeMod, pl1_ConstraintPlane)
                        
                # Store Nodes' Position
                # Here the original line was:
                # pt2_GlobNodeIteration[0] = pt1_OriginNode
                        
                pt2_GlobNodeIteration[0] = pt1_OriginNodeMod
                        
                for j in range(1,len(pt2_GlobNode)+1):
                    if int0_Counter-1 != 0:
                        db0_Divergence = 0
                        for k in range(len(pt2_GlobNode[j-1])):
                            db0_Divergence += pt2_GlobNode[j-1][k].DistanceTo(pt2_GlobNodeIteration[j][k])
                    pt2_GlobNodeIteration[j] = pt2_GlobNode[j-1]
                        
                if bl0_Print:
                    str0_Description = ""
                            
                    str0_Description += "sub-iteration: " + str(int0_Counter) + "\n"
                    if len(xx1_Bracing) == 0:
                        db0_Divergence = 0.00
                    str0_Description += "divergence: " + str(db0_Divergence)
                            
                    print str0_Description
        
                        
                if int0_Counter < int0_CounterBracing and db0_Divergence > db0_Threshold:
                    # Re-Inatialize Global Variables
                    dbl0_Divergence = 0
                    vc2_GlobTrailForce = []
                    ln2_GlobExtEdge = []
                    pt2_GlobNode = []
                    ln2_GlobTrailEdge = []
                    cl2_GlobTrailEdge = []
                    db2_GlobTrailEdge = []
                    ln2_GlobDeviation1Edge = []
                    cl2_GlobDeviation1Edge = []
                    db2_GlobDeviation1Edge = []
                    ln2_GlobDeviation2Edge = []
                    cl2_GlobDeviation2Edge = []
                    db2_GlobDeviation2Edge = []
                    ln2_GlobExtFOEdge = []
                    cl2_GlobExtFOEdge = []
                    db2_GlobExtFOEdge = []
            
                if int0_Counter == int0_CounterBracing or db0_Divergence < db0_Threshold:
                            
                    # Add Bracing
                    ln1_Deviation2Edge = []
                    cl1_Deviation2Edge = []
                    db1_Deviation2Edge = []
                    for i in range(0,len(xx1_Bracing),3):
                        int0_BracingFromLayerIndex = int(xx1_Bracing[i]) // int0_TrailNumber
                        int0_BracingFromTrailIndex = int(xx1_Bracing[i]) % int0_TrailNumber
                        int0_BracingToLayerIndex = int(xx1_Bracing[i+1]) // int0_TrailNumber
                        int0_BracingToTrailIndex = int(xx1_Bracing[i+1]) % int0_TrailNumber
                        ln0_Deviation2Edge = rh.Line(pt2_GlobNodeIteration[int0_BracingFromLayerIndex][int0_BracingFromTrailIndex],pt2_GlobNodeIteration[int0_BracingToLayerIndex][int0_BracingToTrailIndex])
                        ln1_Deviation2Edge.append(ln0_Deviation2Edge)
                        if float(xx1_Bracing[i+2]) > 0.0:
                            cl1_Deviation2Edge.append(System.Drawing.Color.Red)
                        elif float(xx1_Bracing[i+2]) < 0.0:
                            cl1_Deviation2Edge.append(System.Drawing.Color.Blue)
                        else:
                            cl1_Deviation2Edge.append(System.Drawing.Color.Black)
                        db1_Deviation2Edge.append(xx1_Bracing[i+2])
                                
                                
                    ### OUTPUT
            
                    ln1_GlobExtEdgeOut = ListListToList(ln2_GlobExtEdge)
                    pt1_GlobNodeOut = ListListToList(pt2_GlobNodeIteration)
                    ln1_GlobTrailEdgeOut = ListListToList(ln2_GlobTrailEdge)
                    cl1_GlobTrailEdgeOut = ListListToList(cl2_GlobTrailEdge)
                    db1_GlobTrailEdgeOut = ListListToList(db2_GlobTrailEdge)
                    ln1_GlobDeviation1EdgeOut = ListListToList(ln2_GlobDeviation1Edge)
                    cl1_GlobDeviation1EdgeOut = ListListToList(cl2_GlobDeviation1Edge)
                    db1_GlobDeviation1EdgeOut = ListListToList(db2_GlobDeviation1Edge)
                    ln1_GlobDeviation2EdgeOut = ln1_Deviation2Edge
                    cl1_GlobDeviation2EdgeOut = cl1_Deviation2Edge
                    db1_GlobDeviation2EdgeOut = db1_Deviation2Edge
                    ln1_GlobDeviationEdgeOut = ln1_GlobDeviation1EdgeOut[:]
                    ln1_GlobDeviationEdgeOut.extend(ln1_GlobDeviation2EdgeOut)
                    str1_GlobDeviationEdgeOut = str1_Dev1EdgeID[:]
                    str1_GlobDeviationEdgeOut.extend(str1_Dev2EdgeID)
                    cl1_GlobDeviationEdgeOut = cl1_GlobDeviation1EdgeOut[:]
                    cl1_GlobDeviationEdgeOut.extend(cl1_GlobDeviation2EdgeOut)
                    db1_GlobDeviationEdgeOut = db1_GlobDeviation1EdgeOut[:]
                    db1_GlobDeviationEdgeOut.extend(db1_GlobDeviation2EdgeOut)
                    int1_DevEdgeInputSortID = int1_DevEdgeInputID[:]
                    if len(ln1_GlobDeviationEdgeOut) > 0:
                        str1_GlobDeviationEdgeOut, ln1_GlobDeviationEdgeOut, cl1_GlobDeviationEdgeOut, db1_GlobDeviationEdgeOut = (list(t) for t in zip(*sorted(zip(str1_GlobDeviationEdgeOut, ln1_GlobDeviationEdgeOut, cl1_GlobDeviationEdgeOut, db1_GlobDeviationEdgeOut))))
                        int1_DevEdgeInputSortID, ln1_GlobDeviationEdgeOut, str1_GlobDeviationEdgeOut, cl1_GlobDeviationEdgeOut, db1_GlobDeviationEdgeOut = (list(t) for t in zip(*sorted(zip(int1_DevEdgeInputSortID, ln1_GlobDeviationEdgeOut, str1_GlobDeviationEdgeOut, cl1_GlobDeviationEdgeOut, db1_GlobDeviationEdgeOut))))
                    ln1_GlobExtFOEdgeOut = ListListToList(ln2_GlobExtFOEdge)
                    cl1_GlobExtFOEdgeOut = ListListToList(cl2_GlobExtFOEdge)
                    db1_GlobExtFOEdgeOut = ListListToList(db2_GlobExtFOEdge)
                            
                            
                    M.ln1_GlobExtEdgeOut = ln1_GlobExtEdgeOut
                    M.pt1_GlobNodeOut = pt1_GlobNodeOut[:len(str1_NodeOrderC)]
                    M.ln1_GlobTrailEdgeOut = ln1_GlobTrailEdgeOut[:len(str1_TrailEdgeID)]
                    M.str1_GlobTrailEdgeOut = str1_TrailEdgeID
                    M.cl1_GlobTrailEdgeOut = cl1_GlobTrailEdgeOut[:len(str1_TrailEdgeID)]
                    M.db1_GlobTrailEdgeOut = db1_GlobTrailEdgeOut[:len(str1_TrailEdgeID)]
                    M.ln1_GlobDeviation1EdgeOut = ln1_GlobDeviation1EdgeOut
                    M.str1_GlobDeviation1EdgeOut = str1_Dev1EdgeID
                    M.cl1_GlobDeviation1EdgeOut = cl1_GlobDeviation1EdgeOut
                    M.db1_GlobDeviation1EdgeOut = db1_GlobDeviation1EdgeOut
                    M.ln1_GlobDeviation2EdgeOut = ln1_GlobDeviation2EdgeOut
                    M.str1_GlobDeviation2EdgeOut = str1_Dev2EdgeID
                    M.cl1_GlobDeviation2EdgeOut = cl1_GlobDeviation2EdgeOut
                    M.db1_GlobDeviation2EdgeOut = db1_GlobDeviation2EdgeOut
                    M.ln1_GlobDeviationEdgeOut = ln1_GlobDeviationEdgeOut
                    M.str1_GlobDeviationEdgeOut = str1_GlobDeviationEdgeOut
                    M.cl1_GlobDeviationEdgeOut = cl1_GlobDeviationEdgeOut
                    M.db1_GlobDeviationEdgeOut = db1_GlobDeviationEdgeOut
                    M.ln1_GlobExtFOEdgeOut = ln1_GlobExtFOEdgeOut
                    M.cl1_GlobExtFOEdgeOut = cl1_GlobExtFOEdgeOut
                    M.db1_GlobExtFOEdgeOut = db1_GlobExtFOEdgeOut
                            
                    M.str1_NodeOrderOut = str1_NodeOrderC
                    M.str1_EdgeOut = str1_Edge
                    M.str1_ExtFOEdge = str1_ExtFOEdge
                    M.str1_SupportAux = str1_SupportAux
        
        
        
    global int0_Counter
    int0_Counter = 0
            
    db0_Distance = 0.0
        
    if targetNode and targetNodeID:
        db0_DistanceGeometry = 0.0
        for i in range(0,len(targetNodeID)): 
            if str(targetNodeID[i]) in str1_NodeOrderC:
                int0_IndexGlobNode = int(str1_NodeOrderC.index(str(targetNodeID[i])))
                pt0_GlobNode = pt2_GlobNode[int0_IndexGlobNode // int0_TrailNumber - 1][int0_IndexGlobNode % int0_TrailNumber]
                targetNode0 = pt0_GlobNode
                if isinstance(targetNode[i], rh.Curve):
                    targetNode0 = targetNode[i].PointAt( targetNode[i].ClosestPoint(pt0_GlobNode)[1] )
                elif isinstance(targetNode[i], rh.Brep) or isinstance(targetNode[i], rh.BrepFace):
                    targetNode[i] = rs.coercesurface(targetNode[i])
                    targetNode0 = targetNode[i].PointAt( targetNode[i].ClosestPoint(pt0_GlobNode)[1], targetNode[i].ClosestPoint(pt0_GlobNode)[2] )
                elif isinstance(targetNode[i], rh.Point3d):
                    targetNode0 = targetNode[i]
                db0_DistanceGeometry += targetNodeCoeff[i]*pt0_GlobNode.DistanceToSquared(targetNode0)
        db0_Distance += db0_DistanceGeometry
        
    if targetVector and targetVectorID:
        db0_DistanceVectorDir = 0.0
        db0_DistanceVectorMag = 0.0
        for i in range(0,len(targetVectorID)):
            if str(targetVectorID[i]) in str1_NodeOrderC:
                int0_IndexGlobNode = int(str1_NodeOrderC.index(str(targetVectorID[i])))
                vc0_GlobVector = vc2_GlobTrailForce[int0_IndexGlobNode // int0_TrailNumber][int0_IndexGlobNode % int0_TrailNumber]
                targetVector0 = vc0_GlobVector
                if isinstance(targetVector[i], rh.Vector3d):
                    targetVector0 = targetVector[i]
                db0_DistanceVectorMag += targetVectorCoeffMag[i]*(vc0_GlobVector.Length - targetVector0.Length)**2
                vc0_GlobVectorU = rh.Vector3d(vc0_GlobVector)
                targetVector0U = rh.Vector3d(targetVector0)
                vc0_GlobVectorU.Unitize()
                targetVector0U.Unitize()
                db0_DistanceVectorDir += targetVectorCoeffDir[i]*((1- abs(rh.Vector3d.Multiply(vc0_GlobVectorU,targetVector0U)))**2)
        db0_Distance += db0_DistanceVectorMag + db0_DistanceVectorDir
        
    if len(str1_SupportAux) > 0:
        db0_DistanceVectorMag = 0.0
        for i in range(0,len(str1_SupportAux)):
            if str1_SupportAux[i] in str1_NodeOrderC:
                int0_IndexGlobNode = int(str1_NodeOrderC.index(str1_SupportAux[i]))
                vc0_GlobVector = vc2_GlobTrailForce[int0_IndexGlobNode // int0_TrailNumber][int0_IndexGlobNode % int0_TrailNumber]
                db0_DistanceVectorMag += 10*(vc0_GlobVector.Length)**2
        db0_Distance += db0_DistanceVectorMag
        
    # Calculate Absolute Total Load Path of the Structure
    db0_LoadPath = 0.0
    db0_PrevLoadPath = db0_GlobLoadPath
    for i in range(len(ln2_GlobTrailEdge)):
        for j in range(len(ln2_GlobTrailEdge[i])):
            db0_LoadPath += ln2_GlobTrailEdge[i][j].Length*abs(db2_GlobTrailEdge[i][j])
    for i in range(len(ln2_GlobDeviation1Edge)):
        for j in range(len(ln2_GlobDeviation1Edge[i])):
            db0_LoadPath += ln2_GlobDeviation1Edge[i][j].Length*abs(db2_GlobDeviation1Edge[i][j])
    for i in range(len(ln2_GlobDeviation2Edge)):
        for j in range(len(ln2_GlobDeviation2Edge[i])):
            db0_LoadPath += ln2_GlobDeviation2Edge[i][j].Length*abs(db2_GlobDeviation2Edge[i][j])
    db0_GlobLoadPath = int(db0_LoadPath*1E5)/1E5
            
    """
    # Calculate Total Load Path of the Structure
    for i in range(len(ln2_GlobExtFOEdge)):
        for j in range(len(ln2_GlobExtFOEdge[i])):
            pt0_ExtForce_B = ln2_GlobExtFOEdge[i][j].To
            pt0_ExtForce_A = ln2_GlobExtFOEdge[i][j].From
            vc0_ExtForce = rh.Vector3d(pt0_ExtForce_B - pt0_ExtForce_A)
            db0_LoadPath += rh.Vector3d.Multiply(vc0_ExtForce,-rh.Vector3d(pt0_ExtForce_A))
    db0_Distance = db0_LoadPath
    """
    if minLoadPath == True:
        db0_Distance += minLoadPathCoeff*db0_LoadPath
        
    if bl0_Print:
        str0_DescriptionOpt += "\nobjective: " + str(db0_Distance)
        str0_DescriptionOpt += "\n\n\n "
        print str0_DescriptionOpt
            
    str0_GlobDivergence = str(int( (db0_Distance - minLoadPathCoeff*db0_LoadPath) *1E5)/1E5)
            
    if db0_Distance < db0_DistanceBest:
        db0_DistanceBest = db0_Distance
        db1_VariableBest = db1_Variable
                
    return(db0_Distance)
        
pt2_Trails = []
        
        
M = model()
        
        
        
if TPC and hasattr(TPC,"db1_StructuralBehaviourOut"):
        
    vc2_GlobTrailForce = []
    ln2_GlobExtEdge = []
    pt2_GlobNode = []
    pt2_GlobNodeIteration = []
    ln2_GlobTrailEdge = []
    cl2_GlobTrailEdge = []
    db2_GlobTrailEdge = []
    ln2_GlobDeviation1Edge = []
    cl2_GlobDeviation1Edge = []
    db2_GlobDeviation1Edge = []
    ln2_GlobDeviation2Edge = []
    cl2_GlobDeviation2Edge = []
    db2_GlobDeviation2Edge = []
    ln2_GlobExtFOEdge = []
    cl2_GlobExtFOEdge = []
    db2_GlobExtFOEdge = []
            
            
    db1_StructuralBehaviour = TPC.db1_StructuralBehaviourOut
    str1_NodeOrderC = TPC.str1_NodeOrderOut
    xx1_Bracing = TPC.db1_DeviationIndirectOut
    pl1_ConstraintPlane = TPC.pl1_ConstraintPlaneOut
    id_NodePlane = TPC.int1_ConstraintPlaneOut
    pt1_OriginNode = TPC.pt1_OriginNodeOut
    dc2_ExtForce = TPC.dc2_ForceOut
    str1_Edge = TPC.str1_EdgeOut
            
    # Counters and Tolerance
    int0_Counter = 0
    db0_Divergence = float("inf")
    db0_Threshold = 1e-3
    int0_CounterBracing = 50
    db0_DistanceBest = float("inf")
    db1_VariableBest = []
        
    if len(xx1_Bracing) == 0: int0_CounterBracing = 1
        
    int0_TrailNumber = len(pt1_OriginNode)  # input nodes
    int0_C = 3+int0_TrailNumber+1
    int0_R = int(len(db1_StructuralBehaviour)/int0_C)
    db2_StructuralBehaviour = ListToListList(db1_StructuralBehaviour, int0_R, int0_C)
    int0_LayerCount = int(len(db2_StructuralBehaviour)/int0_TrailNumber) # amount of layers
            
            
    # Add labels external forces
            
    str1_ExtFOEdge = []
    int0_TrailAux = len(TPC.crv1_TrailAux)

    for i in range(len(str1_NodeOrder)):
        str1_ExtFOEdge.append("")
        
    str1_SupportAux = []
    for i in range(int0_TrailAux):
        str1_SupportAux.append( str(len(TPC.pt1_NodeOut) - int0_TrailAux +i) )
            
    if specWeight and yieldStress:
        for i in range(len(str1_NodeOrder)):
            if str1_NodeOrder[i][0] != "W" and str1_NodeOrder[i] not in str1_SupportAux:
                if len(str1_ExtFOEdge[i]) == 0:
                    str1_ExtFOEdge[i] = "G" + str1_NodeOrder[i]
                else:
                    str1_ExtFOEdge[i] = "G" + str1_NodeOrder[i] + "-" + str1_ExtFOEdge[i]

    str1_ExtFOReact = str1_ExtFOEdge[-int0_TrailNumber:]

            
    for i in range(len(str1_ExtFOReact)):
        if str1_ExtFOReact[i] == "":
            str1_ExtFOReactExt = str1_ExtFOEdge[-2*int0_TrailNumber:]
            str1_ExtFOReact[i] = str1_ExtFOReactExt[i]

    for i in range(len(str1_ExtFOReact)):
        str0_ExtFOReact = str1_ExtFOReact[i].split("-")[0]
        str0_ExtFOReact = str0_ExtFOReact.replace('G', 'R')
        str1_ExtFOReact[i] = str0_ExtFOReact

            
    for i in range( len(str1_NodeOrder)-int0_TrailNumber, len(str1_NodeOrder)):
        int0_NodeReact = i - (len(str1_NodeOrder)-int0_TrailNumber)
        if len(str1_ExtFOReact[ int0_NodeReact ]) == 0:
            int0_React = int(str1_NodeOrder[i]) - int0_TrailAux
            if "V" + str(int0_React) in TPC.str1_OriginNodeOut:
                str1_ExtFOReact[ int0_NodeReact ] = "R" + str(int0_React)
            else:
                str1_ExtFOReact[ int0_NodeReact ] = "R" + str1_NodeOrder[i]

    for key in dc2_ExtForce:
        i = int( str1_NodeOrder.index((dc2_ExtForce[key][3])) )
        if str1_ExtFOEdge[i] == "":  
            str1_ExtFOEdge[i] = "L" + key
        else:
            str1_ExtFOEdge[i] += "-" + "L" + key

    str1_ExtFOEdge.extend(str1_ExtFOReact)
            
        
            
    # Variables for Optimization
            
    # Deviation 1
    int2_Deviation1Edge = []
    db1_Deviation1Edge = []
    for g in range(int0_LayerCount):
        k = 3
        for i in range(g*int0_TrailNumber,(g+1)*int0_TrailNumber):
            k += 1
            for j in range(k,int0_TrailNumber+3):
                if db2_StructuralBehaviour[i][j] != 0:
                    int2_Deviation1Edge.append((i,j))
                    db1_Deviation1Edge.append(db2_StructuralBehaviour[i][j])
    # Trail
    int2_TrailEdge = []
    db1_TrailEdge = []
    for g in range(int0_LayerCount-1):
        for i in range(int0_TrailNumber):
            int2_TrailEdge.append([g*int0_TrailNumber + i,int0_TrailNumber+3]) 
            db1_TrailEdge.append(db2_StructuralBehaviour[g*int0_TrailNumber + i][int0_TrailNumber+3])
        
    # Deviation 2
    db1_Deviation2Edge = []
    for i in range(2,len(xx1_Bracing),3):
        db1_Deviation2Edge.append(xx1_Bracing[i])
        
    # Origin Nodes
    db1_OriginNodeX = [pt0_OriginNode.X for pt0_OriginNode in pt1_OriginNode]
    db1_OriginNodeY = [pt0_OriginNode.Y for pt0_OriginNode in pt1_OriginNode]
    db1_OriginNodeZ = [pt0_OriginNode.Z for pt0_OriginNode in pt1_OriginNode]
        
    # Loads
    str1_Load = []
    db1_LoadX = []
    db1_LoadY = []
    db1_LoadZ = []
    for key in dc2_ExtForce:
        str1_Load.append(key)
        db1_LoadX.append(dc2_ExtForce[key][0])
        db1_LoadY.append(dc2_ExtForce[key][1])
        db1_LoadZ.append(dc2_ExtForce[key][2])
        
        
    int0_CounterOpt = 0
    print "Iteration report\n\n "
        
    # Calculate gradient
    def Grad(var, grad):
        if grad:
            global db0_Dx
            fX_0 = Main(db1_StructuralBehaviour, str1_NodeOrderC, str1_Load, xx1_Bracing, pl1_ConstraintPlane, id_NodePlane, pt1_OriginNode, str1_Edge, db0_Divergence, db0_Threshold, int0_CounterBracing, int0_TrailNumber, int0_C, int0_R, db2_StructuralBehaviour, int0_LayerCount, var, False)
            for i in range(len(var)):
                varDx = var[:]
                varDx[i] += db0_Dx
                if db1_BoundUp[i] != db1_BoundLow[i]:
                    fX_1 = Main(db1_StructuralBehaviour, str1_NodeOrderC, str1_Load, xx1_Bracing, pl1_ConstraintPlane, id_NodePlane, pt1_OriginNode, str1_Edge, db0_Divergence, db0_Threshold, int0_CounterBracing, int0_TrailNumber, int0_C, int0_R, db2_StructuralBehaviour, int0_LayerCount, varDx, False)
                    dfX_1 = (fX_1 - fX_0) / db0_Dx
                else: dfX_1 = 0.0 
                grad[i] = dfX_1
        out = Main(db1_StructuralBehaviour, str1_NodeOrderC, str1_Load, xx1_Bracing, pl1_ConstraintPlane, id_NodePlane, pt1_OriginNode, str1_Edge, db0_Divergence, db0_Threshold, int0_CounterBracing, int0_TrailNumber, int0_C, int0_R, db2_StructuralBehaviour, int0_LayerCount, var, True)
        return out
        
    # Optimization function
    def Optimization(db1_InitialValues, db1_BoundUp, db1_BoundLow, db0_T, int0_I, nl0_Algo):
        solver = nl.NLoptSolver(nl0_Algo, len(db1_InitialValues), db0_T, int0_I)
        solver.SetLowerBounds(Array[float]( db1_BoundLow ))
        solver.SetUpperBounds(Array[float]( db1_BoundUp ))
        solver.SetMinObjective.Overloads[Func[Array[float], Array[float], float]](Grad)
        initialValue = Array[float](db1_InitialValues)
        out, finalScore = solver.Optimize(initialValue)
        return finalScore
            
    global str0_GlobSolver
    str0_GlobSolver = "None"
            
    if O and (hasattr(O, "targetNode") and hasattr(O, "targetNodeID") or hasattr(O, "targetVector") and hasattr(O, "targetVectorID") or hasattr(O, "minLoadPath") or len(str1_SupportAux) > 0 ):
        int1_T_ID = O.boundsTrailID
        db1_T_Up = O.boundsTrailUp
        db1_T_Low = O.boundsTrailLow
                
        int1_D_ID = O.boundsDevID
        db1_D_Up = O.boundsDevUp
        db1_D_Low = O.boundsDevLow
        
        int1_O_ID = O.boundsOriginNodeID
        db1_O_UpX = O.boundsOriginNodeUpX 
        db1_O_LowX = O.boundsOriginNodeLowX
        db1_O_UpY = O.boundsOriginNodeUpY
        db1_O_LowY = O.boundsOriginNodeLowY
        db1_O_UpZ = O.boundsOriginNodeUpZ
        db1_O_LowZ = O.boundsOriginNodeLowZ
        
        int1_L_ID = O.boundsLoadID
        db1_L_UpX = O.boundsLoadUpX 
        db1_L_LowX = O.boundsLoadLowX
        db1_L_UpY = O.boundsLoadUpY
        db1_L_LowY = O.boundsLoadLowY
        db1_L_UpZ = O.boundsLoadUpZ
        db1_L_LowZ = O.boundsLoadLowZ
        
        global db0_Dx
        db0_Dx = O.gradientDelta
        db0_T = O.relativeTolerance
        int0_I = O.maxIterations
        str0_A = O.optimAlgorithm
        str0_GlobSolver = str0_A
        
        dc1_Algo = {"LD_SLSQP" : nl.NLoptAlgorithm.LD_SLSQP,
                    "LN_BOBYQA" : nl.NLoptAlgorithm.LN_BOBYQA,
                    "GD_MLSL" : nl.NLoptAlgorithm.GD_MLSL,
                    "LD_LBFGS" : nl.NLoptAlgorithm.LD_LBFGS,
                    "LD_AUGLAG" : nl.NLoptAlgorithm.LD_AUGLAG,
                    "LN_SBPLX" : nl.NLoptAlgorithm.LN_SBPLX,
                    "LN_COBYLA" : nl.NLoptAlgorithm.LN_COBYLA,
                    "LD_TNEWTON" : nl.NLoptAlgorithm.LD_TNEWTON,
                    "GN_ISRES" : nl.NLoptAlgorithm.GN_ISRES,
                    "GN_MLSL" : nl.NLoptAlgorithm.GN_MLSL}
        
        
        db1_TrailBoundUp = db1_TrailEdge[:]
        for i in range(len(int1_T_ID)):
            if str(int1_T_ID[i]) in str1_TrailEdgeID: db1_TrailBoundUp[ str1_TrailEdgeID.index(str(int1_T_ID[i])) ] += db1_T_Up[i]
        
        db1_TrailBoundLow = db1_TrailEdge[:]
        for i in range(len(int1_T_ID)):
            if str(int1_T_ID[i]) in str1_TrailEdgeID: db1_TrailBoundLow[ str1_TrailEdgeID.index(str(int1_T_ID[i])) ] += db1_T_Low[i]
        
        
        db1_Deviation1BoundUp = db1_Deviation1Edge[:]
        for i in range(len(int1_D_ID)):
            if str(int1_D_ID[i]) in str1_Dev1EdgeID: db1_Deviation1BoundUp[ str1_Dev1EdgeID.index(str(int1_D_ID[i])) ] += db1_D_Up[i]
        
        db1_Deviation1BoundLow = db1_Deviation1Edge[:]
        for i in range(len(int1_D_ID)):
           if str(int1_D_ID[i]) in str1_Dev1EdgeID: db1_Deviation1BoundLow[ str1_Dev1EdgeID.index(str(int1_D_ID[i])) ] += db1_D_Low[i]
        
        db1_Deviation2BoundUp = db1_Deviation2Edge[:]
        for i in range(len(int1_D_ID)):
            if str(int1_D_ID[i]) in str1_Dev2EdgeID: db1_Deviation2BoundUp[ str1_Dev2EdgeID.index(str(int1_D_ID[i])) ] += db1_D_Up[i]
        
        db1_Deviation2BoundLow = db1_Deviation2Edge[:]
        for i in range(len(int1_D_ID)):
            if str(int1_D_ID[i]) in str1_Dev2EdgeID: db1_Deviation2BoundLow[ str1_Dev2EdgeID.index(str(int1_D_ID[i])) ] += db1_D_Low[i]
        
        
        str1_OriginNode = str1_NodeOrderC[:len(pt1_OriginNode)]
        for i in range(len(str1_OriginNode)):
            str1_OriginNode[i] = str1_OriginNode[i].replace("L","")
                
        db1_OriginNodeXBoundUp = db1_OriginNodeX[:]
        for i in range(len(int1_O_ID)):
            if str(int1_O_ID[i]) in str1_OriginNode: db1_OriginNodeXBoundUp[ str1_OriginNode.index(str(int1_O_ID[i])) ] += db1_O_UpX[i]
                
        db1_OriginNodeXBoundLow = db1_OriginNodeX[:]
        for i in range(len(int1_O_ID)):
            if str(int1_O_ID[i]) in str1_OriginNode: db1_OriginNodeXBoundLow[ str1_OriginNode.index(str(int1_O_ID[i])) ] += db1_O_LowX[i]
                
        db1_OriginNodeYBoundUp = db1_OriginNodeY[:]
        for i in range(len(int1_O_ID)):
            if str(int1_O_ID[i]) in str1_OriginNode: db1_OriginNodeYBoundUp[ str1_OriginNode.index(str(int1_O_ID[i])) ] += db1_O_UpY[i]
                
        db1_OriginNodeYBoundLow = db1_OriginNodeY[:]
        for i in range(len(int1_O_ID)):
            if str(int1_O_ID[i]) in str1_OriginNode: db1_OriginNodeYBoundLow[ str1_OriginNode.index(str(int1_O_ID[i])) ] += db1_O_LowY[i]
                
        db1_OriginNodeZBoundUp = db1_OriginNodeZ[:]
        for i in range(len(int1_O_ID)):
            if str(int1_O_ID[i]) in str1_OriginNode: db1_OriginNodeZBoundUp[ str1_OriginNode.index(str(int1_O_ID[i])) ] += db1_O_UpZ[i]
                
        db1_OriginNodeZBoundLow = db1_OriginNodeZ[:]
        for i in range(len(int1_O_ID)):
            if str(int1_O_ID[i]) in str1_OriginNode: db1_OriginNodeZBoundLow[ str1_OriginNode.index(str(int1_O_ID[i])) ] += db1_O_LowZ[i]
        
        
        db1_LoadXBoundUp = db1_LoadX[:]
        for i in range(len(int1_L_ID)):
            if str(int1_L_ID[i]) in str1_Load: db1_LoadXBoundUp[ str1_Load.index( str(int1_L_ID[i])) ] += db1_L_UpX[i]
                
        db1_LoadXBoundLow = db1_LoadX[:]
        for i in range(len(int1_L_ID)):
            if str(int1_L_ID[i]) in str1_Load: db1_LoadXBoundLow[ str1_Load.index( str(int1_L_ID[i])) ] += db1_L_LowX[i]
                
        db1_LoadYBoundUp = db1_LoadY[:]
        for i in range(len(int1_L_ID)):
            if str(int1_L_ID[i]) in str1_Load: db1_LoadYBoundUp[ str1_Load.index( str(int1_L_ID[i])) ] += db1_L_UpY[i]
                
        db1_LoadYBoundLow = db1_LoadY[:]
        for i in range(len(int1_L_ID)):
            if str(int1_L_ID[i]) in str1_Load: db1_LoadYBoundLow[ str1_Load.index( str(int1_L_ID[i])) ] += db1_L_LowY[i]
                
        db1_LoadZBoundUp = db1_LoadZ[:]
        for i in range(len(int1_L_ID)):
            if str(int1_L_ID[i]) in str1_Load: db1_LoadZBoundUp[ str1_Load.index( str(int1_L_ID[i])) ] += db1_L_UpZ[i]
                
        db1_LoadZBoundLow = db1_LoadZ[:]
        for i in range(len(int1_L_ID)):
            if str(int1_L_ID[i]) in str1_Load: db1_LoadZBoundLow[ str1_Load.index( str(int1_L_ID[i])) ] += db1_L_LowZ[i]
        
        
        # Define Initial Values for Optimization
        db1_InitialValues = []
        db1_InitialValues = db1_Deviation1Edge[:]
        db1_InitialValues.extend(db1_TrailEdge[:])
        db1_InitialValues.extend(db1_Deviation2Edge[:])
        db1_InitialValues.extend(db1_OriginNodeX[:])
        db1_InitialValues.extend(db1_OriginNodeY[:])
        db1_InitialValues.extend(db1_OriginNodeZ[:])
        db1_InitialValues.extend(db1_LoadX[:])
        db1_InitialValues.extend(db1_LoadY[:])
        db1_InitialValues.extend(db1_LoadZ[:])
                
        # Define Bounds for Optimization
        db1_BoundUp = []
        db1_BoundUp = db1_Deviation1BoundUp[:]
        db1_BoundUp.extend(db1_TrailBoundUp[:])
        db1_BoundUp.extend(db1_Deviation2BoundUp[:])
        db1_BoundUp.extend(db1_OriginNodeXBoundUp[:])
        db1_BoundUp.extend(db1_OriginNodeYBoundUp[:])
        db1_BoundUp.extend(db1_OriginNodeZBoundUp[:])
        db1_BoundUp.extend(db1_LoadXBoundUp[:])
        db1_BoundUp.extend(db1_LoadYBoundUp[:])
        db1_BoundUp.extend(db1_LoadZBoundUp[:])
        db1_BoundLow = []
        db1_BoundLow = db1_Deviation1BoundLow[:]
        db1_BoundLow.extend(db1_TrailBoundLow[:])
        db1_BoundLow.extend(db1_Deviation2BoundLow[:])
        db1_BoundLow.extend(db1_OriginNodeXBoundLow[:])
        db1_BoundLow.extend(db1_OriginNodeYBoundLow[:])
        db1_BoundLow.extend(db1_OriginNodeZBoundLow[:])
        db1_BoundLow.extend(db1_LoadXBoundLow[:])
        db1_BoundLow.extend(db1_LoadYBoundLow[:])
        db1_BoundLow.extend(db1_LoadZBoundLow[:])
        
        Optimization(db1_InitialValues, db1_BoundUp, db1_BoundLow, db0_T, int0_I, dc1_Algo[str0_A])
                
        Main(db1_StructuralBehaviour, str1_NodeOrderC, str1_Load, xx1_Bracing, pl1_ConstraintPlane, id_NodePlane, pt1_OriginNode, str1_Edge, db0_Divergence, db0_Threshold, int0_CounterBracing, int0_TrailNumber, int0_C, int0_R, db2_StructuralBehaviour, int0_LayerCount, db1_VariableBest, True)
    else:
        Main(db1_StructuralBehaviour, str1_NodeOrderC, str1_Load, xx1_Bracing, pl1_ConstraintPlane, id_NodePlane, pt1_OriginNode, str1_Edge, db0_Divergence, db0_Threshold, int0_CounterBracing, int0_TrailNumber, int0_C, int0_R, db2_StructuralBehaviour, int0_LayerCount, [], True)
# ---------- end cem_calculate_structure_2_0 ----------

panel_2 = Panel(cem_calculate_structure_2_0)
cem_extract_structure_2_0 = PythonScript(M=cem_calculate_structure_2_0)  # -> nodes, nodesID, trails, trailsID, trailsCol, trailsMag, deviations, deviationsID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
# ---------- cem_extract_structure_2_0: Python ----------
"""
Retrieves automatically the data in the structural model
    Inputs:
        M: (structural model) The calculated structural model (empty on error)
    Outputs:
        nodes: (point3D) The nodes of the structural model
        nodesID: (string) The IDs of the nodes
        trails: (line) The trail edges of the structural model
        trailsID: (string) The IDs of the trail edges
        trailsCol: (color) The colors of the trail edges
        trailsMag: (double) The magnitudes of the forces in the trail edges
        deviationDirect: (line) The direct deviation edges of the structural model
        deviationsDirectID: (string) The IDs of the direct deviation edges
        deviationDirectCol: (color) The colors of the direct deviation edges
        deviationDirectMag: (double) The magnitudes of the forces in the direct deviation edges
        deviationIndirect: (line) The indirect deviation edges of the structural model
        deviationsIndirectID: (string) The IDs of the indirect deviation edges
        deviationIndirectCol: (color) The colors of the indirect deviation edges
        deviationIndirectMag: (double) The magnitudes of the forces in the indirect deviation edges
        externalForces: (line) The external forces of the structural model
        externalForcesCol: (color) The colors of the external forces 
        externalForcesMag: (double) The magnitudes of the forces in the external forces 
    Remarks:
        This extract the data within the structural diagram
"""


__author__    = ['Patrick Ole Ohlbrock','Pierluigi D''Acunto' ]
__copyright__ = 'Copyright 2021 - ETH Zurich and Technical University of Munich'
__license__   = 'MIT License'
__email__     = ['ohlbrock@arch.ethz.ch','pierluigi.dacunto@tum.de']
__version__   = "2.00"

"""
If you use the CEM library in a project, please refer to the GitHub repository: 

@Misc{cem2021,
author = {Ohlbrock, Patrick Ole and D'Acunto, Pierluigi},
title = {{CEM: Combinatorial Equilibrium Modeling}},
year = {2021},
note = {Release 2.00},
url = { http://github.com/OleOhlbrock/CEM },
}

"""


if M and hasattr(M, "pt1_GlobNodeOut") and hasattr(M, "str1_NodeOrderOut") and hasattr(M, "ln1_GlobTrailEdgeOut") and hasattr(M, "cl1_GlobTrailEdgeOut") and hasattr(M, "db1_GlobTrailEdgeOut") and hasattr(M, "ln1_GlobDeviation1EdgeOut") and hasattr(M, "cl1_GlobDeviation1EdgeOut") and hasattr(M, "db1_GlobDeviation1EdgeOut") and hasattr(M, "ln1_GlobDeviation2EdgeOut") and hasattr(M, "cl1_GlobDeviation2EdgeOut") and hasattr(M, "db1_GlobDeviation2EdgeOut") and hasattr(M, "ln1_GlobExtFOEdgeOut") and hasattr(M, "cl1_GlobExtFOEdgeOut") and hasattr(M, "db1_GlobExtFOEdgeOut") and hasattr(M, "str1_SupportAux"):

    nodes_C = []
    nodesID_C = []
    for i in range(len(M.pt1_GlobNodeOut)):
        if M.str1_NodeOrderOut[i][0] != "L" and M.str1_NodeOrderOut[i][0] != "W" and M.str1_NodeOrderOut[i] not in M.str1_SupportAux:
            nodes_C.append(M.pt1_GlobNodeOut[i])
            nodesID_C.append("V" + M.str1_NodeOrderOut[i])
        nodes = nodes_C
        nodesID = nodesID_C

    trails_C = []
    trailsID_C = []
    trailsCol_C = []
    trailsMag_C = []
    for i in range(len(M.ln1_GlobTrailEdgeOut)):
        if M.str1_GlobTrailEdgeOut[i][0] != "E" and M.ln1_GlobTrailEdgeOut[i].Length != 0.0:
            trails_C.append(M.ln1_GlobTrailEdgeOut[i])
            trailsID_C.append("T" + M.str1_GlobTrailEdgeOut[i])
            trailsCol_C.append(M.cl1_GlobTrailEdgeOut[i])
            trailsMag_C.append(M.db1_GlobTrailEdgeOut[i])
        trails = trails_C
        trailsID = trailsID_C
        trailsCol = trailsCol_C
        trailsMag = trailsMag_C
    
    deviationsDirect = M.ln1_GlobDeviation1EdgeOut
    deviationsDirectID = M.str1_GlobDeviation1EdgeOut
    deviationsDirectCol = M.cl1_GlobDeviation1EdgeOut
    deviationsDirectMag = M.db1_GlobDeviation1EdgeOut
    deviationsIndirect = M.ln1_GlobDeviation2EdgeOut
    deviationsIndirectID = M.str1_GlobDeviation2EdgeOut
    deviationsIndirectCol = M.cl1_GlobDeviation2EdgeOut
    deviationsIndirectMag = M.db1_GlobDeviation2EdgeOut
    deviations = M.ln1_GlobDeviationEdgeOut
    deviationsID = ["D" + devID for devID in M.str1_GlobDeviationEdgeOut]
    deviationsCol = M.cl1_GlobDeviationEdgeOut
    deviationsMag = M.db1_GlobDeviationEdgeOut
    externalForces = M.ln1_GlobExtFOEdgeOut
    externalForcesID = M.str1_ExtFOEdge
    externalForcesCol = M.cl1_GlobExtFOEdgeOut
    externalForcesMag = M.db1_GlobExtFOEdgeOut
# ---------- end cem_extract_structure_2_0 ----------
midpt = CurveMiddle(Curve=cem_extract_structure_2_0.externalForces)
tag = TextTag3D(
    Location=cem_extract_structure_2_0.nodes,
    Text=cem_extract_structure_2_0.nodesID,
    Size=0.25,
    Colour=RGB(0, 0, 0),
    Justification=7)
preview = CustomPreview(
    Geometry=[cem_extract_structure_2_0.trails, cem_extract_structure_2_0.externalForces, cem_extract_structure_2_0.deviations],
    Material=[cem_extract_structure_2_0.trailsCol, cem_extract_structure_2_0.externalForcesCol, cem_extract_structure_2_0.deviationsCol])
tag_2 = TextTag3D(Location=midpt, Text=cem_extract_structure_2_0.externalForcesID, Size=0.1, Colour=RGB(0, 0, 0), Justification=7)
