# Grasshopper definition CEM_2.00_R7_GHPlugin.ghx (Grasshopper 1.0.7)
# plug-ins: CEM_Build_Topology_2.0, CEM_Deviation_2.0, CEM_Support_2.0, CEM_Load_2.0, CEM_Trail_2.0, CEM_Extract_Topology_2.0, CEM_Constraint_Plane_2.0, CEM_Origin_Node_2.0, CEM_Material_Properties_2.0, CEM_Target_Node_2.0, CEM_Target_Vector_2.0, CEM_Bound_Trail_2.0, CEM_Bound_Deviation_2.0, CEM_Bound_Origin_Node_2.0, CEM_Bound_Load_2.0, CEM_Extract_Structure_2.0, CEM_Min_Load_Path_2.0, CEM_Optimization_Setup_2.0, CEM_Calculate_Structure_2.0

# ---- group: CEM_Build_Topology
# CEM - Release 2.00
# If you use the library of CEM in a project, please refer to the CEM GitHub repository:
# 
# @Misc{cem2021,
# author = {Ohlbrock, Patrick Ole and D'Acunto, Pierluigi},
# title = {{CEM: Combinatorial Equilibrium Modeling}},
# year = {2021},
# note = {Release 2.00},
# url = { http://github.com/OleOhlbrock/CEM },
# }
trailedge = Curve(flatten([<curve referenced from the Rhino model> x12]))
pointload = Point(flatten([<point referenced from the Rhino model> x4]))
deviationedge = Curve(flatten([<curve referenced from the Rhino model> x16]))
support = Point(flatten([<point referenced from the Rhino model> x4]))
cem_deviation_2_0 = CEM_Deviation_20(DeviationEdge=deviationedge, DeviationMagn=Slider(-2, range=-20..10))
cem_load_2_0 = CEM_Load_20(
    PointLoad=pointload,
    LoadMagnX=Slider(0, range=-10..10),
    LoadMagnY=Slider(0, range=-10..10),
    LoadMagnZ=Slider(-3, range=-10..10))
cem_trail_2_0 = CEM_Trail_20(TrailEdge=trailedge, TrailLen=Slider(-3, range=-10..10))
cem_support_2_0 = CEM_Support_20(Support=support)
cem_build_topology_2_0 = CEM_Build_Topology_20(T=cem_trail_2_0, L=cem_load_2_0, D=cem_deviation_2_0, S=cem_support_2_0)

# ----
panel = Panel(cem_build_topology_2_0)
cem_extract_topology_2_0 = CEM_Extract_Topology_20(TP=cem_build_topology_2_0)  # -> Nodes, NodesID, Trails, TrailsID, Deviations, DeviationsID, AuxTrails, AuxTrailsID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

targetnode = Panel("""V15
V13
V12
V14""")
series = Series(Start=0, Step=1, Count=11)
series_2 = Series(Start=12, Step=1, Count=16)
self_weight = BooleanToggle(False)
list = ValueList({"LD_AUGLAG", "LD_LBFGS", "LD_SLSQP", "LD_TNEWTON", "LN_BOBYQA", "LN_COBYLA", "LN_SBPLX", "GD_MLSL", "GN_MLSL", "GN_ISRES"}, selected="LD_LBFGS")
originnodes = Point([<point referenced from the Rhino model> x4])
targetnodes = Point([<point referenced from the Rhino model> x4])
targetvector = Vector()
targetvectorcoeffdir = Slider(0, range=0..10000)
boundscoefficientoriginnode = Slider(0.2, range=0..1000)
number_slider = Slider(0, range=0..5000)
bounddevid = Integer(series_2)
number_slider_2 = Slider(10, range=0..5000)
yieldstress_kn_m2 = Slider(500000, range=50..1000000)
specific_weight_kn_m3 = Slider(73.5, range=5..500)
targetvectorid = Integer()
targetvectorcoeffmag = Slider(0, range=0..10000)
boundscoefficientoriginnode_2 = Slider(0, range=0..1000)
number_slider_3 = Slider(0, range=0..5000)
boundtrailid = Integer(series)
minloadpathcoeff = Slider(0.08, range=0..1000)
concat = Concatenate(FragmentA="T", FragmentB=boundtrailid)
concat_2 = Concatenate(FragmentA="D", FragmentB=bounddevid)
cem_bound_origin_node_2_0 = CEM_Bound_Origin_Node_20(
    BoundOriginNodeID=cem_extract_topology_2_0.OriginNodeID,
    BoundUpOriginNodeX=boundscoefficientoriginnode,
    BoundLowOriginNodeX=boundscoefficientoriginnode,
    BoundUpOriginNodeY=boundscoefficientoriginnode,
    BoundLowOriginNodeY=boundscoefficientoriginnode,
    BoundUpOriginNodeZ=boundscoefficientoriginnode_2,
    BoundLowOriginNodeZ=boundscoefficientoriginnode_2)
cem_target_vector_2_0 = CEM_Target_Vector_20(
    TargetVector=targetvector,
    TargetVectorID=targetvectorid,
    TargetVectorCoeffMag=targetvectorcoeffmag,
    TargetVectorCoeffDir=targetvectorcoeffdir)
cem_constraint_plane_2_0 = CEM_Constraint_Plane_20(ConstraintPlane=cem_extract_topology_2_0.ConstraintPlane, ConstraintPlaneID=cem_extract_topology_2_0.ConstraintPlaneID)
cem_min_load_path_2_0 = CEM_Min_Load_Path_20(MinLoadPath=Toggle(True), MinLoadPathCoeff=minloadpathcoeff)
cem_target_node_2_0 = CEM_Target_Node_20(TargetNode=targetnodes, TargetNodeID=targetnode, TargetNodeCoeff=Slider(1, range=0..10000))
cem_bound_load_2_0 = CEM_Bound_Load_20(
    BoundLoadID=cem_extract_topology_2_0.LoadsID,
    BoundUpLoadX=number_slider_3,
    BoundLowLoadX=number_slider_3,
    BoundUpLoadY=number_slider_3,
    BoundLowLoadY=number_slider_3,
    BoundUpLoadZ=number_slider,
    BoundLowLoadZ=number_slider)
cem_bound_trail_2_0 = CEM_Bound_Trail_20(BoundTrailID=concat, BoundUpTrail=Slider(10, range=0..5000), BoundLowTrail=Slider(10, range=0..5000))
cem_bound_deviation_2_0 = CEM_Bound_Deviation_20(BoundDevID=concat_2, BoundUpDev=number_slider_2, BoundLowDev=number_slider_2)
cem_origin_node_2_0 = CEM_Origin_Node_20(OriginNode=originnodes, OriginNodeID=cem_extract_topology_2_0.OriginNodeID)
cem_material_properties_2_0 = CEM_Material_Properties_20(SelfWeight=self_weight, YieldStress=yieldstress_kn_m2, SpecWeight=specific_weight_kn_m3)
cem_optimization_setup_2_0 = CEM_Optimization_Setup_20(
    TN=cem_target_node_2_0,
    TV=cem_target_vector_2_0,
    LP=cem_min_load_path_2_0,
    BO=cem_bound_origin_node_2_0,
    BL=cem_bound_load_2_0,
    BT=cem_bound_trail_2_0,
    BD=cem_bound_deviation_2_0,
    GradientDelta=Slider(0.0001, range=0.0001..1),
    RelativeTolerance=Slider(1e-06, range=1e-06..1),
    MaxIterations=Slider(30, range=1..1000),
    OptimAlgorithm=list)
cem_calculate_structure_2_0 = CEM_Calculate_Structure_20(
    MarshallingSignalParameter=cem_build_topology_2_0,
    CPL=cem_constraint_plane_2_0,
    N=cem_origin_node_2_0,
    SW=cem_material_properties_2_0,
    O=cem_optimization_setup_2_0)

panel_2 = Panel(cem_calculate_structure_2_0)
cem_extract_structure_2_0 = CEM_Extract_Structure_20(M=cem_calculate_structure_2_0)  # -> Nodes, NodesID, Trails, TrailsID, TrailsCol, TrailsMag, Deviations, DeviationsID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
midpt = CurveMiddle(Curve=cem_extract_structure_2_0.ExternalForces)
preview = CustomPreview(
    Geometry=[cem_extract_structure_2_0.Trails, cem_extract_structure_2_0.ExternalForces, cem_extract_structure_2_0.Deviations],
    Material=[cem_extract_structure_2_0.TrailsCol, cem_extract_structure_2_0.ExternalForcesCol, cem_extract_structure_2_0.DeviationsCol])
tag = TextTag3D(
    Location=cem_extract_structure_2_0.Nodes,
    Text=cem_extract_structure_2_0.NodesID,
    Size=0.25,
    Colour=RGB(0, 0, 0),
    Justification=7)
tag_2 = TextTag3D(Location=midpt, Text=cem_extract_structure_2_0.ExternalForcesID, Size=0.1, Colour=RGB(0, 0, 0), Justification=7)
