# Grasshopper definition Stadium Definition_Radial.ghx (Grasshopper 1.0.7)

amount_betweeen_first_and_last_layers = Slider(5, range=1..10)
projectedlengthtrails = Slider(80, range=0..100)
amount_of_sectors = Slider(32, range=4..100)
move_originnodes_along_curve = Slider(0, range=0..1)
main_curve = Curve(<curve referenced from the Rhino model>)

amplitude_planes = Slider(0, range=-10..5)

frequence = Slider(2, range=0..6)
amplitude_origin_nodes = Slider(0, range=-10..5)
shift_of_peak = Slider(0, range=0..16)

frequence_2 = Slider(2, range=0..6)
frequence_3 = Slider(2, range=0..6)

localalpha_trail2 = Slider(120, range=1..180)
distance_t1_t2 = Slider(4, range=0..40)
localteta_trail2 = Slider(10, range=0..180)

localalpha_trail4 = Slider(1, range=1..179)
localteta_trail4 = Slider(1, range=1..179)
distance_t1_t4 = Slider(1, range=0..20)

shift_of_peak_2 = Slider(48, range=0..64)
cluster = Cluster_3(
    main_curve=main_curve,
    A=amplitude_planes,
    freq_2=frequence_2,
    num_2=projectedlengthtrails,
    int=amount_of_sectors,
    num=move_originnodes_along_curve,
    freq=frequence_3,
    S=shift_of_peak_2,
    int_3=amount_betweeen_first_and_last_layers,
    int_2=frequence,
    db0_originnodeampliz=amplitude_origin_nodes,
    int0_shiftpeak=shift_of_peak,
    localalpha_trail2=localalpha_trail2,
    localteta_trail2=localteta_trail2,
    distance_t1_t2=distance_t1_t2,
    distance_t1_t3=distance_t1_t2,
    localalpha_trail4=localalpha_trail4,
    localteta_trail4=localteta_trail4,
    distance_t1_t4=distance_t1_t4)  # -> int_10, line_23, line_24, line_25, line_26, line_27, line_28, line_29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

t1_m = Slider(-10, range=-10..10)
t1_end = Slider(-10, range=-10..10)
t1_m_2 = Slider(-20, range=-40..10)
t2 = Line(cluster.line_24)
t2_start = Slider(0, range=-10..10)
t3 = Line(cluster.line_25)
t3_m = Slider(0, range=-10..10)
t3_end = Slider(0, range=-10..10)
t4 = Line(cluster.line_26)
t4_m = Slider(0, range=-10..10)
t4_end = Slider(0, range=-10..10)
t1 = Line(cluster.line_23)
t1_start = Slider(-10, range=-10..10)
t2_m = Slider(0, range=-10..10)
t2_end = Slider(0, range=-10..10)
t3_start = Slider(0, range=-10..10)
t4_start = Slider(0, range=-10..10)
cluster_2 = Cluster_2(lines=t1, num_3=t1_m_2, num_2=t1_m_2, num=t1_m_2)  # -> lines_3, attributes
cluster_3 = Cluster_2(lines=t2, num_3=t2_start, num_2=t2_m, num=t2_end)  # -> lines_3, attributes
cluster_4 = Cluster_2(lines=t3, num_3=t3_start, num_2=t3_m, num=t3_end)  # -> lines_3, attributes
cluster_5 = Cluster_2(lines=t4, num_3=t4_start, num_2=t4_m, num=t4_end)  # -> lines_3, attributes
num = Number(cluster_3.attributes)
line = Line(cluster_4.lines_3)
line_2 = Line(cluster_5.lines_3)
line_3 = Line(cluster_2.lines_3)
num_2 = Number(cluster_2.attributes)
line_4 = Line(cluster_3.lines_3)
num_3 = Number(cluster_4.attributes)
num_4 = Number(cluster_5.attributes)
merge = Merge(Data1=num_2, Data2=num, Data3=num_3, Data4=num_4)
merge_2 = Merge(Data1=line_3, Data2=line_4, Data3=line, Data4=line_2)
num_5 = Number(merge)
line_5 = Line(merge_2)

load_x = Slider(0, range=-2..10)
load_x_2 = Slider(0, range=0..1)
load_x_3 = Slider(0, range=-100..100.001)
end = EndPoints(Curve=line_3)  # -> Start, End
division = Division(A=load_x_3, B=cluster.int_10)
external_forces = Concatenate(FragmentA=load_x, FragmentB=",", FragmentC=load_x_2, FragmentD=",", FragmentE=division)
line_6 = LineSDL(Start=end.End, Direction=Vector(0, 0, 1), Length=1)
panel = Panel(external_forces)
lng = ListLength(List=line_6)
dup = DuplicateData(Data=panel, Number=lng, Order=True)
line_7 = Line(line_6)
txt = Text(dup)

dev_t1_end = Slider(10, range=-10..20)
dev_t1_start = Slider(-20, range=-20..10)
dev_t1_m = Slider(0.5, range=-10..10)
dev_t1 = Line(cluster.line_27)
dev_t2 = Line(cluster.line_28)
dev_t2_start = Slider(0, range=-10..10)
dev_t2_m = Slider(0, range=-10..10)
dev_t2_end = Slider(0, range=-10..10)
dev_t3 = Line(cluster.line_29)
dev_t3_start = Slider(0, range=-10..10)
dev_t3_m = Slider(0, range=-10..10)
dev_t3_end = Slider(0, range=-10..10)
dev_t4 = Line(cluster.line_30)
dev_t4_start = Slider(0, range=-10..10)
dev_t4_m = Slider(0, range=-10..10)
dev_t4_end = Slider(0, range=-10..10)
cluster_6 = Cluster(line=dev_t1, num_3=dev_t1_start, num_2=dev_t1_m, num=dev_t1_end)  # -> lines, attributes
cluster_7 = Cluster(line=dev_t2, num_3=dev_t2_start, num_2=dev_t2_m, num=dev_t2_end)  # -> lines, attributes
cluster_8 = Cluster(line=dev_t3, num_3=dev_t3_start, num_2=dev_t3_m, num=dev_t3_end)  # -> lines, attributes
cluster_9 = Cluster(line=dev_t4, num_3=dev_t4_start, num_2=dev_t4_m, num=dev_t4_end)  # -> lines, attributes
line_8 = Line(cluster_7.lines)
num_6 = Number(cluster_7.attributes)
num_7 = Number(cluster_8.attributes)
num_8 = Number(cluster_9.attributes)
line_9 = Line(cluster_6.lines)
num_9 = Number(cluster_6.attributes)
line_10 = Line(cluster_8.lines)
line_11 = Line(cluster_9.lines)
merge_3 = Merge(Data1=line_9, Data2=line_8, Data3=line_10, Data4=line_11)
merge_4 = Merge(Data1=num_9, Data2=num_6, Data3=num_7, Data4=num_8)
multiplication = Multiplication(A=merge_4, B=cluster.int_11)

dev_t12 = Line(cluster.line_31)
dev_t12_start = Slider(1, range=-10..10)
dev_t12_m = Slider(-0.5, range=-10..10)
dev_t12_end = Slider(-4.424, range=-10..10)
dev_t13 = Line(cluster.line_32)
dev_t13_start = Slider(1, range=-10..10)
dev_t13_m = Slider(-0.2, range=-10..10)
dev_t13_end = Slider(-2, range=-10..10)
dev_t23 = Line(cluster.line_33)
dev_t23_start = Slider(0, range=-10..10)
dev_t23_m = Slider(0, range=-10..10)
dev_t23_end = Slider(0, range=-10..10)
dev_t34 = Line(cluster.line_34)
dev_t34_start = Slider(0, range=-10..10)
dev_t34_m = Slider(0, range=-10..10)
dev_t34_end = Slider(0, range=-10..10)
dev_t24 = Line(cluster.line_35)
dev_t24_start = Slider(0, range=-10..10)
dev_t24_m = Slider(0, range=-10..10)
dev_t24_end = Slider(0, range=-10..10)
dev_t14 = Line(cluster.line_36)
dev_t14_start = Slider(0, range=-10..10)
dev_t14_m = Slider(0, range=-10..10)
dev_t14_end = Slider(0, range=-10..10)
cluster_10 = Cluster(line=dev_t12, num_3=dev_t12_start, num_2=dev_t12_m, num=dev_t12_end)  # -> lines, attributes
cluster_11 = Cluster(line=dev_t13, num_3=dev_t13_start, num_2=dev_t13_m, num=dev_t13_end)  # -> lines, attributes
cluster_12 = Cluster(line=dev_t23, num_3=dev_t23_start, num_2=dev_t23_m, num=dev_t23_end)  # -> lines, attributes
cluster_13 = Cluster(line=dev_t34, num_3=dev_t34_start, num_2=dev_t34_m, num=dev_t34_end)  # -> lines, attributes
cluster_14 = Cluster(line=dev_t24, num_3=dev_t24_start, num_2=dev_t24_m, num=dev_t24_end)  # -> lines, attributes
cluster_15 = Cluster(line=dev_t14, num_3=dev_t14_start, num_2=dev_t14_m, num=dev_t14_end)  # -> lines, attributes
line_12 = Line(cluster_10.lines)
line_13 = Line(cluster_12.lines)
num_10 = Number(cluster_12.attributes)
line_14 = Line(cluster_14.lines)
num_11 = Number(cluster_15.attributes)
num_12 = Number(cluster_10.attributes)
line_15 = Line(cluster_11.lines)
num_13 = Number(cluster_11.attributes)
line_16 = Line(cluster_13.lines)
num_14 = Number(cluster_13.attributes)
num_15 = Number(cluster_14.attributes)
line_17 = Line(cluster_15.lines)

txt_2 = Text(flatten(num_5))
trails = Curve(flatten(line_5))
external_force = Curve(flatten(line_7))
txt_3 = Text(flatten(division))
pt_groundlevel = Point(<point referenced from the Rhino model>)
X = UnitX(Factor=Slider(0, range=0..100))

dev_t23_ring = Line(cluster.line_37)
dev_t23_ring_start = Slider(0, range=-10..10)
dev_t23_ring_m = Slider(-0.885, range=-10..10)
dev_t23_ring_end = Slider(0, range=-10..10)
dev_t12_diag = Line(cluster.line_38)
dev_t12_diag_start = Slider(0, range=-10..10)
dev_t12_diag_m = Slider(0, range=-10..10)
dev_t12_diag_end = Slider(0, range=-10..10)
dev_t13_diag = Line(cluster.line_39)
dev_t13_diag_start = Slider(0, range=-10..10)
dev_t13_diag_m = Slider(0, range=-10..10)
dev_t13_diag_end = Slider(0, range=-10..10)
dev_t11_diag = Line(cluster.line_40)
dev_t13_diag_start_2 = Slider(0, range=-10..10)
dev_t13_diag_m_2 = Slider(0, range=-10..10)
dev_t13_diag_end_2 = Slider(0, range=-10..10)
cluster_16 = Cluster(line=dev_t23_ring, num_3=dev_t23_ring_start, num_2=dev_t23_ring_m, num=dev_t23_ring_end)  # -> lines, attributes
cluster_17 = Cluster(line=dev_t12_diag, num_3=dev_t12_diag_start, num_2=dev_t12_diag_m, num=dev_t12_diag_end)  # -> lines, attributes
cluster_18 = Cluster(line=dev_t13_diag, num_3=dev_t13_diag_start, num_2=dev_t13_diag_m, num=dev_t13_diag_end)  # -> lines, attributes
cluster_19 = Cluster(line=dev_t11_diag, num_3=dev_t13_diag_start_2, num_2=dev_t13_diag_m_2, num=dev_t13_diag_end_2)  # -> lines, attributes
line_18 = Line(cluster_19.lines)
line_19 = Line(cluster_16.lines)
line_20 = Line(cluster_17.lines)
num_16 = Number(cluster_17.attributes)
line_21 = Line(cluster_18.lines)
num_17 = Number(cluster_18.attributes)
num_18 = Number(cluster_19.attributes)

division_2 = Division(A=cluster_16.attributes, B=cluster.int_12)

num_19 = Number(division_2)

merge_5 = Merge(
    Data1=multiplication,
    Data2=num_12,
    Data3=num_13,
    Data4=num_10,
    Data5=num_14,
    Data6=num_15,
    Data7=num_11,
    Data8=num_19,
    Data9=num_16,
    Data10=num_17,
    Data11=num_18)
merge_6 = Merge(
    Data1=merge_3,
    Data2=line_12,
    Data3=line_15,
    Data4=line_13,
    Data5=line_16,
    Data6=line_14,
    Data7=line_17,
    Data8=line_19,
    Data9=line_20,
    Data10=line_21,
    Data11=line_18)
num_20 = Number(merge_5)
line_22 = Line(merge_6)
txt_4 = Text(flatten(num_20))
deviation = Curve(flatten(line_22))

# ---- group: Topology Generation
number_slider = Slider(-1, range=-20..10)
deviation_2 = Curve(flatten(deviation))
external_force_2 = Curve(flatten(external_force))
trails_2 = Curve(flatten(trails))
number_slider_2 = Slider(-3, range=-10..10)
support = Point()
D = GhPythonScript(deviationEdge=flatten(deviation_2), deviationMagn=flatten(txt_4))  # -> D; inputs deviationEdge: list of Curve, deviationMagn: list
# ---------- D: Python ----------
"""
Defines a new deviation object from inputs
    Inputs:
        deviationEdge: (curves) The curves that define the deviation members in the topological diagram
        deviationMagn: (float) The force magnitudes of the deviation members (tension-positive, compression-negative) 
    Outputs:
        D: (deviationObject) The constructed deviation object
    Remarks:
        This generates a new instance of the deviation object
"""

class Deviation(object):
    def __repr__(self):
        return self.ToString()
        
    def __str__(self):
        return self.ToString()
        
    def ToString(self):
        if deviationEdge:
            return "Deviation Member"



if deviationEdge:
    D = Deviation()
    D.geom = []
    D.magn = []
    
    if deviationMagn:
        if len(deviationEdge) == len(deviationMagn):
            deviationMagnC = []
            for i in range(len(deviationEdge)):
                deviationMagnC.append( deviationMagn[i] )
            D.geom = deviationEdge
            D.magn = deviationMagnC
        elif len(deviationMagn) == 1:
            deviationMagnC = []
            for i in range(len(deviationEdge)):
                deviationMagnC.append( deviationMagn[0] )
            D.geom = deviationEdge
            D.magn = deviationMagnC
        else:
            deviationMagnC = []
            for i in range(len(deviationEdge)):
                deviationMagnC.append( 1 )
            D.geom = deviationEdge
            D.magn = deviationMagnC
    else:
        deviationMagnC = []
        for i in range(len(deviationEdge)):
            deviationMagnC.append( 1 )
        D.geom = deviationEdge
        D.magn = deviationMagnC
# ---------- end D ----------
L = GhPythonScript(loadEdge=flatten(external_force_2), loadMagnZ=flatten(txt_3))  # -> L; inputs loadEdge: list of Line, loadMagnX: list, loadMagnY: list, loadMagnZ: list
# ---------- L: Python ----------
"""
Defines a new point load object from inputs
    Inputs:
        loadEdge: (curves) The curves that define a point load in the topological diagram
        loadMagnX: (float) The magnitude of the point load in x-direction 
        loadMagnY: (float) The magnitude of the point load in y-direction 
        loadMagnZ: (float) TThe magnitude of the point load in z-direction 
    Outputs:
        L: (pointLoadObject) The constructed point load object
    Remarks:
        This generates a new instance of the constructed point load object 
"""


import Rhino


class Load(object):
    def __repr__(self):
        return self.ToString()
        
    def __str__(self):
        return self.ToString()
        
    def ToString(self):
        if loadEdge:
            return "Point Load"
        else:
            return "No external Load"



if loadEdge:
    L = Load()
    L.geom = []
    L.magn = []
    if loadMagnX and loadMagnY and loadMagnZ:
        if len(loadMagnX) == len(loadMagnY) == len(loadMagnZ):
            if len(loadEdge) == len(loadMagnX):
                loadMagn = []
                for i in range(len(loadEdge)):
                    loadMagn.append( (loadMagnX[i],loadMagnY[i],loadMagnZ[i]) )
                L.geom = loadEdge
                L.magn = loadMagn
            elif len(loadMagnX) == 1:
                loadMagn = []
                for i in range(len(loadEdge)):
                    loadMagn.append( (loadMagnX[0],loadMagnY[0],loadMagnZ[0]) )
                L.geom = loadEdge
                L.magn = loadMagn
            else:
                loadMagn = []
                for i in range(len(loadEdge)):
                    loadMagn.append( (0,0,-1) )
                L.geom = loadEdge
                L.magn = loadMagn
        else:
            loadMagn = []
            for i in range(len(loadEdge)):
                loadMagn.append( (0,0,-1) )
            L.geom = loadEdge
            L.magn = loadMagn
    else:
        loadMagn = []
        for i in range(len(loadEdge)):
            loadMagn.append( (0,0,-1) )
        L.geom = loadEdge
        L.magn = loadMagn


print L
# ---------- end L ----------
T = GhPythonScript(trailEdge=flatten(trails_2), trailLen=flatten(txt_2))  # -> T; inputs trailEdge: list of Curve, trailLen: list
# ---------- T: Python ----------
"""
Defines new trail edges from inputs
    Inputs:
        trailEdge: (curves) The curves (segments) that define the trail members in the topological diagram
        trailLen: (float) The lenghts of the trail members (tension-positive, compression-negative)
    Outputs:
        T: (trailObject) The constructed trail object
    Remarks:
        This generates a new instance of a trail object
"""



import Rhino


class Trail(object):
    def __repr__(self):
        return self.ToString()
        
    def __str__(self):
        return self.ToString()
        
    def ToString(self):
        if trailEdge:
            return "Trail Member"



if trailEdge:
    T = Trail()
    T.geom = []
    T.len = []
    
    if trailLen:
        if len(trailEdge) == len(trailLen):
            trailLenC = []
            for i in range(len(trailEdge)):
                trailLenC.append( trailLen[i] )
            T.geom = trailEdge
            T.len = trailLenC
        elif len(trailLen) == 1:
            trailLenC = []
            for i in range(len(trailEdge)):
                trailLenC.append( trailLen[0] )
            T.geom = trailEdge
            T.len = trailLenC
        else:
            trailLenC = []
            for i in range(len(trailEdge)):
                trailLenC.append( 1 )
            T.geom = trailEdge
            T.len = trailLenC
    else:
        trailLenC = []
        for i in range(len(trailEdge)):
            trailLenC.append( 1 )
        T.geom = trailEdge
        T.len = trailLenC
# ---------- end T ----------
S = GhPythonScript(support=flatten(support))  # -> S; inputs support: list of Point3d
# ---------- S: Python ----------
"""
Defines a new support object from inputs
    Inputs:
        support: (points) The support points in the topological diagram
    Outputs:
        S: (supportObject) The constructed support object 
    Remarks:
        This generates a new instance of the support object
"""

class Support(object):
    def __repr__(self):
        return self.ToString()
        
    def __str__(self):
        return self.ToString()
        
    def ToString(self):
        if support:
            return "Support"


if support:
    S = Support()
    S.geom = support
# ---------- end S ----------
topologygeneration_1_30_py = PythonScript(T=T, D=D, L=L, S=S)  # -> out, TP; inputs T: list, D: list, L: list, S: list
# ---------- topologygeneration_1_30_py: Python ----------
"""
Defines a new topological diagram from inputs
    Inputs:
        T: (trailObjects) Trail members in the topological diagram 
        L: (pointLoadObjects) Point Loads in the topological diagram 
        D: (deviationObjects) Deviation members in the topological diagram 
        S: (supportObjects) Supports in the topological diagram
    Outputs:
        TP: (topological diagram) The constructed topological diagram (empty topology on error)
    Remarks:
        This generates a new instance of the topological diagram
"""

__author__    = ['Patrick Ole Ohlbrock','Pierluigi D''Acunto' ]
__copyright__ = 'Copyright 2018 - Chair of Structural Design, ETH Zurich'
__license__   = 'MIT License'
__email__     = 'ohlbrock@arch.ethz.ch'
__version__   = "1.30"

"""
If you use the CEM library in a project, please refer to the GitHub repository: 

@Misc{cem2018,
author = {Ohlbrock, Patrick Ole and D'Acunto, Pierluigi},
title = {{CEM: Combinatorial Equilibrium Modeling}},
year = {2018},
note = {Release 1.30},
url = { http://github.com/OleOhlbrock/CEM },
}

"""




import System.Drawing.Color
import System.Guid
import Rhino
db0_T = 0.001

class topology(object):
    def __repr__(self):
        return self.ToString()
        
    def __str__(self):
        return self.ToString()
        
    def ToString(self):
        if trailMembers and trailMembersID:
            if len(trailMembers) == len(trailMembersID):
                str0_Description = ""
                if hasattr(self, "str1_StructuralBehaviourOut") or hasattr(self, "db1_StructuralBehaviourOut")  and pt1_NodeOut and int2_Trail:
                    str0_Description += "Topological Diagram\n\nvertices: " + str(len(pt1_NodeOut)) + "\ntrail members: " + str(len(int2_Trail)) 
                    if int2_Deviation1:
                        str0_Description += "\ndirect deviation members: " + str(len(int2_Deviation1))
                        if str2_Deviation2:
                            str0_Description += "\nindirect deviation members: " + str(len(str2_Deviation2))
                    return str0_Description
                else:
                    return "Empty topology"
            else:
                return "Empty topology"
        else:
            return "Empty topology"


def ListListToList(xx2_Data):
    xx1_DataOut = []
    for xx1_Data in xx2_Data:
        xx1_DataOut.extend(xx1_Data)
    return xx1_DataOut


TP = topology()


externalForces = []
externalForcesID = []
if L:
    for l in L:
        if l:
            externalForces.extend(l.geom)
            externalForcesID.extend(l.magn)


trailMembers = []
trailMembersID = []
if T:
    for t in T:
        if t:
            trailMembers.extend(t.geom)
            trailMembersID.extend(t.len)


deviationMembers = []
deviationMembersID = []
if D:
    for d in D:
        if d:
            deviationMembers.extend(d.geom)
            deviationMembersID.extend(d.magn)

supports = []
if S:
    for s in S:
        if s:
            supports.extend(s.geom)



if trailMembers and trailMembersID:
    if len(trailMembers) == len(trailMembersID) and len(deviationMembers) == len(deviationMembersID) and len(externalForces) == len(externalForcesID):

        # Create List of Nodes and trailMembers' Connectivity
        pt1_Node = []
        int2_Trail = []
        int2_Deviation = []
        int2_ExtForce = []
        
        pt1_Node.append(trailMembers[0].PointAtStart)
        
        # Nodes and Egdes from trailMembers
        for crv0_Trail in trailMembers:
            int1_Trail = []
            pt0_Start = crv0_Trail.PointAtStart
            bl0_Check = False
            for i in xrange(len(pt1_Node)):
                if abs(pt0_Start.X - pt1_Node[i].X) < db0_T and abs(pt0_Start.Y - pt1_Node[i].Y) < db0_T and abs(pt0_Start.Z - pt1_Node[i].Z) < db0_T:
                    int1_Trail.append(i)
                    bl0_Check = True
                    break
            if bl0_Check == False:
                pt1_Node.append(pt0_Start)
                int1_Trail.append(len(pt1_Node)-1)
            pt0_End = crv0_Trail.PointAtEnd
            bl0_Check = False
            for i in xrange(len(pt1_Node)):
                if abs(pt0_End.X - pt1_Node[i].X) < db0_T and abs(pt0_End.Y - pt1_Node[i].Y) < db0_T and abs(pt0_End.Z - pt1_Node[i].Z) < db0_T:
                    int1_Trail.append(i)
                    bl0_Check = True
                    break
            if bl0_Check == False:
                pt1_Node.append(pt0_End)
                int1_Trail.append(len(pt1_Node)-1)
            int2_Trail.append(int1_Trail)
        

        # Deviation
        crv1_DeviationClean = []
        id1_DeviationClean = []
        for k in xrange(len(deviationMembers)):
            pt0_StartDeviation = deviationMembers[k].PointAtStart
            pt0_EndDeviation = deviationMembers[k].PointAtEnd
            for i in xrange(len(pt1_Node)):
                if abs(pt0_StartDeviation.X - pt1_Node[i].X) < db0_T and abs(pt0_StartDeviation.Y - pt1_Node[i].Y) < db0_T and abs(pt0_StartDeviation.Z - pt1_Node[i].Z) < db0_T:
                    for j in xrange(len(pt1_Node)):
                        if abs(pt0_EndDeviation.X - pt1_Node[j].X) < db0_T and abs(pt0_EndDeviation.Y - pt1_Node[j].Y) < db0_T and abs(pt0_EndDeviation.Z - pt1_Node[j].Z) < db0_T:
                            crv1_DeviationClean.append(deviationMembers[k])
                            id1_DeviationClean.append(deviationMembersID[k])
                            int1_Deviation = []
                            int1_Deviation.append(i)
                            int1_Deviation.append(j)
                            int2_Deviation.append(int1_Deviation)
                            break
                    break
        deviationMembers = crv1_DeviationClean
        deviationMembersID = id1_DeviationClean
        
        # External Force
        ln1_ExtForceClean = []
        External_Forces_IDClean = []
        for k in xrange(len(externalForces)):
            pt0_StartExtForce = externalForces[k].From
            pt0_EndExtForce = externalForces[k].To
            for i in xrange(len(pt1_Node)):
                int1_ExtForce = []
                if abs(pt0_StartExtForce.X - pt1_Node[i].X) < db0_T and abs(pt0_StartExtForce.Y - pt1_Node[i].Y) < db0_T and abs(pt0_StartExtForce.Z - pt1_Node[i].Z) < db0_T:
                    ln1_ExtForceClean.append(externalForces[k])
                    External_Forces_IDClean.append(externalForcesID[k])
                    int1_ExtForce.append(i)
                    int2_ExtForce.append(int1_ExtForce)
                    break
            for j in xrange(len(pt1_Node)):
                if abs(pt0_EndExtForce.X - pt1_Node[j].X) < db0_T and abs(pt0_EndExtForce.Y - pt1_Node[j].Y) < db0_T and abs(pt0_EndExtForce.Z - pt1_Node[j].Z) < db0_T:
                    ln1_ExtForceClean.append(externalForces[k])
                    External_Forces_IDClean.append(externalForcesID[k])
                    int1_ExtForce.append(j)
                    int2_ExtForce.append(int1_ExtForce)
                    break
        
        externalForces = ln1_ExtForceClean
        externalForcesID = External_Forces_IDClean
        
        
        # Extract Attributes External Forces
        st2_externalForcesID = []
        for i in range(len(externalForcesID)):
            st1_externalForcesID = []
            for j in range(len(externalForcesID[i])):
                st1_externalForcesID.append(str(externalForcesID[i][j]))
            st2_externalForcesID.append(st1_externalForcesID)
        str2_ExtForceAtt = st2_externalForcesID

        # Extract Attributes trailMembers
        str1_TrailAtt = [str(x) for x in trailMembersID]

        # Extract Attributes Deviation
        str1_DeviationAtt = [str(x) for x in deviationMembersID]
        
        
        # Create Dictionary of trailMembers' Ends
        dc2_TrailEnds = {}
        for i in xrange(len(int2_Trail)):
            dc2_TrailEnds[str(i)] = [str(x) for x in int2_Trail[i]]
        
        # Create Dictionary of trailMembers' Attributes
        dc1_TrailAtt = {}
        for i in xrange(len(str1_TrailAtt)):
            dc1_TrailAtt[str(i)] = str1_TrailAtt[i]
        
        
        # Create Dictionary of External Forces' End
        dc1_ExtForceEnds = {}
        for i in xrange(len(int2_ExtForce)):
            dc1_ExtForceEnds[str(i)] = str(int2_ExtForce[i][0])
        
        
        # Create Dictionary of External Forces' Attributes
        dc2_ExtForceAtt = {}
        for i in xrange(len(str2_ExtForceAtt)):
            dc2_ExtForceAtt[str(i)] = [x for x in str2_ExtForceAtt[i]]

        
        # Create Lists of Node-Node Connectivity from trailMembers
        int2_Node = []
        for pt0_Node in pt1_Node:
            int1_Node = []
            int2_Node.append(int1_Node)
        for int1_Trail in int2_Trail:
            int2_Node[int1_Trail[0]].append(int1_Trail[1])
            int2_Node[int1_Trail[1]].append(int1_Trail[0])
        
        
        # Create Lists of Deviations' Ends and Attributes
        str2_Deviation = []
        for i in xrange(len(str1_DeviationAtt)):
            str2_Deviation.append( [str(item) for item in int2_Deviation[i] ] )
            str2_Deviation[i].extend([str1_DeviationAtt[i]])
        
        # Convert Trail Input into Polylines
        ln1_Trail = []
        for crv0_Trail in trailMembers:
            if crv0_Trail is Rhino.Geometry.Line:
                ln1_Trail.append(crv0_Trail)
            else:
                ln1_Trail.append(Rhino.Geometry.Line(crv0_Trail.PointAtStart, crv0_Trail.PointAtEnd))
        
        trailMembers = []
        for ln0_Trail in ln1_Trail:
            trailMembers.append(ln0_Trail.ToNurbsCurve())
        
        plc1_Trail = Rhino.Geometry.Curve.JoinCurves(trailMembers)
        
        pln1_Trail = []
        for plc0_Trail in plc1_Trail:
            pln1_Trail.append(plc0_Trail.TryGetPolyline()[1])
        
        
        # Check supports
        pt1_SupportClean = []
        for j in xrange(len(pln1_Trail)):
            if supports:
                pt1_SupportClean.append(pln1_Trail[j][len(pln1_Trail[j])-1])
                for i in xrange(len(supports)):
                    if abs(pln1_Trail[j][0].X - supports[i].X) < db0_T and abs(pln1_Trail[j][0].Y - supports[i].Y) < db0_T and abs(pln1_Trail[j][0].Z - supports[i].Z) < db0_T:
                        pt1_SupportClean[j] = pln1_Trail[j][0]
                        pln1_Trail[j].Reverse()
            else:
                pt1_SupportClean.append(pln1_Trail[j][len(pln1_Trail[j])-1])
        supports = pt1_SupportClean
        
        
        # Find Node Indexes of supports
        int1_Support = []
        for pt0_Support in supports:
            for i in xrange(len(pt1_Node)):
                if abs(pt0_Support.X - pt1_Node[i].X) < db0_T and abs(pt0_Support.Y - pt1_Node[i].Y) < db0_T and abs(pt0_Support.Z - pt1_Node[i].Z) < db0_T:
                    int1_Support.append(i)
                    break
        
        # Create Graph (Dictionary of Node-Node Connectivity from trailMembers)
        dc2_Node = {}
        for i in xrange(len(int2_Node)):
            dc2_Node[str(i)] = [str(x) for x in int2_Node[i]]
        
        int2_TrailPoly = []
        for pln0_Trail in pln1_Trail:
            int1_TrailPoly = []
            for i in xrange(len(pln0_Trail)):
                for k in xrange(len(pt1_Node)):
                    if abs(pln0_Trail[i].X - pt1_Node[k].X) < db0_T and abs(pln0_Trail[i].Y - pt1_Node[k].Y) < db0_T and abs(pln0_Trail[i].Z - pt1_Node[k].Z) < db0_T:
                        int1_TrailPoly.append(k)
                        break
            int2_TrailPoly.append(list(reversed(int1_TrailPoly)))
        
        dc2_ShortPath = {}
        
        for i in xrange(len(pt1_Node)):
            for int1_TrailPoly in int2_TrailPoly:
                if i in int1_TrailPoly:
                    str1_ShortPath = ["S"]
                    str1_ShortPath.extend(map(str, int1_TrailPoly[:int1_TrailPoly.index(i)+1]))
                    dc2_ShortPath[str(i)] = str1_ShortPath
                    break
        
        dc1_ShortPathDist = {}
        dc2_ShortPathDistGrade = {}
        
        for i in xrange(len(pt1_Node)):
            for pln0_Trail in pln1_Trail:
                for j in xrange(len(pln0_Trail)):
                    if abs(pln0_Trail[j].X - pt1_Node[i].X) < db0_T and abs(pln0_Trail[j].Y - pt1_Node[i].Y) < db0_T and abs(pln0_Trail[j].Z - pt1_Node[i].Z) < db0_T:
                        dc1_ShortPathDist[str(i)] = len(pln0_Trail) - j
                        break
        
        # Define Sequences
        for key in dc1_ShortPathDist:
            if dc1_ShortPathDist[key] not in dc2_ShortPathDistGrade:
                dc2_ShortPathDistGrade[dc1_ShortPathDist[key]] = [key]
            else:
                dc2_ShortPathDistGrade[dc1_ShortPathDist[key]].extend([key])
        
        
        # Separate deviation_1 (direct) and deviation_2 (indirect-bracing)
        
        dc2_Deviation1Ends = {}
        dc2_Deviation2Ends = {}
        
        dc1_Deviation1Att = {}
        dc1_Deviation2Att = {}
        
        int2_Deviation1 = []
        str2_Deviation2 = []
        
        crv1_Deviation1 = []
        crv1_Deviation2 = []
        
        j = 0
        k = 0
        
        for i in xrange(len(str2_Deviation)):
            if dc1_ShortPathDist[ str(str2_Deviation[i][0]) ] == dc1_ShortPathDist[ str(str2_Deviation[i][1]) ]:
                dc2_Deviation1Ends[str(j)] = [str(str2_Deviation[i][0]),str(str2_Deviation[i][1])]
                dc1_Deviation1Att[str(j)] = str(str2_Deviation[i][2])
                int2_Deviation1.append([int(str2_Deviation[i][0]),int(str2_Deviation[i][1])])
                crv1_Deviation1.append(deviationMembers[i])
                j += 1
            else:
                dc2_Deviation2Ends[str(k)] = [str(str2_Deviation[i][0]),str(str2_Deviation[i][1])]
                dc1_Deviation2Att[str(k)] = str(str2_Deviation[i][2])
                str2_Deviation2.append(str2_Deviation[i])
                crv1_Deviation2.append(deviationMembers[i])
                k += 1
        
        
        
        # Create Dictionary of Trail and Deviation 1 for Structural Matrix
        dc2_EdgeEnds = {}
        for key in dc2_TrailEnds:
            dc2_EdgeEnds[str(int(key))] = dc2_TrailEnds[key]
        for key in dc2_Deviation1Ends:
            dc2_EdgeEnds[str(int(key)+len(dc2_TrailEnds))] = dc2_Deviation1Ends[key]
        
        dc1_EdgeAtt = {}
        for key in dc1_TrailAtt:
            dc1_EdgeAtt[str(int(key))] = dc1_TrailAtt[key]
        for key in dc1_Deviation1Att:
            dc1_EdgeAtt[str(int(key)+len(dc1_TrailAtt))] = dc1_Deviation1Att[key]
        
        # Create Dictionary of Trail and Deviation 1 and 2 for Visualization
        dc1_Edge = {}
        for key in dc1_TrailAtt:
            dc1_Edge[str(int(key))] = dc1_TrailAtt[key]
        for key in dc1_Deviation1Att:
            dc1_Edge[str(int(key)+len(dc1_TrailAtt))] = dc1_Deviation1Att[key]
        for key in dc1_Deviation2Att:
            dc1_Edge[str(int(key)+len(dc1_TrailAtt)+len(dc1_Deviation1Att))] = dc1_Deviation2Att[key]
        
        
        ## Visualization
        
        # Nodes
        pt1_NodeOut = pt1_Node
        pt1_TargetOut = pt1_NodeOut
        str1_NodeOut = [str(i) + " (" + str(dc1_ShortPathDist[str(i)]) + ")" for i in xrange(len(pt1_Node))]
        str1_TargetOut = [str(i) for i in xrange(len(pt1_Node))]
        
        # Edges
        crv1_Edge = []
        for crv0_Trail in trailMembers: crv1_Edge.append(crv0_Trail)
        for crv0_Deviation1 in crv1_Deviation1: crv1_Edge.append(crv0_Deviation1)
        for crv0_Deviation2 in crv1_Deviation2: crv1_Edge.append(crv0_Deviation2)
        
        crv1_EdgeOut = crv1_Edge
        pt1_EdgeOut = [crv0_Edge.PointAtNormalizedLength(0.6) for crv0_Edge in crv1_EdgeOut]
        str1_EdgeOut = [str(i) + " (" + dc1_Edge[str(i)] + ")" for i in xrange(len(crv1_EdgeOut))]
        
        
        # Update Lists of Node-Node Connectivity from Deviation 1
        for int1_DevTemp in int2_Deviation1:
            int2_Node[int1_DevTemp[0]].append(int1_DevTemp[1])
            int2_Node[int1_DevTemp[1]].append(int1_DevTemp[0])
        
        
        # Create Graph (Dictionary of Node-Node Connectivity from trailMembers)
        for i in xrange(len(int2_Node)):
            dc2_Node[str(i)] = [str(x) for x in int2_Node[i]]
        
        
        ## Create Dictionaries for Structural Matrix
        dc1_NodeTrailOut = {}
        dc1_NodeTrailIn = {}
        dc2_NodeDeviation = {}
        dc1_NodeExtForce = {}
        dc1_NodeExtForceAtt = {}
        int0_NodeTrailIn = {}
        
        # Trail In and Out
        for key in dc2_ShortPath:
            dc1_NodeTrailOut[key] = dc2_ShortPath[key][len(dc2_ShortPath[key])-2]
        for key in dc1_NodeTrailOut:
            if dc1_NodeTrailOut[key] != "S":
                dc1_NodeTrailIn[dc1_NodeTrailOut[key]] = key
        
        for key in dc1_NodeTrailOut:
            if key not in dc1_NodeTrailIn:
                dc1_NodeTrailIn[key] = "L"
        
        # Deviation
        for key in dc2_Node:
            str1_v = []
            for v in dc2_Node[key]:
                if v != dc1_NodeTrailOut[key] and v != dc1_NodeTrailIn[key]:
                    str1_v.append(v)
            dc2_NodeDeviation[key] = str1_v
        
        # External Forces
        for key in dc1_ExtForceEnds:
            if dc1_ExtForceEnds[key] not in dc1_NodeExtForce:
                dc1_NodeExtForce[dc1_ExtForceEnds[key]] = [key]
            else:
                dc1_NodeExtForce[dc1_ExtForceEnds[key]].append(key)
        
        for key in dc1_NodeExtForce:
            for v in dc1_NodeExtForce[key]:
                if dc1_ExtForceEnds[v] not in dc1_NodeExtForceAtt:
                    dc1_NodeExtForceAtt[key] = [item for item in dc2_ExtForceAtt[v]]
                else:
                    xx1_NodeExtForceAtt = dc1_NodeExtForceAtt[dc1_ExtForceEnds[v]]
                    for i in xrange(len(xx1_NodeExtForceAtt)):
                        try:
                            xx1_NodeExtForceAtt[i] = float(xx1_NodeExtForceAtt[i])
                        except:
                            xx1_NodeExtForceAtt[i] = -1.0
                            
                            
                    try:
                        dc2_ExtForceAtt[v][0] = float(dc2_ExtForceAtt[v][0])
                    except:
                        dc2_ExtForceAtt[v][0] = -1.0
                    try:
                        dc2_ExtForceAtt[v][1] = float(dc2_ExtForceAtt[v][1])
                    except:
                        dc2_ExtForceAtt[v][1] = -1.0
                    try:
                        dc2_ExtForceAtt[v][2] = float(dc2_ExtForceAtt[v][2])
                    except:
                        dc2_ExtForceAtt[v][2] = -1.0
                    dc1_NodeExtForceAtt[key][0] += float(dc2_ExtForceAtt[v][0])
                    dc1_NodeExtForceAtt[key][1] += float(dc2_ExtForceAtt[v][1])
                    dc1_NodeExtForceAtt[key][2] += float(dc2_ExtForceAtt[v][2])
        
        
        ## Create Structural Matrix According to Weight
        
        # Initialize Matrix with Indices
        str2_StructuralMatrix = []
        str1_NodeOrderMatrix = []
        str2_NodeOrderMatrix = []
        
        str1_NodeOrder = dc2_ShortPathDistGrade[1]
        
        for i in sorted(xrange(1,len(dc2_ShortPathDistGrade)+1)):
            str1_NodeOrderUp = []
            str2_NodeOrderMatrix.append(str1_NodeOrder)
            for str0_NodeOrder in str1_NodeOrder:
                str1_NodeOrderMatrix.append(str0_NodeOrder)
                if str0_NodeOrder[0] != "L":
                    str2_StructuralMatrix.append(["0"]*(3+len(str1_NodeOrder)+1))
                    str1_NodeOrderUp.append(dc1_NodeTrailIn[str0_NodeOrder])
                else:
                    str2_StructuralMatrix.append(["0"]*(3+len(str1_NodeOrder)+1))
                    str1_NodeOrderUp.append("L")
            str1_NodeOrder = str1_NodeOrderUp
        
        int0_NodeOrderMatrix = len(str2_NodeOrderMatrix[0])
        
        
        # Add Attribute External Forces
        for key in dc1_NodeExtForce:
            int0_NodeIndex = str1_NodeOrderMatrix.index(key)
            str2_StructuralMatrix[int0_NodeIndex][0:3] = [str(item) for item in dc1_NodeExtForceAtt[key]]
        
        # Add Attribute Trail Out
        for key in dc2_EdgeEnds:
            if dc2_EdgeEnds[key][0] in dc1_NodeTrailOut and dc2_EdgeEnds[key][1] == dc1_NodeTrailOut[dc2_EdgeEnds[key][0]]:
                int0_NodeIndex = str1_NodeOrderMatrix.index(dc2_EdgeEnds[key][0])
                str2_StructuralMatrix[int0_NodeIndex][len(str2_StructuralMatrix[int0_NodeIndex])-1] = dc1_EdgeAtt[key]
            elif dc2_EdgeEnds[key][1] in dc1_NodeTrailOut and dc2_EdgeEnds[key][0] == dc1_NodeTrailOut[dc2_EdgeEnds[key][1]]:
                int0_NodeIndex = str1_NodeOrderMatrix.index(dc2_EdgeEnds[key][1])
                str2_StructuralMatrix[int0_NodeIndex][len(str2_StructuralMatrix[int0_NodeIndex])-1] = dc1_EdgeAtt[key]
        
        # Add Attribute Deviation
        for key in dc2_EdgeEnds:
            if dc2_EdgeEnds[key][0] in dc2_NodeDeviation and dc2_EdgeEnds[key][1] in dc2_NodeDeviation[dc2_EdgeEnds[key][0]]:
                int0_NodeIndex = str1_NodeOrderMatrix.index(dc2_EdgeEnds[key][0])
                int0_NodeIndexTo = str1_NodeOrderMatrix.index(dc2_EdgeEnds[key][1])
                int0_NodeIndexRaw = (int0_NodeIndexTo) % int0_NodeOrderMatrix
                str2_StructuralMatrix[int0_NodeIndex][3 + int0_NodeIndexRaw] = dc1_EdgeAtt[key]
            if dc2_EdgeEnds[key][1] in dc2_NodeDeviation and dc2_EdgeEnds[key][0] in dc2_NodeDeviation[dc2_EdgeEnds[key][1]]:
                int0_NodeIndex = str1_NodeOrderMatrix.index(dc2_EdgeEnds[key][1])
                int0_NodeIndexTo = str1_NodeOrderMatrix.index(dc2_EdgeEnds[key][0])
                int0_NodeIndexRaw = (int0_NodeIndexTo) % int0_NodeOrderMatrix
                str2_StructuralMatrix[int0_NodeIndex][3 + int0_NodeIndexRaw] = dc1_EdgeAtt[key]
        
        # Order Matrix
        str2_StructuralMatrixOrder = []
        int1_StructuralMatrixOrder = []
        str2_NodeOrderMatrixReversed = []
        
        for i in reversed(xrange(1,len(str2_NodeOrderMatrix)+1)):
            for j in xrange(int0_NodeOrderMatrix):
                int0_Index = int0_NodeOrderMatrix*(i-1)+j
                if i != len(str2_NodeOrderMatrix):
                    int1_StructuralMatrixOrder.append(str2_NodeOrderMatrix[i-1][j])
                str2_StructuralMatrixOrder.append(str2_StructuralMatrix[int0_NodeOrderMatrix*(i-1)+j])
        
        for i in reversed(xrange(1,len(str2_NodeOrderMatrix)+1)):
            str1_NodeOrderMatrixReversed = []
            for j in xrange(int0_NodeOrderMatrix):
                str1_NodeOrderMatrixReversed.append(str2_NodeOrderMatrix[i-1][j])
            str2_NodeOrderMatrixReversed.append(str1_NodeOrderMatrixReversed)
        
        # Substitute Node Index with Matrix Index in Deviation2
        str1_Deviation2 = ListListToList(str2_Deviation2)
        str1_NodeOrder = ListListToList(str2_NodeOrderMatrixReversed)
        
        for i in xrange(len(str1_Deviation2)):
            if (i+1) % 3 != 0:
                str1_Deviation2[i] = str1_NodeOrder.index(str(str1_Deviation2[i]))
        
        
        ## Output
        str1_DeviationIndirectOut = str1_Deviation2
        str1_StructuralBehaviourOut = ListListToList(str2_StructuralMatrixOrder)
        
        
        #### AUTOMATIC GEOMETRIC INPUT FOR FORM DIAGRAM
        
        # str1_NodeOrderOut from Graph with "L" where leaf (as List)
        # str1_NodeOrderC = Clean Node Order without L but duplicated node numbers where needed
        # pt1_NodeOut = geometric locations from vertices in graph
        
        # Amount of layers
        N_layers = len(str1_NodeOrder)/len(supports)
        
        # Clean up the sequence of nodes in the network, create duplicates where the trail is shorter
        for j in xrange(N_layers):
            for i in xrange(len(str1_NodeOrder)):
                if str1_NodeOrder[i]== "L":
                    str1_NodeOrder[i] = str1_NodeOrder[i+len(supports)]
        str1_TrailTipOrder = str1_NodeOrder[:len(supports)]
        
        # Get the position of the origin points from the topological diagram
        
        pt1_OriginNodeOut = []
        for i in xrange(len((supports))):
            pt0_OriginNodeOut = pt1_NodeOut[int(str1_TrailTipOrder[i])] 
            pt1_OriginNodeOut.append(pt0_OriginNodeOut)
        
        # projection of points in World-x-y plane
        pt2_NodePlanes = []
        
        for i in xrange(len(pt1_NodeOut)):
            pt1_NodePlanes = Rhino.Geometry.Point3d(pt1_NodeOut[i][0],pt1_NodeOut[i][1],0.0)
            pt2_NodePlanes.append(pt1_NodePlanes)
        
        # Get the constraint planes from the vertices from the topological diagram
        pl1_ConstraintPlaneOut = []
        pl0_ConstraintPlaneOut = []
        vc0_NormalVectorPlane = []
        
        for i in xrange(len(str1_NodeOrder)-len(supports)):
             vc0_NormalVectorPlane =  Rhino.Geometry.Vector3d(pt2_NodePlanes[int(str1_NodeOrder[i])]-pt2_NodePlanes[int(str1_NodeOrder[i+len(supports)])])
             pl0_ConstraintPlaneOut = Rhino.Geometry.Plane(pt2_NodePlanes[int(str1_NodeOrder[i+len(supports)])],vc0_NormalVectorPlane)
             pl1_ConstraintPlaneOut.append(pl0_ConstraintPlaneOut)
        
        
        str1_NodeOrderOut = str1_NodeOrder
        int1_ConstraintPlaneOut = str1_NodeOrder[len(supports):]
        
        
        
        TP.str1_StructuralBehaviourOut = str1_StructuralBehaviourOut
        TP.str1_DeviationIndirectOut = str1_DeviationIndirectOut
        TP.pt1_NodeOut = pt1_NodeOut
        TP.str1_NodeOut = str1_NodeOut
        TP.crv1_EdgeOut = crv1_EdgeOut
        TP.pt1_EdgeOut = pt1_EdgeOut
        TP.str1_EdgeOut = str1_EdgeOut
        TP.str1_NodeOrderOut = str1_NodeOrderOut
        TP.pl1_ConstraintPlaneOut = pl1_ConstraintPlaneOut
        TP.int1_ConstraintPlaneOut = int1_ConstraintPlaneOut
        TP.pt1_OriginNodeOut = pt1_OriginNodeOut


def StringToFloat(val):
    try:
        return float(val)
    except (ValueError, TypeError):
        return 1.0

if TP and hasattr(TP, "str1_StructuralBehaviourOut"):
    str1_StructuralBehaviour = TP.str1_StructuralBehaviourOut[:]
    str1_DeviationIndirect = TP.str1_DeviationIndirectOut[:]
    db1_StructuralBehaviour = []
    db1_DeviationIndirect = []
        
    for i in xrange(len(str1_StructuralBehaviour)):
        db1_StructuralBehaviour.append(StringToFloat(str1_StructuralBehaviour[i]))
    
    for i in xrange(len(str1_DeviationIndirect)):
        db1_DeviationIndirect.append(StringToFloat(str1_DeviationIndirect[i]))

    del TP.str1_StructuralBehaviourOut
    del TP.str1_DeviationIndirectOut
    
    TP.db1_StructuralBehaviourOut = db1_StructuralBehaviour
    TP.db1_DeviationIndirectOut = db1_DeviationIndirect
# ---------- end topologygeneration_1_30_py ----------

# ----
T_2 = PythonNoHint(T=topologygeneration_1_30_py.TP)  # -> pl1_ConstraintPlane, int1_ConstraintPlane
# ---------- T_2: Python ----------
if T:
    pl1_ConstraintPlane = T.pl1_ConstraintPlaneOut
    int1_ConstraintPlane = T.int1_ConstraintPlaneOut
# ---------- end T_2 ----------
T_3 = PythonNoHint(T=topologygeneration_1_30_py.TP)  # -> pt1_OriginNode
# ---------- T_3: Python ----------
if T:
    pt1_OriginNode = T.pt1_OriginNodeOut
# ---------- end T_3 ----------
tp = PythonNoHint(TP=topologygeneration_1_30_py.TP)  # -> constraintPlane, constraintPlaneID
# ---------- tp: Python ----------
"""
Retrieves automatically generated planes from the topological diagram
    Inputs:
        TP: (topological diagram) The topological diagram used for the calculation of the structural model
    Outputs:
        constraintPlane: (plane) The planes which are projections of the toplogical diagram on the xy plane
        constraintPlaneID: (integer) The indices of these planes
    Remarks:
        This generates constraintPlanes and constraintPlaneIDs
"""


if TP and hasattr(TP, "pl1_ConstraintPlaneOut") and hasattr(TP, "int1_ConstraintPlaneOut"):
    constraintPlane = TP.pl1_ConstraintPlaneOut
    constraintPlaneID = TP.int1_ConstraintPlaneOut
# ---------- end tp ----------
tp_2 = PythonNoHint(TP=topologygeneration_1_30_py.TP)  # -> originNode, originNodeID
# ---------- tp_2: Python ----------
"""
Retrieves automatically generated origin nodes from the topological diagram
    Inputs:
        TP: (topological diagram) The topological diagram used for the calculation of the structural model
    Outputs:
        originNode: (point 3D) The origin points from the topological diagram
        originNodeID: (integer) The indices of these points
    Remarks:
        This generates coriginNodes and originNodeIDs
"""


if TP and hasattr(TP, "pt1_OriginNodeOut"):
    originNode = TP.pt1_OriginNodeOut
    originNodeID = TP.str1_NodeOrderOut[:len(originNode)]
# ---------- end tp_2 ----------
panel_2 = Panel(topologygeneration_1_30_py.TP)
visualizevertices = PythonNoHint(TP=topologygeneration_1_30_py.TP)  # -> V, L
# ---------- visualizevertices: Python ----------
if TP and hasattr(TP, "str1_NodeOut") and hasattr(TP, "pt1_NodeOut"):
    V = TP.pt1_NodeOut
    L = TP.str1_NodeOut
# ---------- end visualizevertices ----------

planes_ground_level_supports = PlanesGroundLevelSupports(L_2=T_2.pl1_ConstraintPlane, O=pt_groundlevel, L=T_3)
ground_level_supports = GroundLevelSupports(int=T_2.int1_ConstraintPlane, data=T_3, pt_groundlevel=pt_groundlevel)  # -> A, D
pln = Plane(flatten(ground_level_supports.D))
int = Integer(flatten(ground_level_supports.A))
int_2 = Integer(T_2.int1_ConstraintPlane)
pln_2 = Plane(planes_ground_level_supports)

move = Move(Geometry=tp_2.originNode, Motion=X)  # -> Geometry, Transform
tag = TextTag3D(Location=visualizevertices.V, Text=visualizevertices.L, Size=0.2, Colour=RGB(0, 0, 0), Justification=7)

# ---- group: Combinatorial Equlibrium Modelling
self_weight = BooleanToggle(True)
yieldstress_kn_m2 = Slider(200000, range=50..1000000)
specific_weight_kn_m3 = Slider(500, range=5..500)
cpl = GhPythonScript(constraintPlane=flatten(pln_2), constraintPlaneID=flatten(int_2))  # -> CPL; inputs constraintPlane: list of Plane, constraintPlaneID: list of Int32
# ---------- cpl: Python ----------
"""
Create a new constraint plane object CPL for given inputs
    Inputs:
        constraintPlane: (Plane) constraint planes per nodes
        constraintPlaneID: (integer) corresponding node indices
    Outputs:
        CPL: (constraintPlaneObject) The created constraint plane object
    Remarks:
        This generates a new instance of the constraint plane object
"""




import Rhino


class CPlane(object):
    def __repr__(self):
        return self.ToString()
        
    def __str__(self):
        return self.ToString()
        
    def ToString(self):
        if constraintPlane and len(constraintPlane) == len(constraintPlaneID):
            return str(len(constraintPlane)) + " Constraint Planes"
        else:
            return "Invalid Constraint Planes"



if constraintPlane:
    CPL = CPlane()
    CPL.constraintPlane = constraintPlane
    CPL.constraintPlaneID = constraintPlaneID
# ---------- end cpl ----------
N = GhPythonScript(originNode=flatten(move.Geometry), originNodeID=flatten(tp_2.originNodeID))  # -> N; inputs originNode: list of Point3d, originNodeID: list of Int32
# ---------- N: Python ----------
"""
Create a new origin node object N for given inputs
    Inputs:
        originNode: (Point 3d) Position of the origin nodes
        originNodeID: (integer) Corresponding node indices
    Outputs:
        N: (originNodeObject) The created origin node object
    Remarks:
        This generates a new instance of the origin node object
"""

import Rhino


class ONode(object):
    def __repr__(self):
        return self.ToString()
        
    def __str__(self):
        return self.ToString()
        
    def ToString(self):
        if originNode and len(originNode) == len(originNodeID):
            return str(len(originNode)) + " Defined Origin Nodes"
        else:
            return "Undefined Origin Nodes"



if originNode:
    N = ONode()
    N.originNode = originNode
    N.originNodeID = originNodeID
# ---------- end N ----------
sw = GhPythonScript(selfWeight=self_weight, yieldStress=yieldstress_kn_m2, specWeight=specific_weight_kn_m3)  # -> SW; inputs selfWeight: Boolean
# ---------- sw: Python ----------
"""
Create a new self weight object for a given input
    Inputs:
        selfWeight: (bool) Activates the self weight of the structure
        yieldStress: (double) The yield stress of the structural members
        specWeight: (double) The specific weight of the structural members
    Outputs:
        SW: (selfWeightObject) The created self weight object
    Remarks:
        This generates a new instance of the self weight object
"""





import Rhino


class SWeight(object):
    def __repr__(self):
        return self.ToString()
        
    def __str__(self):
        return self.ToString()
        
    def ToString(self):
        if selfWeight and yieldStress and specWeight:
                return "Self Weight"
        else:
            return "No Self Weight"

SW = SWeight()
if selfWeight and yieldStress and specWeight:
    SW.yieldStress = yieldStress
    SW.specWeight = specWeight
# ---------- end sw ----------
combinatorialequilibriummodelling_1_30_p = PythonScript(TP=topologygeneration_1_30_py.TP, CPL=cpl, N=N, SW=sw)  # -> out, M; "combinatorialEquilibriumModelling_1.30.py"
# ---------- combinatorialequilibriummodelling_1_30_p: Python ----------
"""
Calculate the structural model
    Inputs:
        TP: (topological diagram) The topological diagram used for the calculation of the structural model
        CPL: (constraintPlaneObject) The constraint planes and their Indices
        N: (originnodeObject) The origin nodes and their Indices
        SW: (selfWeightObject) The Activation of self weight of the structure and their yield stress and specific weight attributes.
    Outputs:
        M: (structural model) The calculated structural model (empty model on error)
    Remarks:
        This generates a new instance of the structural model for a given topological diagram
"""

__author__    = ['Patrick Ole Ohlbrock','Pierluigi D''Acunto' ]
__copyright__ = 'Copyright 2018 - Chair of Structural Design, ETH Zurich'
__license__   = 'MIT License'
__email__     = 'ohlbrock@arch.ethz.ch'
__version__   = "1.30"

"""
If you use the CEM library in a project, please refer to the GitHub repository: 

@Misc{cem2018,
author = {Ohlbrock, Patrick Ole and D'Acunto, Pierluigi},
title = {{CEM: Combinatorial Equilibrium Modeling}},
year = {2018},
note = {Release 1.30},
url = { http://github.com/OleOhlbrock/CEM },
}

"""


import Rhino.Geometry as rh
import rhinoscriptsyntax as rs
import math
import System.Drawing.Color
import copy
import time


class model(object):
    def __repr__(self):
        return self.ToString()
        
    def __str__(self):
        return self.ToString()
        
    def ToString(self):
        if TPC and hasattr(TPC, "db1_StructuralBehaviourOut"):
            str0_Description = ""
            if int0_LayerCount:
                str0_Description += "Structural Model\n\nlayers: " + str(int0_LayerCount)
                if pt1_GlobNodeOut and ln1_GlobTrailEdgeOut:
                    str0_Description += "\nvertices: " + str(len(pt1_GlobNodeOut)-int0_TrailNumber) + "\ntrail members: " + str(len(ln1_GlobTrailEdgeOut)-int0_TrailNumber) 
                    if ln1_GlobDeviation1EdgeOut:
                        str0_Description += "\ndirect deviation members: " + str(len(ln1_GlobDeviation1EdgeOut))
                        if ln1_GlobDeviation2EdgeOut:
                            str0_Description += "\nindirect deviation members: " + str(len(ln1_GlobDeviation2EdgeOut))
                    return str0_Description
                else:
                    return "Empty Structural Model"
            else:
                return "Empty Structural Model"
        else:
            return "Empty Structural Model"


### AUXILIARY FUNCTIONS
def ListListToList(xx2_Data):
    xx1_DataOut = []
    for xx1_Data in xx2_Data:
        xx1_DataOut.extend(xx1_Data)
    return xx1_DataOut

def TransposeListList(xx2_Data):
    xx2_DataOut = list(map(list, zip(*xx2_Data)))
    return xx2_DataOut
    
def ListToListList(xx1_Data, int0_R, int0_C):
    xx2_DataOut = []
    for i in xrange(int0_R):
        xx1_DataOut = []
        for j in xrange(int0_C):
            xx1_DataOut.append(xx1_Data[j+i*int0_C])
        xx2_DataOut.append(xx1_DataOut)
    return xx2_DataOut

def DataTreeToListList(dt2_Data):
    xx2_DataOut = []
    for i in xrange(dt2_Data.BranchCount):
        xx1_DataOut = []
        for j in xrange(len(dt2_Data.Branch(i))):
            xx1_DataOut.append(dt2_Data.Branch(i)[j])
        xx2_DataOut.append(xx1_DataOut)
    return xx2_DataOut



constraintPlane = []
constraintPlaneID = []

if CPL:
    constraintPlane = CPL.constraintPlane
    constraintPlaneID = CPL.constraintPlaneID


yieldStress = None
specWeight = None

if SW and hasattr(SW, "yieldStress") and hasattr(SW, "specWeight"):
    yieldStress = SW.yieldStress
    specWeight = SW.specWeight


import copy
TPC = copy.deepcopy(TP)

if TPC and hasattr(TPC, "db1_StructuralBehaviourOut"):
    if len(constraintPlane) > 0:
        if len(constraintPlane) == len(constraintPlaneID):
            TPC.pl1_ConstraintPlaneOut = constraintPlane
            TPC.int1_ConstraintPlaneOut = constraintPlaneID
        else:
            TPC.pl1_ConstraintPlaneOut = None
            TPC.int1_ConstraintPlaneOut = None
    else:
        TPC.pl1_ConstraintPlaneOut = None
        TPC.int1_ConstraintPlaneOut = None
    
    if N:
        if len(N.originNode) == len(TP.pt1_OriginNodeOut):
            TPC.pt1_OriginNodeOut = N.originNode






M = model()

if TPC and hasattr(TPC, "db1_StructuralBehaviourOut"):
    
    db1_StructuralBehaviour = TPC.db1_StructuralBehaviourOut
    str1_NodeOrderC = TPC.str1_NodeOrderOut
    xx1_Bracing = TPC.db1_DeviationIndirectOut
    pl1_ConstraintPlane = TPC.pl1_ConstraintPlaneOut
    id_NodePlane = TPC.int1_ConstraintPlaneOut
    pt1_OriginNode = TPC.pt1_OriginNodeOut
    str1_Edge = TPC.str1_EdgeOut
    

    ### GLOBAL VARIABLES
    
    # Counters and Tolerance
    int0_Counter = 0
    db0_Divergence = float("inf")
    db0_Threshold = 1e-10
    int0_CounterBracing = 100
    
    if len(xx1_Bracing) == 0: int0_CounterBracing = 1
    
    int0_TrailNumber = len(pt1_OriginNode)  # input nodes
    int0_C = 3+int0_TrailNumber+1
    int0_R = int(len(db1_StructuralBehaviour)/int0_C)
    db2_StructuralBehaviour = ListToListList(db1_StructuralBehaviour, int0_R, int0_C)
    int0_LayerCount = int(len(db2_StructuralBehaviour)/int0_TrailNumber) # amount of layers
    
    # Global Variables
    vc2_GlobTrailForce = []
    ln2_GlobExtEdge = []
    pt2_GlobNode = []
    pt2_GlobNodeIteration = []
    ln2_GlobTrailEdge = []
    cl2_GlobTrailEdge = []
    db2_GlobTrailEdge = []
    ln2_GlobDeviation1Edge = []
    cl2_GlobDeviation1Edge = []
    db2_GlobDeviation1Edge = []
    ln2_GlobDeviation2Edge = []
    cl2_GlobDeviation2Edge = []
    db2_GlobDeviation2Edge = []
    ln2_GlobExtFOEdge = []
    cl2_GlobExtFOEdge = []
    db2_GlobExtFOEdge = []
    
    
    ### MAIN FUNCTION
    
    def Main(db1_StructuralBehaviour, xx1_Bracing, pt1_OriginNode, pl1_ConstraintPlane):
        
        global int0_Counter     # global counter
        
        g = 0                                   
        ### ITERATE FOR EACH LAYER OF THE STRUCTURE
        
        ## Initialize
        pt1_InputNode = []
        
        for g in xrange(int0_LayerCount):
            
            vc1_TrailForceIn = []
            
            if g == 0:
                pt1_InputNode = pt1_OriginNode
                for i in xrange(int0_TrailNumber):
                    vc1_TrailForceIn.append(rh.Vector3d(0,0,0)) 
            else:
                pt1_InputNode = pt2_GlobNode[g-1]
                for i in xrange(int0_TrailNumber):
                    vc1_TrailForceIn.append(-vc2_GlobTrailForce[g-1][i])
        
            ### LAYER DEVELOPMENT
            
            ## Initialize Layer
            
            # Create Deviation Length and Unit Vector Matrix
            vc2_DevLengthVector = []
            vc2_DevUnitVector = []
            
            for i in xrange(int0_TrailNumber):
                vc1_DevLengthVector = []
                vc1_DevUnitVector = []
                for j in xrange(int0_TrailNumber):
                    vc0_DevLengthVector = rh.Vector3d(pt1_InputNode[j]-pt1_InputNode[i])
                    vc0_DevUnitVector = rh.Vector3d(vc0_DevLengthVector)
                    rh.Vector3d.Unitize(vc0_DevUnitVector)
                    vc1_DevLengthVector.append(vc0_DevLengthVector)
                    vc1_DevUnitVector.append(vc0_DevUnitVector)
                vc2_DevLengthVector.append(vc1_DevLengthVector)
                vc2_DevUnitVector.append(vc1_DevUnitVector)
            
            
            ### MAIN FUNCTION
            
            # Create List of External Forces
            # list for external and bracing forces
            db1_ExtForceX = []
            db1_ExtForceY = []
            db1_ExtForceZ = []
            
            # list for external forces only
            db1_ExtFOX = []
            db1_ExtFOY = []
            db1_ExtFOZ = []
            
            # Add External Forces from Matrix    
            for i in xrange(g*int0_TrailNumber,(g+1)*int0_TrailNumber):
                db1_ExtFOX.append(db2_StructuralBehaviour[i][0])
                db1_ExtFOY.append(db2_StructuralBehaviour[i][1])
                db1_ExtFOZ.append(db2_StructuralBehaviour[i][2])
                
            for i in xrange(g*int0_TrailNumber,(g+1)*int0_TrailNumber):
                db1_ExtForceX.append(db2_StructuralBehaviour[i][0])
                db1_ExtForceY.append(db2_StructuralBehaviour[i][1])
                db1_ExtForceZ.append(db2_StructuralBehaviour[i][2])
                
                # Add Magnitudes of Bracing Forces as External Forces
                # Start node of bracing
                if len(xx1_Bracing) > 0:
                    if int0_Counter != 0 :
                        for j in xrange(0,len(xx1_Bracing),3):
                            int0_BracingFromLayerIndex = int(xx1_Bracing[j]) // int0_TrailNumber
                            if i == int(xx1_Bracing[j]):
                                pt0_BracingFrom = pt2_GlobNodeIteration[g][i-g*int0_TrailNumber]
                                int0_BracingToLayerIndex = int(xx1_Bracing[j+1]) // int0_TrailNumber
                                int0_BracingToTrailIndex = int(xx1_Bracing[j+1]) % int0_TrailNumber
                                pt0_BracingTo = pt2_GlobNodeIteration[int0_BracingToLayerIndex][int0_BracingToTrailIndex]
                                vc0_ForceA = rh.Vector3d(pt0_BracingTo-pt0_BracingFrom)
                                rh.Vector3d.Unitize(vc0_ForceA)
                                vc0_ForceA = float(xx1_Bracing[j+2])*vc0_ForceA
                                db1_ExtForceX[i-g*int0_TrailNumber] += vc0_ForceA.X
                                db1_ExtForceY[i-g*int0_TrailNumber] += vc0_ForceA.Y
                                db1_ExtForceZ[i-g*int0_TrailNumber] += vc0_ForceA.Z
                            
                # End node of bracing
                if len(xx1_Bracing) > 0:
                    if int0_Counter != 0:
                        for j in xrange(1,len(xx1_Bracing),3):
                            int0_BracingFromLayerIndex = int(xx1_Bracing[j]) // int0_TrailNumber
                            if i == int(xx1_Bracing[j]):
                                pt0_BracingFrom = pt2_GlobNodeIteration[g][i-g*int0_TrailNumber]
                                int0_BracingToLayerIndex = int(xx1_Bracing[j-1]) // int0_TrailNumber
                                int0_BracingToTrailIndex = int(xx1_Bracing[j-1]) % int0_TrailNumber
                                pt0_BracingTo = pt2_GlobNodeIteration[int0_BracingToLayerIndex][int0_BracingToTrailIndex]
                                vc0_ForceA = rh.Vector3d(pt0_BracingTo-pt0_BracingFrom)
                                rh.Vector3d.Unitize(vc0_ForceA)
                                vc0_ForceA = float(xx1_Bracing[j+1])*vc0_ForceA
                                db1_ExtForceX[i-g*int0_TrailNumber] += vc0_ForceA.X
                                db1_ExtForceY[i-g*int0_TrailNumber] += vc0_ForceA.Y
                                db1_ExtForceZ[i-g*int0_TrailNumber] += vc0_ForceA.Z
            
            # Vector sum of external and bracing forces for the equilibrium calculation
            vc1_ExtForce = []
            for i in xrange(int0_TrailNumber):
                vc0_ExtForce = rh.Vector3d(db1_ExtForceX[i],db1_ExtForceY[i],db1_ExtForceZ[i])
                vc1_ExtForce.append(vc0_ExtForce)
            
            # Vector sum of external forces only for visualization
            vc1_ExtFO = []
            for i in xrange(int0_TrailNumber):
                vc0_ExtFO = rh.Vector3d(db1_ExtFOX[i],db1_ExtFOY[i],db1_ExtFOZ[i])
                vc1_ExtFO.append(vc0_ExtFO)
            
            # Add External Forces to the Form Diagram
            ln1_ExtFOEdge = []
            cl1_ExtFOEdge = []
            db1_ExtFOEdge = []
            
            for i in xrange(len(vc1_ExtFO)):
                ln1_ExtFOEdge.append(rh.Line(pt1_InputNode[i],(pt1_InputNode[i] + vc1_ExtFO[i])))
                cl1_ExtFOEdge.append(System.Drawing.Color.DarkGreen)
                db1_ExtFOEdge.append(abs(vc1_ExtFO[i].Length))
            
            # Extract Deviation Matrix
            db2_DevForceMag = []
            
            for i in xrange(g*int0_TrailNumber,(g+1)*int0_TrailNumber):
                db1_DevForceMag = []
                for j in xrange(3,int0_TrailNumber+3):
                    db1_DevForceMag.append((db2_StructuralBehaviour[i][j]))
                db2_DevForceMag.append(db1_DevForceMag)
            # Create Trail Length and Static Action Matrix from Input Origin Points
            db1_TrailLength = []
            db1_TrailStatAct = []
            
            for i in xrange(g*int0_TrailNumber,(g+1)*int0_TrailNumber):
                db1_TrailLength.append(db2_StructuralBehaviour[i][int0_TrailNumber+3])
                if g == 0:
                    db1_TrailStatAct.append(0)
                else:
                    db1_TrailStatAct.append(abs((db2_StructuralBehaviour[i-int0_TrailNumber][int0_TrailNumber+3]*vc1_TrailForceIn[i-g*int0_TrailNumber]).Length))
            
            
            # Calculate Hadamard Product of Deviation Length Matrix and Deviation Matrix
            vc2_DevForce = []
            db2_DevStatAct = []
            
            for i in xrange(int0_TrailNumber):
                vc1_DevForce = []
                db1_DevStatAct = []
                for j in xrange(int0_TrailNumber):
                    vc0_DevForce = vc2_DevUnitVector[i][j]*db2_DevForceMag[i][j]
                    db0_DevStatAct = abs((vc2_DevLengthVector[i][j]*db2_DevForceMag[i][j]).Length)
                    vc1_DevForce.append(vc0_DevForce)
                    db1_DevStatAct.append(db0_DevStatAct)
                vc2_DevForce.append(vc1_DevForce)
                db2_DevStatAct.append(db1_DevStatAct)
            
            
            # Sum Deviation Vectors and Static Action per each Node
            vc1_DevForceSum = []
            db1_DevStatActSum = []
            db1_IndDevStatActSum = []
            
            for i in xrange(int0_TrailNumber):
                vc0_DevForceSum = rh.Vector3d(0,0,0)
                db0_DevStatActSum = 0
                for j in xrange(int0_TrailNumber):
                    vc0_DevForceSum += vc2_DevForce[i][j]
                    db0_DevStatActSum += db2_DevStatAct[i][j]
                vc1_DevForceSum.append(vc0_DevForceSum)
                db1_DevStatActSum.append(db0_DevStatActSum)
            # Get Static Action per Node for Indirect Deviations
            # Start Node of Inderect Deviations
            if specWeight and yieldStress and len(xx1_Bracing) >0:
                int1_StartBracingIndex = []
                int1_EndBracingIndex = []
                db1_BracingValue = []
                for i in xrange(0,len(xx1_Bracing),3):
                    int1_StartBracingIndex.append(int(xx1_Bracing[i]))
                    int1_EndBracingIndex.append(int(xx1_Bracing[i+1]))
                    db1_BracingValue.append(float(xx1_Bracing[i+2]))
                for i in xrange(int0_TrailNumber):
                    if int0_Counter != 0:
                        int1_StartBracingIndex_C = int1_StartBracingIndex[:]
                        int1_EndBracingIndex_C = int1_EndBracingIndex[:]
                        db1_BracingValue_C = db1_BracingValue[:]
                        db0_IndDevStatActSum = 0
                        for j in int1_StartBracingIndex:
                            if g*int0_TrailNumber + i == j:
                                int0_StartBracingIndex = int1_StartBracingIndex_C.index(g*int0_TrailNumber + i)
                                int0_StartBracingGlobIndex = g*int0_TrailNumber + i
                                int0_EndBracingGlobIndex = int1_EndBracingIndex_C[ int0_StartBracingIndex ]
                                db0_ValueBracingGlobIndex = db1_BracingValue_C[ int0_StartBracingIndex ]
                                int1_StartBracingIndex_C.pop( int0_StartBracingIndex )
                                int1_EndBracingIndex_C.pop( int0_StartBracingIndex )
                                db1_BracingValue_C.pop( int0_StartBracingIndex )
                                # Get Start and End Nodes of Bracing
                                int0_StartBracingLayer = g
                                int0_StartBracingTrail = i
                                int0_EndBracingLayer = int0_EndBracingGlobIndex // int0_TrailNumber
                                int0_EndBracingTrail = int0_EndBracingGlobIndex % int0_TrailNumber
                                pt0_StartBracing = pt2_GlobNodeIteration[int0_StartBracingLayer][int0_StartBracingTrail]
                                pt0_EndBracing = pt2_GlobNodeIteration[int0_EndBracingLayer][int0_EndBracingTrail]
                                db0_IndDevStatActSum += abs(db0_ValueBracingGlobIndex*pt0_StartBracing.DistanceTo(pt0_EndBracing))
                        db1_IndDevStatActSum.append(db0_IndDevStatActSum)
                            
                # End Node of Inderect Deviations
                int1_StartBracingIndex = []
                int1_EndBracingIndex = []
                db1_BracingValue = []
                for i in xrange(1,len(xx1_Bracing),3):
                    int1_StartBracingIndex.append(int(xx1_Bracing[i-1]))
                    int1_EndBracingIndex.append(int(xx1_Bracing[i]))
                    db1_BracingValue.append(float(xx1_Bracing[i+1]))
                for i in xrange(int0_TrailNumber):
                    if int0_Counter != 0:
                        int1_StartBracingIndex_C = int1_StartBracingIndex[:]
                        int1_EndBracingIndex_C = int1_EndBracingIndex[:]
                        db1_BracingValue_C = db1_BracingValue[:]
                        db0_IndDevStatActSum = 0
                        for j in int1_EndBracingIndex:
                            if g*int0_TrailNumber + i == j:
                                int0_EndBracingIndex = int1_EndBracingIndex_C.index(g*int0_TrailNumber + i)
                                int0_EndBracingGlobIndex = g*int0_TrailNumber + i
                                int0_StartBracingGlobIndex = int1_StartBracingIndex_C[ int0_EndBracingIndex ]
                                db0_ValueBracingGlobIndex = db1_BracingValue_C[ int0_EndBracingIndex ]
                                int1_StartBracingIndex_C.pop( int0_EndBracingIndex )
                                int1_EndBracingIndex_C.pop( int0_EndBracingIndex )
                                db1_BracingValue_C.pop( int0_EndBracingIndex )
                                # Get Start and End Nodes of Bracing
                                int0_EndBracingLayer = g
                                int0_EndBracingTrail = i
                                int0_StartBracingLayer = int0_StartBracingGlobIndex // int0_TrailNumber
                                int0_StartBracingTrail = int0_StartBracingGlobIndex % int0_TrailNumber
                                pt0_StartBracing = pt2_GlobNodeIteration[int0_StartBracingLayer][int0_StartBracingTrail]
                                pt0_EndBracing = pt2_GlobNodeIteration[int0_EndBracingLayer][int0_EndBracingTrail]
                                db0_IndDevStatActSum += abs(db0_ValueBracingGlobIndex*pt0_StartBracing.DistanceTo(pt0_EndBracing))
                        db1_IndDevStatActSum[i] += db0_IndDevStatActSum
            else:
                db1_IndDevStatActSum = [0.0 for i in range(int0_TrailNumber)]
            # Construct Equilibrium per each Node
            vc1_TrailForceOut = []
            vc1_SelfWeight = []
            for i in xrange(int0_TrailNumber):
                if len(xx1_Bracing) > 0 and int0_Counter == 0:
                    db1_IndDevStatActSum = [0.0 for i in range(int0_TrailNumber)]
                if specWeight and yieldStress:
                    vc0_SelfWeight = rh.Vector3d(((db1_TrailStatAct[i] + db1_DevStatActSum[i]/2 + db1_IndDevStatActSum[i]/2 )*specWeight/yieldStress)*(-rh.Vector3d.ZAxis))
                    vc0_TrailForceOut = -(vc1_ExtForce[i] + vc1_DevForceSum[i] + vc1_TrailForceIn[i] + vc0_SelfWeight)
                    vc1_TrailForceOut.append(vc0_TrailForceOut)
                    vc1_SelfWeight.append(vc0_SelfWeight)
                else:
                    vc0_TrailForceOut = -(vc1_ExtForce[i] + vc1_DevForceSum[i] + vc1_TrailForceIn[i])
                    vc1_TrailForceOut.append(vc0_TrailForceOut)
    
            
            # Add Self Weight to the Form Diagram
            # external force plus self-weight
            for i in xrange(len(vc1_SelfWeight)):
                ln1_ExtFOEdge.append(rh.Line(pt1_InputNode[i],(pt1_InputNode[i] + vc1_SelfWeight[i])))
                cl1_ExtFOEdge.append(System.Drawing.Color.DarkGreen)
                db1_ExtFOEdge.append(abs(vc1_SelfWeight[i].Length))
            
            
            ## Construction Form Diagram
            
            # Find New Nodes
           
            pt1_Node = []
            for i in xrange(int0_TrailNumber):
                vc0_TrailForceOutUn = rh.Vector3d(vc1_TrailForceOut[i])
                rh.Vector3d.Unitize(vc0_TrailForceOutUn)
                ln0_TrailOut = rh.Line(pt1_InputNode[i],vc0_TrailForceOutUn)
                pt0_Node = pt1_InputNode[i] + vc0_TrailForceOutUn*db1_TrailLength[i]
                pt1_Node.append(pt0_Node)
                
                # Modify result in case of constraint planes
                if pl1_ConstraintPlane:
                    if g != int0_LayerCount-1:
                        for j in xrange(len(id_NodePlane)):
                            if int(str1_NodeOrderC[((g+1)*int0_TrailNumber)+i]) == int(id_NodePlane[j]):
                                pl0_PlaneTrailOut = pl1_ConstraintPlane[j]
                                if pl0_PlaneTrailOut is not None:
                                    xx1_Intersect = rh.Intersect.Intersection.LinePlane(ln0_TrailOut,pl0_PlaneTrailOut)
                                    bl0_Intersect = xx1_Intersect[0]
                                    db0_Intersect = xx1_Intersect[1]
                                    if abs(db0_Intersect) < abs(db0_Threshold):
                                        db1_TrailLength[i] = 0.0
                                        pt0_Node = pt1_InputNode[i]
                                    if bl0_Intersect and abs(db0_Intersect) > abs(db0_Threshold):
                                        pt0_Node = ln0_TrailOut.PointAt(db0_Intersect)
                                        db1_TrailLength[i] = pt1_InputNode[i].DistanceTo(pt0_Node)*db0_Intersect/abs(db0_Intersect)
                        pt1_Node[len(pt1_Node)-1] = pt0_Node
                
            # Build Trail Edges
            ln1_TrailEdge = []
            cl1_TrailEdge = []
            db1_TrailEdge = []
            
            for i in xrange(int0_TrailNumber):
                ln0_TrailEdge = rh.Line(pt1_InputNode[i],pt1_Node[i])
                ln1_TrailEdge.append(ln0_TrailEdge)
                if db1_TrailLength[i] > 0:
                    cl1_TrailEdge.append(System.Drawing.Color.Red)
                elif db1_TrailLength[i] < 0:
                    cl1_TrailEdge.append(System.Drawing.Color.Blue)
                else:
                    cl1_TrailEdge.append(System.Drawing.Color.Black)
                db1_TrailEdge.append(abs(vc1_TrailForceOut[i].Length))
    
            # Build Deviation Edges
            ln1_Deviation1Edge = []
            cl1_Deviation1Edge = []
            db1_Deviation1Edge = []
            k = 3
            
            for i in xrange(g*int0_TrailNumber,(g+1)*int0_TrailNumber):
                k += 1
                for j in xrange(k,int0_TrailNumber+3):
                    if db2_StructuralBehaviour[i][j] != 0:
                        ln0_Deviation1Edge = rh.Line(pt1_InputNode[i % int0_TrailNumber],pt1_InputNode[j-3])
                        ln1_Deviation1Edge.append(ln0_Deviation1Edge)
                        if db2_StructuralBehaviour[i][j] > 0:
                            cl1_Deviation1Edge.append(System.Drawing.Color.Red)
                        else:
                            cl1_Deviation1Edge.append(System.Drawing.Color.Blue)
                        db1_Deviation1Edge.append(abs(db2_StructuralBehaviour[i][j]))
            
            vc2_GlobTrailForce.append(vc1_TrailForceOut)
            
            # Form Diagram
            ln2_GlobTrailEdge.append(ln1_TrailEdge)
            db2_GlobTrailEdge.append(db1_TrailEdge)
            ln2_GlobDeviation1Edge.append(ln1_Deviation1Edge)
            cl2_GlobDeviation1Edge.append(cl1_Deviation1Edge)
            db2_GlobDeviation1Edge.append(db1_Deviation1Edge)
            ln2_GlobExtFOEdge.append(ln1_ExtFOEdge)
            cl2_GlobExtFOEdge.append(cl1_ExtFOEdge)
            db2_GlobExtFOEdge.append(db1_ExtFOEdge)
            pt2_GlobNode.append(pt1_Node)
            cl2_GlobTrailEdge.append(cl1_TrailEdge)
    
            g += 1
        
        # Add Reactions to Form Diagram
        for i in xrange(len(vc2_GlobTrailForce[g-1])):
            if specWeight and yieldStress:
                vc0_SelfWeight = (abs(vc2_GlobTrailForce[g-1][i].Length*ln2_GlobTrailEdge[g-1][i].Length)*specWeight/yieldStress)*(-rh.Vector3d.ZAxis)
                if cl2_GlobTrailEdge[g-1][i] != System.Drawing.Color.Blue:
                    ln1_ExtFOEdge.append(rh.Line(pt2_GlobNode[g-1][i],(pt2_GlobNode[g-1][i] + vc2_GlobTrailForce[g-1][i] + vc0_SelfWeight)))
                    db1_ExtFOEdge.append(abs(ln1_ExtFOEdge[len(ln1_ExtFOEdge)-1].Length))
                else:
                    ln1_ExtFOEdge.append(rh.Line((pt2_GlobNode[g-1][i] - vc2_GlobTrailForce[g-1][i] + vc0_SelfWeight),pt2_GlobNode[g-1][i]))
                    db1_ExtFOEdge.append(abs(ln1_ExtFOEdge[len(ln1_ExtFOEdge)-1].Length))
            else:
                if cl2_GlobTrailEdge[g-1][i] != System.Drawing.Color.Blue:
                    ln1_ExtFOEdge.append(rh.Line(pt2_GlobNode[g-1][i],(pt2_GlobNode[g-1][i] + vc2_GlobTrailForce[g-1][i])))
                    db1_ExtFOEdge.append(abs(ln1_ExtFOEdge[len(ln1_ExtFOEdge)-1].Length))
                else:
                    ln1_ExtFOEdge.append(rh.Line((pt2_GlobNode[g-1][i] - vc2_GlobTrailForce[g-1][i]),pt2_GlobNode[g-1][i]))
                    db1_ExtFOEdge.append(abs(ln1_ExtFOEdge[len(ln1_ExtFOEdge)-1].Length))
            cl1_ExtFOEdge.append(System.Drawing.Color.DarkGreen)
    
        # Update Counter
        int0_Counter += 1
        
        return
    
    # Initialization of Nodes' Position
    
    for j in xrange(int0_LayerCount+1):
        pt1_GlobNodeIteration = []
        pt2_GlobNodeIteration.append(pt1_GlobNodeIteration)
    
    # Initial Check
    int0_StructuralLayersMatrix = int(len(db1_StructuralBehaviour)/(3+len(pt1_OriginNode)+1)/len(pt1_OriginNode))
    if db1_StructuralBehaviour == None or int0_StructuralLayersMatrix == 0:
        print(str("Please input Matrix of Structural Behaviour"))
        if len(pt1_OriginNode) == 0:
            print(str("Please input Origin Points"))
    else:
        if len(pt1_OriginNode) == 0:
            print(str("Please input Origin Points"))
        else:
            str0_Description = ""
            str0_Description += "Iteration report"
            
            # Start Iteration
            while int0_Counter < int0_CounterBracing and db0_Divergence > db0_Threshold:
                
                # Call Main Function
                Main(db1_StructuralBehaviour, xx1_Bracing, pt1_OriginNode, pl1_ConstraintPlane)
                
                
                
                # Store Nodes' Position
                pt2_GlobNodeIteration[0] = pt1_OriginNode
                for j in xrange(1,len(pt2_GlobNode)+1):
                    if int0_Counter-1 != 0:
                        db0_Divergence = 0
                        for k in xrange(len(pt2_GlobNode[j-1])):
                            db0_Divergence += pt2_GlobNode[j-1][k].DistanceTo(pt2_GlobNodeIteration[j][k])
                    pt2_GlobNodeIteration[j] = pt2_GlobNode[j-1]
                
                str0_Description += "\n\niteration N: " + str(int0_Counter) + "\n"
                if len(xx1_Bracing) == 0:
                    db0_Divergence = 0.00
                str0_Description += "divergence: " + str(db0_Divergence)
                if int0_Counter < int0_CounterBracing and db0_Divergence > db0_Threshold:
                    # Re-Inatialize Global Variables
                    dbl0_Divergence = 0
                    vc2_GlobTrailForce = []
                    ln2_GlobExtEdge = []
                    pt2_GlobNode = []
                    ln2_GlobTrailEdge = []
                    cl2_GlobTrailEdge = []
                    db2_GlobTrailEdge = []
                    ln2_GlobDeviation1Edge = []
                    cl2_GlobDeviation1Edge = []
                    db2_GlobDeviation1Edge = []
                    ln2_GlobDeviation2Edge = []
                    cl2_GlobDeviation2Edge = []
                    db2_GlobDeviation2Edge = []
                    ln2_GlobExtFOEdge = []
                    cl2_GlobExtFOEdge = []
                    db2_GlobExtFOEdge = []
                
                if int0_Counter == int0_CounterBracing or db0_Divergence < db0_Threshold:
                    
                    # Add Bracing
                    ln1_Deviation2Edge = []
                    cl1_Deviation2Edge = []
                    db1_Deviation2Edge = []
                    for i in xrange(0,len(xx1_Bracing),3):
                        int0_BracingFromLayerIndex = int(xx1_Bracing[i]) // int0_TrailNumber
                        int0_BracingFromTrailIndex = int(xx1_Bracing[i]) % int0_TrailNumber
                        int0_BracingToLayerIndex = int(xx1_Bracing[i+1]) // int0_TrailNumber
                        int0_BracingToTrailIndex = int(xx1_Bracing[i+1]) % int0_TrailNumber
                        ln0_Deviation2Edge = rh.Line(pt2_GlobNodeIteration[int0_BracingFromLayerIndex][int0_BracingFromTrailIndex],pt2_GlobNodeIteration[int0_BracingToLayerIndex][int0_BracingToTrailIndex])
                        ln1_Deviation2Edge.append(ln0_Deviation2Edge)
                        if float(xx1_Bracing[i+2]) > 0:
                            cl1_Deviation2Edge.append(System.Drawing.Color.Red)
                        elif float(xx1_Bracing[i+2]) < 0:
                            cl1_Deviation2Edge.append(System.Drawing.Color.Blue)
                        else:
                            cl1_Deviation2Edge.append(System.Drawing.Color.Black)
                        db1_Deviation2Edge.append(abs(xx1_Bracing[i+2]))
    
                    ### OUTMUT
    
                    ln1_GlobExtEdgeOut = ListListToList(ln2_GlobExtEdge)
                    pt1_GlobNodeOut = ListListToList(pt2_GlobNodeIteration)
                    ln1_GlobTrailEdgeOut = ListListToList(ln2_GlobTrailEdge)
                    cl1_GlobTrailEdgeOut = ListListToList(cl2_GlobTrailEdge)
                    db1_GlobTrailEdgeOut = ListListToList(db2_GlobTrailEdge)
                    ln1_GlobDeviation1EdgeOut = ListListToList(ln2_GlobDeviation1Edge)
                    cl1_GlobDeviation1EdgeOut = ListListToList(cl2_GlobDeviation1Edge)
                    db1_GlobDeviation1EdgeOut = ListListToList(db2_GlobDeviation1Edge)
                    ln1_GlobDeviation2EdgeOut = ln1_Deviation2Edge
                    cl1_GlobDeviation2EdgeOut = cl1_Deviation2Edge
                    db1_GlobDeviation2EdgeOut = db1_Deviation2Edge
                    ln1_GlobExtFOEdgeOut = ListListToList(ln2_GlobExtFOEdge)
                    cl1_GlobExtFOEdgeOut = ListListToList(cl2_GlobExtFOEdge)
                    db1_GlobExtFOEdgeOut = ListListToList(db2_GlobExtFOEdge)
                    
                    M.ln1_GlobExtEdgeOut = ln1_GlobExtEdgeOut
                    M.pt1_GlobNodeOut = pt1_GlobNodeOut
                    M.ln1_GlobTrailEdgeOut = ln1_GlobTrailEdgeOut
                    M.cl1_GlobTrailEdgeOut = cl1_GlobTrailEdgeOut
                    M.db1_GlobTrailEdgeOut = db1_GlobTrailEdgeOut
                    M.ln1_GlobDeviation1EdgeOut = ln1_GlobDeviation1EdgeOut
                    M.cl1_GlobDeviation1EdgeOut = cl1_GlobDeviation1EdgeOut
                    M.db1_GlobDeviation1EdgeOut = db1_GlobDeviation1EdgeOut
                    M.ln1_GlobDeviation2EdgeOut = ln1_GlobDeviation2EdgeOut
                    M.cl1_GlobDeviation2EdgeOut = cl1_GlobDeviation2EdgeOut
                    M.db1_GlobDeviation2EdgeOut = db1_GlobDeviation2EdgeOut
                    M.ln1_GlobExtFOEdgeOut = ln1_GlobExtFOEdgeOut
                    M.cl1_GlobExtFOEdgeOut = cl1_GlobExtFOEdgeOut
                    M.db1_GlobExtFOEdgeOut = db1_GlobExtFOEdgeOut
                    M.str1_NodeOrderOut = str1_NodeOrderC
                    M.str1_EdgeOut = str1_Edge

            print str0_Description
# ---------- end combinatorialequilibriummodelling_1_30_p ----------
# ----
panel_3 = Panel(combinatorialequilibriummodelling_1_30_p.M)
panel_4 = Panel(combinatorialequilibriummodelling_1_30_p.out)

# ---- group: Visualization
scale_external_forces = Slider(0, range=0..1)
text_size = Slider(0, range=0..1)
edge_thickness = Slider(0.007, range=0..1)
visualization = Visualization_2(M=combinatorialequilibriummodelling_1_30_p.M, db0_scale_extforce=scale_external_forces)  # -> gm1_formdiagram, cl1_formdiagram, db1_forcemagn, pt1_formnode, str1_nodeorderout
multiplication_2 = Multiplication(A=visualization.db1_forcemagn, B=edge_thickness)
preview_thickness = CSharpScript(
    ln0_E_v=visualization.gm1_formdiagram,
    cl0_E_v=visualization.cl1_formdiagram,
    pt0_N_v=visualization.pt1_formnode,
    st0_N_v=visualization.str1_nodeorderout,
    db0_Txt_Size=text_size,
    db0_Line_Thick=multiplication_2)  # inputs ln0_E_v: Line, cl0_E_v: Color, pt0_N_v: Point3d, st0_N_v: String, db0_Txt_Size: Double, db0_Line_Thick: Double
# ---------- preview_thickness: C# usings ----------
using System.IO;
using System.Linq;
using System.Data;
using System.Drawing;
using System.Reflection;
using System.Windows.Forms;
using System.Xml;
using System.Xml.Linq;
using System.Runtime.InteropServices;

using Rhino.DocObjects;
using Rhino.Collections;
using GH_IO;
using GH_IO.Serialization;
# ---------- preview_thickness: C# ----------
    ln1_Edge_t.Add(ln0_E_v);
    cl1_Color_Edge_t.Add(cl0_E_v);
    pt1_Vertex_t.Add(pt0_N_v);
    st1_Tag_Vertex_t.Add(st0_N_v);
    db1_Txt_Size_t.Add(db0_Txt_Size);
    db1_Line_Thick_t.Add(db0_Line_Thick);
# ---------- preview_thickness: C# additional code ----------
  private readonly List<Line> ln1_Edge_t = new List<Line>();
  private readonly List<Color> cl1_Color_Edge_t = new List<Color>();
  private readonly List<Point3d> pt1_Vertex_t = new List<Point3d>();
  private readonly List<string> st1_Tag_Vertex_t = new List<string>();
  private readonly List<double> db1_Txt_Size_t = new List<double>();
  private readonly List<double> db1_Line_Thick_t = new List<double>();

  public override void BeforeRunScript()
  {
    ln1_Edge_t.Clear();
    cl1_Color_Edge_t.Clear();
    pt1_Vertex_t.Clear();
    st1_Tag_Vertex_t.Clear();
    db1_Txt_Size_t.Clear();
    db1_Line_Thick_t.Clear();
  }

  public override BoundingBox ClippingBox
  {
    get
    {
      return BoundingBox.Empty;
    }
  }
  public override void DrawViewportWires(IGH_PreviewArgs args)
  {

    Plane pl0_Plane_Edge;
    args.Viewport.GetFrustumFarPlane(out pl0_Plane_Edge);

    for (int int0_i = 0; int0_i < ln1_Edge_t.Count; int0_i++)
    {
      Line ln0_Edge = ln1_Edge_t[int0_i];
      Color cl0_Color_Edge = cl1_Color_Edge_t[int0_i];
      double db0_Txt_Size = db1_Txt_Size_t[int0_i];
      double db0_Line_Thick = db1_Line_Thick_t[int0_i];

      args.Display.DrawLine(ln0_Edge, cl0_Color_Edge, Convert.ToInt32(1 + 10 * db0_Line_Thick));
    }

    if (st1_Tag_Vertex_t.Count == 0)
      return;

    Plane pl0_Plane_Vertex;
    args.Viewport.GetFrustumFarPlane(out pl0_Plane_Vertex);

    for (int int0_i = 0; int0_i < st1_Tag_Vertex_t.Count; int0_i++)
    {
      Point3d pt0_Vertex = pt1_Vertex_t[int0_i];
      string st0_Text_Vertex = st1_Tag_Vertex_t[int0_i];
      pl0_Plane_Vertex.Origin = pt0_Vertex;
      double db0_Txt_Size = db1_Txt_Size_t[int0_i];

      args.Display.DrawPoint(pt0_Vertex, Rhino.Display.PointStyle.Circle, (int) (20 * db0_Txt_Size), System.Drawing.Color.Black);
      Rhino.Display.Text3d drawText = new Rhino.Display.Text3d(st0_Text_Vertex, pl0_Plane_Vertex, db0_Txt_Size);
      args.Display.Draw3dText(drawText, System.Drawing.Color.Black);
      drawText.Dispose();
    }
  }
# ---------- end preview_thickness ----------
preview = CustomPreview(Geometry=visualization.gm1_formdiagram, Material=visualization.cl1_formdiagram)

# ==== cluster Cluster
line = ClusterInput()
# Automatic Planes from Top-DIAGRAM
num = ClusterInput()
num_2 = ClusterInput()
num_3 = ClusterInput()
line_2 = Line(line)
num_4 = Number(num)
num_5 = Number(num_2)
num_6 = Number(num_3)
split = SplitList(List=line_2, Index=1)  # -> ListA, ListB
split_2 = SplitList(List=reverse(split.ListB), Index=1)  # -> ListA, ListB
split_3 = SplitList(List=split_2.ListB, Index=1)  # -> ListA, ListB
line_3 = Line(split.ListA)
line_4 = Line(split_3.ListB)
line_5 = Line(split_3.ListA)
explode = Explode(Curve=line_3, Recursive=True)  # -> Segments, Vertices
explode_2 = Explode(Curve=line_4, Recursive=True)  # -> Segments, Vertices
explode_3 = Explode(Curve=line_5, Recursive=True)  # -> Segments, Vertices
dev_t12_m = Line(flatten(explode_2.Segments))
dev_t12_end = Line(flatten(explode_3.Segments))
dev_t12_start = Line(flatten(explode.Segments))
python = GhPythonScript(
    start=flatten(dev_t12_start),
    m=flatten(dev_t12_m),
    end=flatten(dev_t12_end),
    para_Start=num_6,
    para_m=num_5,
    para_End=num_4)  # -> out, lines, attributes; inputs start: list of Line, m: list of Line, end: list of Line
# ---------- python: Python ----------
__author__ = "opatrick"
__version__ = "2018.09.14"

def shift_left(lst, n):
    """Shifts the lst over by n indices

    >>> lst = [1, 2, 3, 4, 5]
    >>> shift_left(lst, 2)
    >>> lst
    [3, 4, 5, 1, 2]
    """
    assert (n > 0), "n should be non-negative integer"
    def shift(ntimes):
        if ntimes == 0:
            return
        else:
            temp = lst[0]
            for index in range(len(lst) - 1):
                lst[index] = lst[index + 1]         
            lst[index + 1] = temp
            return shift(ntimes-1)
    return shift(n)



import rhinoscriptsyntax as rs
import math
lines = []
attributes = []



for i in xrange(0,len(start),1):
    if para_Start != 0:
        lines.append(start[i])
        attributes.append(para_Start)


for i in xrange(0,len(m),1):
    if para_m != 0:
        lines.append(m[i])
        attributes.append(para_m)

for i in xrange(0,len(end),1):
    if para_End != 0:
        lines.append(end[i])
        attributes.append(para_End)
# ---------- end python ----------
lines = ClusterOutput(python.lines)
attributes = ClusterOutput(python.attributes)

# ==== cluster Cluster_2
lines = ClusterInput()
lines_2 = Line(lines)
line = Line(lines_2)
num = ClusterInput()
num_2 = ClusterInput()
num_3 = ClusterInput()
flip = FlipMatrix(Data=line)
num_4 = Number(num)
num_5 = Number(num_2)
num_6 = Number(num_3)
split = SplitList(List=flip, Index=1)  # -> ListA, ListB
split_2 = SplitList(List=reverse(split.ListB), Index=1)  # -> ListA, ListB
line_2 = Line(split.ListA)
line_3 = Line(split_2.ListB)
line_4 = Line(split_2.ListA)
explode = Explode(Curve=line_2, Recursive=True)  # -> Segments, Vertices
explode_2 = Explode(Curve=line_4, Recursive=True)  # -> Segments, Vertices
explode_3 = Explode(Curve=line_3, Recursive=True)  # -> Segments, Vertices
dev_t12_m = Line(flatten(explode_3.Segments))
dev_t12_end = Line(flatten(explode_2.Segments))
dev_t12_start = Line(flatten(explode.Segments))
python = GhPythonScript(
    start=flatten(dev_t12_start),
    m=flatten(dev_t12_m),
    end=flatten(dev_t12_end),
    para_Start=num_6,
    para_m=num_5,
    para_End=num_4)  # -> out, lines, attributes; inputs start: list of Line, m: list of Line, end: list of Line
# ---------- python: Python ----------
__author__ = "opatrick"
__version__ = "2018.09.14"

import rhinoscriptsyntax as rs
lines = []
attributes = []

for i in xrange(0,len(start),1):
    if para_Start != 0:
        lines.append(start[i])
        attributes.append(para_Start)
        
for i in xrange(0,len(m),1):
    if para_m != 0:
        lines.append(m[i])
        attributes.append(para_m)

for i in xrange(0,len(end),1):
    if para_End != 0:
        lines.append(end[i])
        attributes.append(para_End)
# ---------- end python ----------
lines_3 = ClusterOutput(python.lines)
attributes = ClusterOutput(python.attributes)

# ==== cluster Cluster_3
db0_originnodeampliz = ClusterInput()
int0_shiftpeak = ClusterInput()
localalpha_trail2 = ClusterInput()
localalpha_trail4 = ClusterInput()
localteta_trail2 = ClusterInput()
localteta_trail4 = ClusterInput()
distance_t1_t2 = ClusterInput()
distance_t1_t4 = ClusterInput()
freq = ClusterInput()
num = ClusterInput()
int = ClusterInput()
main_curve = ClusterInput()
S = ClusterInput()
num_2 = ClusterInput()
int_2 = ClusterInput()
int_3 = ClusterInput()
db0_originnodeampliz_2 = Number(db0_originnodeampliz)
localalpha_trail2_2 = Number(localalpha_trail2)
localalpha_trail4_2 = Number(localalpha_trail4)
localteta_trail2_2 = Number(localteta_trail2)
localteta_trail4_2 = Number(localteta_trail4)
distance_t1_t2_2 = Number(distance_t1_t2)
distance_t1_t4_2 = Number(distance_t1_t4)
int0_shiftpeak_2 = Integer(int0_shiftpeak)
number_slider = Slider(0.502, range=0..1)
freq_2 = ClusterInput()
main_curve_2 = Curve(main_curve)
int_4 = Integer(int)
int_5 = Integer(int_2)
num_3 = Number(num)
int_6 = Integer(int_3)
python = GhPythonScript(y=int_4, freq=freq)  # -> out, db2_amplitude
# ---------- python: Python ----------
__author__ = "opatrick"
__version__ = "2018.09.17"

import rhinoscriptsyntax as rs
import math
db2_amplitude = []
for x in xrange(0,y,1):
    stutz = (x*((2*freq)/y)*math.pi)
    amplitude = (math.sin(stutz))
    db2_amplitude.append((amplitude))
# ---------- end python ----------
A = ClusterInput()
rad = Radians(Degrees=localalpha_trail4_2)
rad_2 = Radians(Degrees=localteta_trail4_2)
division = Division(A=6.283185307, B=int_4)
neg = Negative(Value=localteta_trail2_2)
python_2 = GhPythonScript(y=int_4, freq=int_5)  # -> out, db2_amplitude
# ---------- python_2: Python ----------
__author__ = "opatrick"
__version__ = "2018.09.17"

import rhinoscriptsyntax as rs
import math
db2_amplitude = []
for x in xrange(0,y,1):
    stutz = (x*((2*freq)/y)*math.pi)
    amplitude = (math.cos(stutz))
    db2_amplitude.append(amplitude)
# ---------- end python_2 ----------
distance_t1_t3 = ClusterInput()
python_3 = GhPythonScript(y=int_4, freq=freq_2)  # -> out, db2_amplitude; same code as python_2
multiplication = Multiplication(A=python_2.db2_amplitude, B=db0_originnodeampliz_2)
multiplication_2 = Multiplication(A=python.db2_amplitude, B=num_3)
multiplication_3 = Multiplication(A=division, B=multiplication_2)
localalpha_trail3 = Number(localalpha_trail2_2)
localteta_trail3 = Number(neg)
distance_t1_t3_2 = Number(distance_t1_t3)
shift = ShiftList(List=multiplication_3, Shift=S, Wrap=True)
divide = DivideCurve(Curve=main_curve_2, Count=int_4, Kinks=False)  # -> Points, Tangents, Parameters
Z = UnitZ(Factor=multiplication)
shift_2 = ShiftList(List=Z, Shift=int0_shiftpeak_2, Wrap=True)
Z_2 = UnitZ(Factor=1)
panel = Panel(multiplication_2)
rev = Reverse(Vector=Z_2)
addition = Addition(A=divide.Parameters, B=shift)
rad_3 = Radians(Degrees=localteta_trail2_2)
multiplication_4 = Multiplication(A=A, B=python_3.db2_amplitude)
rad_4 = Radians(Degrees=localalpha_trail2_2)
rad_5 = Radians(Degrees=localalpha_trail3)
rad_6 = Radians(Degrees=localteta_trail3)
eval = EvaluateCurve(Curve=main_curve_2, Parameter=addition)  # -> Point, Tangent, Angle
originpoints_trails = Point(eval.Point)
move = Move(Geometry=originpoints_trails, Motion=shift_2)  # -> Geometry, Transform
pl = PlaneNormal(Origin=move.Geometry, ZAxis=eval.Tangent)
align = AlignPlane(Plane=pl, Direction=rev)  # -> Plane, Angle
pt = Point(move.Geometry)
multiplication_5 = Multiplication(A=multiplication_4, B=num_2)
P = ClusterOutput(eval.Point)
pl_origin = PlaneOrigin(Base=align.Plane, Origin=pt)
addition_2 = Addition(A=num_2, B=multiplication_5)
pln2_local_planes = Plane(pl_origin)
pt_2 = PointPolar(BasePlane=pln2_local_planes, XYAngle=rad_4, ZAngle=rad_3, Offset=distance_t1_t2_2)
pt_3 = PointPolar(BasePlane=pln2_local_planes, XYAngle=rad_5, ZAngle=rad_6, Offset=distance_t1_t3_2)
pt_4 = PointPolar(BasePlane=pln2_local_planes, XYAngle=rad, ZAngle=rad_2, Offset=distance_t1_t4_2)
deplane = DeconstructPlane(Plane=pln2_local_planes)  # -> Origin, XAxis, YAxis, ZAxis
num_4 = Number(num_2)
pt2_originstrails1 = Point(pt)
pt2_originstrails2 = Point(pt_2)
pt2_originstrails3 = Point(pt_3)
pt2_originstrails4 = Point(pt_4)
addition_3 = Addition(A=int_6, B=1)
addition_4 = Addition(A=addition_3, B=1)
line = LineSDL(Start=pt2_originstrails2, Direction=deplane.YAxis, Length=addition_2)
line_2 = LineSDL(Start=pt2_originstrails4, Direction=deplane.YAxis, Length=addition_2)
line_3 = LineSDL(Start=pt2_originstrails1, Direction=deplane.YAxis, Length=addition_2)
line_4 = LineSDL(Start=pt2_originstrails3, Direction=deplane.YAxis, Length=addition_2)
divide_2 = DivideCurve(Curve=line_3, Count=addition_4, Kinks=False)  # -> Points, Tangents, Parameters
divide_3 = DivideCurve(Curve=line, Count=addition_4, Kinks=False)  # -> Points, Tangents, Parameters
end = EndPoints(Curve=[line_3, line_4, line])  # -> Start, End
toggle = BooleanToggle(True)
divide_4 = DivideCurve(Curve=line_4, Count=addition_4, Kinks=False)  # -> Points, Tangents, Parameters
divide_5 = DivideCurve(Curve=line_2, Count=addition_4, Kinks=False)  # -> Points, Tangents, Parameters
flip = FlipMatrix(Data=divide_4.Points)
flip_2 = FlipMatrix(Data=divide_2.Points)
flip_3 = FlipMatrix(Data=divide_3.Points)
flip_4 = FlipMatrix(Data=divide_4.Points)
flip_5 = FlipMatrix(Data=divide_5.Points)
shift_3 = ShiftList(List=flip, Shift=1, Wrap=True)
dev_trails2 = PolyLine(Vertices=flip_3, Closed=toggle)
dev_trails1 = PolyLine(Vertices=flip_2, Closed=toggle)
dev_trails4 = PolyLine(Vertices=flip_5, Closed=toggle)
trails_1 = PolyLine(Vertices=divide_2.Points, Closed=False)
trails2 = PolyLine(Vertices=divide_3.Points, Closed=False)
dev_trails3 = PolyLine(Vertices=flip_4, Closed=toggle)
trails3 = PolyLine(Vertices=divide_4.Points, Closed=False)
trails4 = PolyLine(Vertices=divide_5.Points, Closed=False)
flip_6 = FlipMatrix(Data=shift_3)
shift_4 = ShiftList(List=divide_2.Points, Shift=1, Wrap=Toggle(False))
shift_5 = ShiftList(List=divide_2.Points, Shift=1, Wrap=Toggle(False))
flip_7 = FlipMatrix(Data=shift_4)
explode = Explode(Curve=trails_1, Recursive=True)  # -> Segments, Vertices
explode_2 = Explode(Curve=dev_trails2, Recursive=True)  # -> Segments, Vertices
explode_3 = Explode(Curve=dev_trails1, Recursive=True)  # -> Segments, Vertices
explode_4 = Explode(Curve=trails2, Recursive=True)  # -> Segments, Vertices
explode_5 = Explode(Curve=dev_trails3, Recursive=True)  # -> Segments, Vertices
explode_6 = Explode(Curve=dev_trails4, Recursive=True)  # -> Segments, Vertices
explode_7 = Explode(Curve=trails3, Recursive=True)  # -> Segments, Vertices
explode_8 = Explode(Curve=trails4, Recursive=True)  # -> Segments, Vertices
shift_6 = ShiftList(List=flip_7, Shift=1, Wrap=Toggle(True))
flip_8 = FlipMatrix(Data=shift_6)
flip_9 = FlipMatrix(Data=explode_2.Segments)
flip_10 = FlipMatrix(Data=explode_4.Segments)
flip_11 = FlipMatrix(Data=explode_3.Segments)
flip_12 = FlipMatrix(Data=explode_5.Segments)
flip_13 = FlipMatrix(Data=explode_6.Segments)
flip_14 = FlipMatrix(Data=explode_7.Segments)
flip_15 = FlipMatrix(Data=explode_8.Segments)
dev_t13_diag = Line(StartPoint=shift_5, EndPoint=divide_4.Points)
dev_t12_diag = Line(StartPoint=shift_5, EndPoint=divide_3.Points)
dev_t11_diag = Line(StartPoint=flip_8, EndPoint=divide_2.Points)
flip_16 = FlipMatrix(Data=explode.Segments)
dev_t24 = Line(StartPoint=divide_3.Points, EndPoint=divide_5.Points)
dev_t34 = Line(StartPoint=divide_4.Points, EndPoint=divide_5.Points)
dev_t23_ring = Line(StartPoint=divide_3.Points, EndPoint=flip_6)
dev_t14 = Line(StartPoint=divide_2.Points, EndPoint=divide_5.Points)
dev_t23 = Line(StartPoint=divide_3.Points, EndPoint=divide_4.Points)
dev_t13 = Line(StartPoint=divide_2.Points, EndPoint=divide_4.Points)
dev_t12 = Line(StartPoint=divide_2.Points, EndPoint=divide_3.Points)
int_7 = Integer(int_6)
line_5 = Line(flip_16)
line_6 = Line(flip_10)
line_7 = Line(flip_14)
line_8 = Line(flip_15)
line_9 = Line(flip_11)
line_10 = Line(flip_9)
line_11 = Line(flip_12)
line_12 = Line(flip_13)
line_13 = Line(dev_t12)
line_14 = Line(dev_t13)
line_15 = Line(dev_t23)
line_16 = Line(dev_t34)
line_17 = Line(dev_t24)
line_18 = Line(dev_t14)
line_19 = Line(dev_t23_ring)
line_20 = Line(dev_t12_diag)
line_21 = Line(dev_t13_diag)
line_22 = Line(dev_t11_diag)
int_8 = Integer(int_4)
int_9 = Integer(int_4)
int_10 = ClusterOutput(int_7)
line_23 = ClusterOutput(line_5)
line_24 = ClusterOutput(line_6)
line_25 = ClusterOutput(line_7)
line_26 = ClusterOutput(line_8)
line_27 = ClusterOutput(line_9)
line_28 = ClusterOutput(line_10)
line_29 = ClusterOutput(line_11)
line_30 = ClusterOutput(line_12)
line_31 = ClusterOutput(line_13)
line_32 = ClusterOutput(line_14)
line_33 = ClusterOutput(line_15)
line_34 = ClusterOutput(line_16)
line_35 = ClusterOutput(line_17)
line_36 = ClusterOutput(line_18)
line_37 = ClusterOutput(line_19)
line_38 = ClusterOutput(line_20)
line_39 = ClusterOutput(line_21)
line_40 = ClusterOutput(line_22)
int_11 = ClusterOutput(int_8)
int_12 = ClusterOutput(int_9)

# ==== cluster PlanesGroundLevelSupports
O = ClusterInput()
L = ClusterInput()
xy = XYPlane(Origin=O)
lng = ListLength(List=L)
dup = DuplicateData(Data=xy, Number=lng, Order=True)
series = Series(Start=0, Step=1, Count=lng)
L_2 = ClusterInput()
replace = ReplaceItems(List=reverse(L_2), Item=dup, Indices=series, Wrap=False)
rev = ReverseList(List=replace)
L_3 = ClusterOutput(rev)

# ==== cluster GroundLevelSupports
pt_groundlevel = ClusterInput()
int = ClusterInput()
data = ClusterInput()
pt_groundlevel_2 = Point(pt_groundlevel)
int_2 = Integer(int)
data_2 = Data(data)
lng = ListLength(List=data_2)
xy = XYPlane(Origin=pt_groundlevel_2)
split = SplitList(List=reverse(int_2), Index=lng)  # -> ListA, ListB
dup = DuplicateData(Data=xy, Number=lng, Order=True)
A = ClusterOutput(split.ListA)
D = ClusterOutput(dup)

# ==== cluster Visualization_2
db0_scale_extforce = ClusterInput()
M = ClusterInput()
cem = PythonScript(M=M)  # -> ln1_GlobTrailEdgeOut, cl1_GlobTrailEdgeOut, db1_GlobTrailEdgeOut, ln1_GlobDeviation1EdgeOut, cl1_GlobDeviation1EdgeOut, db1_GlobDeviation1EdgeOut, ln1_GlobDeviation2EdgeOut, cl1_GlobDeviation2EdgeOut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
# ---------- cem: Python ----------
ln1_GlobExtEdgeOut = M.ln1_GlobExtEdgeOut
pt1_GlobNodeOut = M.pt1_GlobNodeOut
ln1_GlobTrailEdgeOut = M.ln1_GlobTrailEdgeOut
cl1_GlobTrailEdgeOut = M.cl1_GlobTrailEdgeOut
db1_GlobTrailEdgeOut = M.db1_GlobTrailEdgeOut
ln1_GlobDeviation1EdgeOut = M.ln1_GlobDeviation1EdgeOut
cl1_GlobDeviation1EdgeOut = M.cl1_GlobDeviation1EdgeOut
db1_GlobDeviation1EdgeOut = M.db1_GlobDeviation1EdgeOut
ln1_GlobDeviation2EdgeOut = M.ln1_GlobDeviation2EdgeOut
cl1_GlobDeviation2EdgeOut = M.cl1_GlobDeviation2EdgeOut
db1_GlobDeviation2EdgeOut = M.db1_GlobDeviation2EdgeOut
ln1_GlobExtFOEdgeOut = M.ln1_GlobExtFOEdgeOut
cl1_GlobExtFOEdgeOut = M.cl1_GlobExtFOEdgeOut
db1_GlobExtFOEdgeOut = M.db1_GlobExtFOEdgeOut
str1_NodeOrderOut = M.str1_NodeOrderOut
str1_EdgeOut = M.str1_EdgeOut
# ---------- end cem ----------
merge = Merge(Data1=graft(cem.ln1_GlobTrailEdgeOut), Data2=graft(cem.cl1_GlobTrailEdgeOut), Data3=graft(cem.db1_GlobTrailEdgeOut))
merge_2 = Merge(
    Data1=graft(cem.ln1_GlobDeviation1EdgeOut),
    Data2=graft(cem.cl1_GlobDeviation1EdgeOut),
    Data3=graft(cem.db1_GlobDeviation1EdgeOut))
merge_3 = Merge(
    Data1=graft(cem.ln1_GlobDeviation2EdgeOut),
    Data2=graft(cem.cl1_GlobDeviation2EdgeOut),
    Data3=graft(cem.db1_GlobDeviation2EdgeOut))
merge_4 = Merge(Data1=graft(cem.ln1_GlobExtFOEdgeOut), Data2=graft(cem.cl1_GlobExtFOEdgeOut), Data3=graft(cem.db1_GlobExtFOEdgeOut))
visualization = Visualization(data=merge_3, data_2=merge, data_3=merge_2, data_4=merge_4, F=db0_scale_extforce)  # -> line, col, num, S
pt1_formnode = ClusterOutput(visualization.S)
gm1_formdiagram = ClusterOutput(visualization.line)
cl1_formdiagram = ClusterOutput(visualization.col)
db1_forcemagn = ClusterOutput(visualization.num)
str1_nodeorderout = ClusterOutput(cem.str1_NodeOrderOut)

# ==== cluster Visualization
data = ClusterInput()
data_2 = ClusterInput()
data_3 = ClusterInput()
data_4 = ClusterInput()
F = ClusterInput()
data_5 = Data(data)
data_6 = Data(data_2)
data_7 = Data(data_3)
data_8 = Data(data_4)
cluster = Cluster_4(data=data_8)  # -> line_2, col_2, num_2
cluster_2 = Cluster_4(data=data_5)  # -> line_2, col_2, num_2
cluster_3 = Cluster_4(data=data_6)  # -> line_2, col_2, num_2
cluster_4 = Cluster_4(data=data_7)  # -> line_2, col_2, num_2
end = EndPoints(Curve=flatten(cluster_3.line_2))  # -> Start, End
end_2 = EndPoints(Curve=cluster.line_2)  # -> Start, End
scale = Scale(Geometry=cluster.line_2, Center=end_2.Start, Factor=F)  # -> Geometry, Transform
col = ClusterOutput([cluster_2.col_2, cluster_3.col_2, cluster_4.col_2, cluster.col_2])
num = ClusterOutput([cluster_2.num_2, cluster_3.num_2, cluster_4.num_2, cluster.num_2])
S = ClusterOutput(end.Start)
line = ClusterOutput([cluster_2.line_2, cluster_3.line_2, cluster_4.line_2, scale.Geometry])

# ==== cluster Cluster_4
data = ClusterInput()
data_2 = Data(data)
item = ListItem(List=data_2, Index=0, Wrap=True)
item_2 = ListItem(List=data_2, Index=1, Wrap=True)
item_3 = ListItem(List=data_2, Index=2, Wrap=True)
line = Line(flatten(item))
col = Colour(flatten(item_2))
num = Number(flatten(item_3))
line_2 = ClusterOutput(line)
col_2 = ClusterOutput(col)
num_2 = ClusterOutput(num)
